# Grasshopper definition robot_back_support_ik_study-assembly_tool_v3.gh (Grasshopper 1.0.8)

jr_left = Slider(-3.14, range=-3.14..3.14)
bar_ocf_y = Slider(0, range=-1..1)

# ---- group: construct bar ocf
bar_ocf_x = Slider(-0.12, range=-1..1)
bar_ocf_z = Slider(1.22, range=0.5..2)
multiplication = Multiplication(A=bar_ocf_y, B=1000)
multiplication_2 = Multiplication(A=bar_ocf_x, B=1000)
multiplication_3 = Multiplication(A=bar_ocf_z, B=1000)
construct_point = ConstructPoint(XCoordinate=multiplication_2, YCoordinate=multiplication, ZCoordinate=multiplication_3)
unit_z = UnitZ(Factor=1)
unit_x = UnitX(Factor=1)
construct_plane = ConstructPlane(Origin=construct_point, XAxis=unit_z, YAxis=unit_x)
rotate = Rotate(Geometry=construct_plane, Angle=1.570796327, Plane=PlaneXY(0, 0, 0))  # -> Geometry, Transform

# ----
jp_left = Slider(-500, range=-500..500)
jr_right = Slider(-3.14, range=-3.14..3.14)
jp_right = Slider(325, range=-500..500)
bar_length_mm = Slider(1000, range=500..2000)
python_3_script = Python3Script(trigger=Button(), use_gui=Toggle(False), stop=Button())  # -> out, pb_running
# ---------- python_3_script: Python ----------
#! python 3
# venv: scaffolding_env
# r: numpy==1.24.4
# r: scipy==1.13.1
# r: compas==2.13.0
# r: compas_robots==0.6.0
# r: pybullet==3.2.7
# r: pybullet_planning==0.6.1
# NOTE: do NOT add `# r: compas_fab` -- compas_fab is loaded from the in-repo
# submodule via sys.path injection inside scripts/core/robot_cell.py.
"""C1: PyBullet lifecycle for the dual-arm IK GH workflow.

Inputs (GH params):
    trigger : bool       -- rising-edge starts the PyBullet client
    use_gui : bool       -- True for PyBullet debug GUI window
    stop    : bool       -- rising-edge stops the client (optional)

Outputs:
    pb_running : bool

Idempotent: re-running with `trigger=True` while a client is already up is a
no-op. Sticky cache is shared with the rs_* Rhino scripts (same keys), so
RSPBStart from the toolbar and this component are interchangeable.
"""

import os
import sys

# --- bootstrap: put `scripts/` on sys.path so `core.robot_cell` is importable.
# Importing `core.robot_cell` in turn prepends `external/compas_fab/src` to
# sys.path before anything imports `compas_fab` (see
# `core.robot_cell._ensure_submodule_compas_fab_loaded`).
REPO = os.path.normpath(os.path.join(os.path.dirname(__file__), "..", "..", "..", ".."))
SCRIPTS = os.path.join(REPO, "scripts")
if SCRIPTS not in sys.path:
    sys.path.insert(0, SCRIPTS)

from core import robot_cell  # noqa: E402


pb_running = robot_cell.is_pb_running()

if 'stop' in dir() and stop and pb_running:
    robot_cell.stop_pb_client()
    pb_running = False
elif trigger and not pb_running:
    robot_cell.start_pb_client(use_gui=bool(use_gui), verbose=True)
    pb_running = True

print(f"gh_init_pb: pb_running={pb_running}")
# ---------- end python_3_script ----------
panel = Panel(python_3_script.pb_running)
rotate_3d = Rotate3D(Angle=1.570796327, Center=Point(0, 0, 0), Axis=Vector(0, 0, 1))  # -> Geometry, Transform
query_model_block_definitions = QueryModelBlockDefinitions(Name="T20_Male", AutoUpdateState=True)
python_3_script_2 = Python3Script(
    pair_name="T20",
    bar_length_mm=bar_length_mm,
    bar_anchor_plane=rotate.Geometry,
    jp_left=jp_left,
    jr_left=jr_left,
    jp_right=jp_right,
    jr_right=jr_right)  # -> out, bar_curve, male_left_plane, male_right_plane, male_left_ocf_mm, male_right_ocf_mm; inputs pair_name: String, bar_length_mm: Double, bar_anchor_plane: Plane, jp_left: Double, jr_left: Double
# ---------- python_3_script_2: Python ----------
#! python 3
# venv: scaffolding_env
# r: numpy==1.24.4
# r: compas==2.13.0
"""C2: bar + two male-joint pose computation.

Inputs:
    pair_name        : str, default "T20"
    bar_length_mm    : float, default 2000.0
    bar_anchor_plane : Rhino.Geometry.Plane. **Origin = bar midpoint** (per
                       docs/coordinate_conventions.md §2). +Z = bar axis.
                       Defaults to WorldXY when None.
    jp_left, jr_left : float -- offset of left male from bar MIDPOINT along
                       bar Z (mm) and rotation about bar Z (rad). jp = 0 puts
                       the male AT the anchor; range [-L/2, +L/2] sweeps the
                       full bar.
    jp_right, jr_right : same for right male

Outputs:
    bar_curve         : Rhino.Geometry.LineCurve (doc units) -- bar centerline
    male_left_plane   : Rhino.Geometry.Plane (doc units)     -- left male block frame
    male_right_plane  : Rhino.Geometry.Plane (doc units)     -- right male block frame
    male_left_ocf_mm  : Rhino.Geometry.Transform (mm-tagged) -- pipe to C3
    male_right_ocf_mm : Rhino.Geometry.Transform (mm-tagged) -- pipe to C3

The OCF outputs are wrapped in `Rhino.Geometry.Transform` (not Python
nested lists) because GH decomposes list-of-lists across wires (item-access
receivers see only the first row). `Transform` is a single Rhino primitive
that GH carries atomically. The matrix entries are mm; downstream
components unpack with `_xform_raw_to_np_mm`.
"""

import os
import sys

import Rhino

REPO = os.path.normpath(os.path.join(os.path.dirname(__file__), "..", "..", "..", ".."))
SCRIPTS = os.path.join(REPO, "scripts")
if SCRIPTS not in sys.path:
    sys.path.insert(0, SCRIPTS)

import numpy as np

from core import joint_pair  # noqa: E402
from core.rhino_frame_io import doc_unit_scale_to_mm  # noqa: E402


def _plane_origin_xaxis_yaxis_mm(plane, scale_to_mm):
    o = plane.Origin
    x = plane.XAxis
    y = plane.YAxis
    z = plane.ZAxis
    origin_mm = np.array([o.X, o.Y, o.Z], dtype=float) * scale_to_mm
    return origin_mm, np.array([x.X, x.Y, x.Z]), np.array([y.X, y.Y, y.Z]), np.array([z.X, z.Y, z.Z])


def _mm_matrix_to_rhino_plane(matrix_mm, scale_from_mm):
    origin_doc = np.asarray(matrix_mm[:3, 3], dtype=float) * scale_from_mm
    plane = Rhino.Geometry.Plane(
        Rhino.Geometry.Point3d(float(origin_doc[0]), float(origin_doc[1]), float(origin_doc[2])),
        Rhino.Geometry.Vector3d(float(matrix_mm[0, 0]), float(matrix_mm[1, 0]), float(matrix_mm[2, 0])),
        Rhino.Geometry.Vector3d(float(matrix_mm[0, 1]), float(matrix_mm[1, 1]), float(matrix_mm[2, 1])),
    )
    return plane


def _np_mm_to_xform_raw(matrix_mm):
    """Pack a 4x4 numpy (mm) into a Rhino.Geometry.Transform without unit
    conversion. Used as a GH wire transport; downstream unwraps with
    `_xform_raw_to_np_mm`. NOT the same as `rs_ik_keyframe._np_mm_to_rhino_xform`
    -- that helper bakes a doc-unit Transform for actual geometry transforms.
    """
    xf = Rhino.Geometry.Transform(1.0)
    for i in range(4):
        for j in range(4):
            xf[i, j] = float(matrix_mm[i, j])
    return xf


pair = joint_pair.get_joint_pair(str(pair_name) if pair_name else "T20")
length_mm = float(bar_length_mm) if bar_length_mm is not None else 2000.0
anchor = bar_anchor_plane if bar_anchor_plane is not None else Rhino.Geometry.Plane.WorldXY

scale_to_mm = doc_unit_scale_to_mm()
scale_from_mm = 1.0 / scale_to_mm

origin_mm, _xa, _ya, z_unit = _plane_origin_xaxis_yaxis_mm(anchor, scale_to_mm)
half_length_mm = length_mm * 0.5
# Anchor.Origin == bar MIDPOINT (per docs/coordinate_conventions.md §2).
# Build the bar symmetrically about the anchor.
bar_start_mm = origin_mm - z_unit * half_length_mm
bar_end_mm = origin_mm + z_unit * half_length_mm

bar_frame_mm = joint_pair.canonical_bar_frame_from_line(bar_start_mm, bar_end_mm)

# `canonical_bar_frame_from_line` puts bar_frame.origin at bar_start, so the
# internal jp is measured from bar_start. We want user-facing jp measured
# from the bar MIDPOINT (jp_user = 0 -> joint AT anchor); shift by +L/2.
fk_left = joint_pair.fk_half_from_bar_frame(
    bar_frame_mm, float(jp_left) + half_length_mm, float(jr_left), pair.male
)
fk_right = joint_pair.fk_half_from_bar_frame(
    bar_frame_mm, float(jp_right) + half_length_mm, float(jr_right), pair.male
)

male_left_block_mm = fk_left["block_frame"]
male_right_block_mm = fk_right["block_frame"]

# Rhino outputs (doc units)
bar_curve = Rhino.Geometry.LineCurve(
    Rhino.Geometry.Point3d(*(bar_start_mm * scale_from_mm)),
    Rhino.Geometry.Point3d(*(bar_end_mm * scale_from_mm)),
)
male_left_plane = _mm_matrix_to_rhino_plane(male_left_block_mm, scale_from_mm)
male_right_plane = _mm_matrix_to_rhino_plane(male_right_block_mm, scale_from_mm)

# Wrap mm-tagged 4x4s as Rhino.Geometry.Transform so GH carries them
# atomically across wires (Python list-of-lists gets decomposed into
# branches, which breaks item-access receivers).
male_left_ocf_mm = _np_mm_to_xform_raw(male_left_block_mm)
male_right_ocf_mm = _np_mm_to_xform_raw(male_right_block_mm)
# ---------- end python_3_script_2 ----------
model_block_instance = ModelBlockInstance(
    Transform=[python_3_script_2.male_left_ocf_mm, python_3_script_2.male_right_ocf_mm],
    BlockDefinition=query_model_block_definitions)  # -> BlockInstance, Transform, BlockDefinition
custom_preview = CustomPreview(Geometry=model_block_instance.BlockInstance, Material=ColourSwatch(SwatchColor=RGB(0, 0, 0)))

python_3_script_3 = Python3Script(draw_collision=Toggle(False), draw_visual=Toggle(True))  # -> out, options
# ---------- python_3_script_3: Python ----------
from compas.data import Data
class RobotCellVisualizationOptions(Data):
    def __init__(self, draw_collision, draw_visual, scale):
        super(RobotCellVisualizationOptions, self).__init__()
        self.draw_collision = draw_collision
        self.draw_visual = draw_visual
        self.scale = scale

    @property
    def __data__(self):
        data = {
            'draw_collision': self.draw_collision,
            'draw_visual': self.draw_visual,
            'scale': self.scale,
            }
        return data

options = RobotCellVisualizationOptions(draw_collision, draw_visual, scale)

print(options.sha256(True))
# ---------- end python_3_script_3 ----------

check_bar_cc_this_thing_doesn_t_work_no = BooleanToggle(False)  # "check_bar_cc (this thing doesn't work, no time to debug yet)"
python_3_script_4 = Python3Script(
    pair_name="T20",
    male_left_ocf_mm=python_3_script_2.male_left_ocf_mm,
    male_right_ocf_mm=python_3_script_2.male_right_ocf_mm)  # -> out, tool0_left_mm, tool0_right_mm, tool0_left_plane, tool0_right_plane
# ---------- python_3_script_4: Python ----------
#! python 3
# venv: scaffolding_env
# r: numpy==1.24.4
"""C3: per-arm OCF -> tool0 transform for the dual-arm grasp.

Inputs:
    pair_name         : str, default "T20"
    male_left_ocf_mm  : Rhino.Geometry.Transform (mm-tagged) from C2
    male_right_ocf_mm : Rhino.Geometry.Transform (mm-tagged) from C2

Outputs:
    tool0_left_mm    : Rhino.Geometry.Transform (mm-tagged) -- pipe to C4
    tool0_right_mm   : Rhino.Geometry.Transform (mm-tagged) -- pipe to C4
    tool0_left_plane : Rhino.Geometry.Plane (doc units)
    tool0_right_plane: Rhino.Geometry.Plane (doc units)

Mirrors `rs_ik_keyframe._tool0_from_male`. The dispatch key is
`f"{pair_name}_Male"` to match the convention exported by
`RSExportGraspTool0TF` (Joint mode).
"""

import os
import sys

import Rhino

REPO = os.path.normpath(os.path.join(os.path.dirname(__file__), "..", "..", "..", ".."))
SCRIPTS = os.path.join(REPO, "scripts")
if SCRIPTS not in sys.path:
    sys.path.insert(0, SCRIPTS)

import numpy as np

from core import config  # noqa: E402
from core.rhino_frame_io import doc_unit_scale_to_mm  # noqa: E402


def _resolve_per_side(name):
    key = f"{name}_Male"
    if key not in config.MALE_JOINT_OCF_TO_TOOL0:
        raise RuntimeError(
            f"No MALE_JOINT_OCF_TO_TOOL0 entry for '{key}'. "
            "Run RSExportGraspTool0TF (Joint mode) for this joint type first."
        )
    per_side = config.MALE_JOINT_OCF_TO_TOOL0[key]
    if "left" not in per_side or "right" not in per_side:
        raise RuntimeError(
            f"MALE_JOINT_OCF_TO_TOOL0['{key}'] is missing left/right entries; "
            "re-run RSExportGraspTool0TF for both arm sides."
        )
    return per_side


def _mm_matrix_to_rhino_plane(matrix_mm, scale_from_mm):
    origin_doc = np.asarray(matrix_mm[:3, 3], dtype=float) * scale_from_mm
    return Rhino.Geometry.Plane(
        Rhino.Geometry.Point3d(float(origin_doc[0]), float(origin_doc[1]), float(origin_doc[2])),
        Rhino.Geometry.Vector3d(float(matrix_mm[0, 0]), float(matrix_mm[1, 0]), float(matrix_mm[2, 0])),
        Rhino.Geometry.Vector3d(float(matrix_mm[0, 1]), float(matrix_mm[1, 1]), float(matrix_mm[2, 1])),
    )


def _xform_raw_to_np_mm(xform):
    """Unpack a Rhino.Geometry.Transform (mm-tagged) into a 4x4 numpy array.
    Inverse of `_np_mm_to_xform_raw` in gh_bar_two_males.py.
    """
    return np.array([[float(xform[i, j]) for j in range(4)] for i in range(4)], dtype=float)


def _np_mm_to_xform_raw(matrix_mm):
    xf = Rhino.Geometry.Transform(1.0)
    for i in range(4):
        for j in range(4):
            xf[i, j] = float(matrix_mm[i, j])
    return xf


per_side = _resolve_per_side(str(pair_name) if pair_name else "T20")

ocf_l = _xform_raw_to_np_mm(male_left_ocf_mm)
ocf_r = _xform_raw_to_np_mm(male_right_ocf_mm)

tool0_l = ocf_l @ per_side["left"]
tool0_r = ocf_r @ per_side["right"]

scale_from_mm = 1.0 / doc_unit_scale_to_mm()

tool0_left_mm = _np_mm_to_xform_raw(tool0_l)
tool0_right_mm = _np_mm_to_xform_raw(tool0_r)
tool0_left_plane = _mm_matrix_to_rhino_plane(tool0_l, scale_from_mm)
tool0_right_plane = _mm_matrix_to_rhino_plane(tool0_r, scale_from_mm)
# ---------- end python_3_script_4 ----------
compute_ik = BooleanToggle(True)
xy_plane = XYPlane(Origin=Point(0, 0, 0))
check_robot_self_collision = BooleanToggle(True)
python_3_script_5 = Python3Script(
    trigger=compute_ik,
    tool0_left_mm=python_3_script_4.tool0_left_mm,
    tool0_right_mm=python_3_script_4.tool0_right_mm,
    base_plane=xy_plane,
    check_self=check_robot_self_collision,
    check_bar_coll=check_bar_cc_this_thing_doesn_t_work_no,
    bar_curve=python_3_script_2.bar_curve)  # -> out, ik_state, solved, base_frame_mm
# ---------- python_3_script_5: Python ----------
#! python 3
# venv: scaffolding_env
# r: numpy==1.24.4
# r: compas==2.13.0
# r: compas_robots==0.6.0
# r: pybullet==3.2.7
# r: pybullet_planning==0.6.1
"""C4: dual-arm IK with optional bar-as-rigid-body env collision.

Inputs:
    trigger          : bool   -- rising-edge re-solves; downstream caches
                                 the last solved state until next trigger
    tool0_left_mm    : Rhino.Geometry.Transform (mm-tagged) from C3
    tool0_right_mm   : Rhino.Geometry.Transform (mm-tagged) from C3
    base_plane       : Rhino.Geometry.Plane (doc units) -- robot base
    check_self       : bool, default True   -- self collision
    check_bar_coll   : bool, default False  -- bar-robot collision
    bar_curve        : Rhino.Geometry.Curve (doc units) from C2 -- only used
                       when check_bar_coll=True; tube-meshed and registered
                       as a static rigid body.
    bar_radius_mm    : float, default = config.BAR_RADIUS (10 mm)

Outputs:
    ik_state         : RobotCellState (or None if unsolved)
    solved           : bool
    base_frame_mm    : list[list[float]] 4x4 -- echoed for debugging

Joint-tool collision is allowed by NOT registering the male/female joint
blocks as env rigid bodies; the tool is attached to wrist links via
`touch_links` already configured by `core.robot_cell._configure_tool_states`.
"""

import os
import sys

import Rhino

REPO = os.path.normpath(os.path.join(os.path.dirname(__file__), "..", "..", "..", ".."))
SCRIPTS = os.path.join(REPO, "scripts")
if SCRIPTS not in sys.path:
    sys.path.insert(0, SCRIPTS)

import numpy as np

from core import config  # noqa: E402
from core import env_collision  # noqa: E402
from core import robot_cell  # noqa: E402
from core.rhino_frame_io import doc_unit_scale_to_mm  # noqa: E402


def _plane_to_4x4_mm(plane, scale_to_mm):
    o, x, y, z = plane.Origin, plane.XAxis, plane.YAxis, plane.ZAxis
    matrix = np.eye(4, dtype=float)
    matrix[:3, 0] = [x.X, x.Y, x.Z]
    matrix[:3, 1] = [y.X, y.Y, y.Z]
    matrix[:3, 2] = [z.X, z.Y, z.Z]
    matrix[:3, 3] = np.array([o.X, o.Y, o.Z], dtype=float) * scale_to_mm
    return matrix


def _xform_raw_to_np_mm(xform):
    """Unpack a Rhino.Geometry.Transform (mm-tagged) into a 4x4 numpy array.
    Matches `_np_mm_to_xform_raw` in gh_bar_two_males / gh_male_ocf_to_tool0.
    """
    return np.array([[float(xform[i, j]) for j in range(4)] for i in range(4)], dtype=float)


def _doc_curve_to_mm_curve(curve, scale_to_mm):
    """Return a LineCurve in mm built from `curve`'s endpoints in doc units."""
    s = curve.PointAtStart
    e = curve.PointAtEnd
    return Rhino.Geometry.LineCurve(
        Rhino.Geometry.Point3d(s.X * scale_to_mm, s.Y * scale_to_mm, s.Z * scale_to_mm),
        Rhino.Geometry.Point3d(e.X * scale_to_mm, e.Y * scale_to_mm, e.Z * scale_to_mm),
    )


ik_state = None
solved = False
base_frame_mm = None

if not robot_cell.is_pb_running():
    print("gh_ik_dual_arm: PyBullet not running; trigger gh_init_pb first.")
elif trigger:
    _client, planner = robot_cell.get_planner()
    rcell = robot_cell.get_or_load_robot_cell()
    template = robot_cell.default_cell_state()

    scale_to_mm = doc_unit_scale_to_mm()

    # Optional bar-as-RB
    if check_bar_coll and bar_curve is not None:
        radius_mm = float(bar_radius_mm) if bar_radius_mm is not None else float(config.BAR_RADIUS)
        mm_curve = _doc_curve_to_mm_curve(bar_curve, scale_to_mm)
        bar_mesh = env_collision.bar_tube_compas_mesh_from_geometry(mm_curve, radius_mm)
        if bar_mesh is None:
            print("gh_ik_dual_arm: bar tube mesh build failed; skipping env collision.")
            env_geom = {}
        else:
            env_geom = {
                "env_bar_active": {
                    "mesh": bar_mesh,
                    "frame_world_mm": np.eye(4, dtype=float),
                    "kind": "bar",
                }
            }
    else:
        env_geom = {}

    robot_cell.ensure_env_registered(rcell, env_geom, planner)
    if env_geom:
        template = env_collision.build_env_state(template, env_geom)

    base_mm_np = _plane_to_4x4_mm(base_plane, scale_to_mm)
    base_frame_mm = base_mm_np.tolist()

    tool0_l = _xform_raw_to_np_mm(tool0_left_mm)
    tool0_r = _xform_raw_to_np_mm(tool0_right_mm)

    check = bool(check_self) or bool(check_bar_coll)
    state = robot_cell.solve_dual_arm_ik(
        planner,
        template,
        base_mm_np,
        tool0_l,
        tool0_r,
        check_collision=check,
        verbose_pairs=check,
    )
    if state is not None:
        ik_state = state
        solved = True
        # Push to PB so the GUI / SceneObject sync.
        robot_cell.set_cell_state(planner, ik_state)
        print("gh_ik_dual_arm: solved.")
    else:
        print("gh_ik_dual_arm: IK failed.")
# ---------- end python_3_script_5 ----------
pipe = Pipe(Curve=python_3_script_2.bar_curve, Radius="10", Caps=1, FitRail=False)
python_3_script_6 = Python3Script(ik_state=python_3_script_5.ik_state, vis_options=python_3_script_3.options)  # -> out, draw, tool0_left_plane, tool0_right_plane
# ---------- python_3_script_6: Python ----------
#! python 3
# venv: scaffolding_env
# r: numpy==1.24.4
# r: compas==2.13.0
# r: compas_robots==0.6.0
"""C5: cached SceneObject draw of the dual-arm robot at `ik_state`.

Inputs:
    ik_state    : RobotCellState (from C4)
    vis_options : compas Data object whose `__data__` is forwarded to
                  Scene.add(robot_cell, **kwargs). Provide a default empty
                  one (e.g. compas.data.Data subclass instance) on first
                  wire; the SceneObject is cached against its sha256 so
                  repeated draws are fast.
    single_arm  : bool, default False -- True for the single-arm support cell

Outputs:
    draw                 : list of Rhino guids drawn this tick
    tool0_left_plane     : Rhino.Geometry.Plane
    tool0_right_plane    : Rhino.Geometry.Plane

Adapted from `support_materials/gh_keyframe_demos/python/GH_scene_viz.py`.
The robot_cell is fetched from `core.robot_cell.get_or_load_robot_cell()`
so it is the same instance used by C4 -- this keeps the SceneObject cache
key valid even after env-RB updates.
"""

import os
import sys

import Rhino
import scriptcontext as sc

REPO = os.path.normpath(os.path.join(os.path.dirname(__file__), "..", "..", "..", ".."))
SCRIPTS = os.path.join(REPO, "scripts")
if SCRIPTS not in sys.path:
    sys.path.insert(0, SCRIPTS)

from compas.scene import Scene  # noqa: E402
from compas.scene import register as _scene_register  # noqa: E402
from compas.geometry import Frame, Transformation  # noqa: E402
from compas_rhino.conversions import frame_to_rhino_plane  # noqa: E402
from compas_ghpython import create_id  # noqa: E402

from core import robot_cell as _rc  # noqa: E402


def _ensure_gh_registration():
    """Make sure `compas.scene.Scene` knows how to draw `RobotCell` in
    Grasshopper context.

    `compas_fab.ghpython.scene` exposes a `@plugin(requires=["Rhino"])`
    function `register_scene_objects()` that maps `RobotCell` ->
    `RobotCellObject` for context "Grasshopper". That registration is
    gated by `if compas.RHINO:` -- under Rhino 8 CPython that flag is
    sometimes False, so the gate skips and Scene.add(robot_cell) raises
    `SceneObjectNotRegisteredError`. Force the import and the explicit
    `register(...)` here so we don't depend on plugin auto-discovery.
    """
    try:
        from compas_fab.ghpython.scene import (  # noqa: F401
            RobotCellObject, RigidBodyObject, ReachabilityMapObject,
        )
        from compas_fab.robots import RobotCell, RigidBody, ReachabilityMap
        _scene_register(RobotCell, RobotCellObject, context="Grasshopper")
        _scene_register(RigidBody, RigidBodyObject, context="Grasshopper")
        _scene_register(ReachabilityMap, ReachabilityMapObject, context="Grasshopper")
    except Exception as exc:
        print(f"gh_scene_viz: registration failed ({exc}); Scene.add will likely raise.")


draw = []
tool0_left_plane = None
tool0_right_plane = None

if ik_state is None:
    print("gh_scene_viz: ik_state is None; nothing to draw.")
else:
    _ensure_gh_registration()
    rcell = _rc.get_or_load_robot_cell()

    object_hash = str(id(rcell))
    options_hash = vis_options.sha256(True) if vis_options is not None else "default"
    gh_component = ghenv.Component
    sticky_id = create_id(gh_component, f"{object_hash}_{options_hash}_{bool(single_arm)}")

    scene_object = sc.sticky.get(sticky_id)
    if scene_object is None or getattr(scene_object, "item", None) is not rcell:
        scene = Scene()
        kwargs = vis_options.__data__ if vis_options is not None else {}
        scene_object = scene.add(rcell, **kwargs)
        sc.sticky[sticky_id] = scene_object

    draw = scene_object.draw(ik_state)

    world_from_base = Transformation.from_frame(ik_state.robot_base_frame)
    if not single_arm:
        left_link = "left_ur_arm_tool0"
        right_link = "right_ur_arm_tool0"
        left_fk = rcell.robot_model.forward_kinematics(ik_state.robot_configuration, link_name=left_link)
        right_fk = rcell.robot_model.forward_kinematics(ik_state.robot_configuration, link_name=right_link)
        tool0_left_plane = frame_to_rhino_plane(
            Frame.from_transformation(world_from_base * Transformation.from_frame(left_fk))
        )
        tool0_right_plane = frame_to_rhino_plane(
            Frame.from_transformation(world_from_base * Transformation.from_frame(right_fk))
        )
    else:
        single_link = "ur_arm_tool0"
        single_fk = rcell.robot_model.forward_kinematics(ik_state.robot_configuration, link_name=single_link)
        tool0_left_plane = frame_to_rhino_plane(
            Frame.from_transformation(world_from_base * Transformation.from_frame(single_fk))
        )
# ---------- end python_3_script_6 ----------
panel_2 = Panel([python_3_script_5.ik_state, python_3_script_5.solved])
custom_preview_2 = CustomPreview(Geometry=pipe, Material=ColourSwatch(SwatchColor=RGB(0, 0, 255)))
mesh = Mesh(python_3_script_6.draw)
scale = Scale(Geometry=mesh, Center=Point(0, 0, 0), Factor="1000")  # -> Geometry, Transform
bounding_box = BoundingBox(Content=scale.Geometry, Plane=PlaneXY(0, 0, 0), UnionBox=True)  # -> Box, Box_2
deconstruct_brep = DeconstructBrep(Brep=bounding_box.Box)  # -> Faces, Edges, Vertices
custom_preview_3 = CustomPreview(Geometry=deconstruct_brep.Edges, Material=ColourSwatch(SwatchColor=RGBA(255, 255, 255, 10)))
list_item = ListItem(List=deconstruct_brep.Edges, Index=0, Wrap=True)  # -> Item, Item1
list_item_2 = ListItem(List=deconstruct_brep.Edges, Index="8", Wrap=True)
end_points = EndPoints(Curve=graft(list_item_2))  # -> Start, End
point = Point(end_points.Start)
project = Project(Geometry=point, Plane=PlaneXY(0, 0, 0))  # -> Geometry, Transform
point_2 = Point([python_3_script_2.male_left_plane, python_3_script_2.male_right_plane])
list_item_3 = ListItem(List=point_2, Index=0, Wrap=True)  # -> Item, Item1
end_points_2 = EndPoints(Curve=graft([list_item.Item, list_item.Item1]))  # -> Start, End
linear_dimension = LinearDimension(PointA=point, PointB=project.Geometry)  # -> LinearDimension, BaseLine, PointA, PointB, Style
aligned_dimension = AlignedDimension(PointA=list_item_3.Item, PointB=list_item_3.Item1)  # -> AlignedDimension, Plane, PointA, PointB, Offset, Style
aligned_dimension_2 = AlignedDimension(PointA=end_points_2.Start, PointB=end_points_2.End)  # -> AlignedDimension, Plane, PointA, PointB, Offset, Style
