# Grasshopper definition RobotX_demo_keyframe_v1.3_antenna_test.gh (Grasshopper 1.0.8)

line = Line(Line((0.900156436, 0.4039444872, 0.2589992128), (0.9001564383, 0.4039444872, 0.2939992128)))  # disabled
curve = Curve(<curve referenced from the Rhino model>)  # disabled
line_2 = Line(Line((0.900156436, 0.4039444872, 0.2589992128), (0.930156436, 0.4039444872, 0.2589992128)))  # disabled
curve_2 = Curve(<curve referenced from the Rhino model>)  # disabled
cluster = Cluster_2(curve=line, curve_2=line_2)  # disabled
cluster_2 = Cluster_2(curve=curve_2, curve_2=curve)  # disabled
curve_3 = Curve(<curve referenced from the Rhino model>)  # disabled
curve_4 = Curve(<curve referenced from the Rhino model>)  # disabled

# ---- group: male joint bounding box at origin
curve_5 = Curve(<curve referenced from the Rhino model>)  # disabled
curve_6 = Curve(<curve referenced from the Rhino model>)  # disabled
curve_curve = CurveCurve(CurveA=curve_6, CurveB=curve_5)  # -> Points, ParamsA, ParamsB; disabled
mesh = Mesh(<mesh referenced from the Rhino model>)  # disabled
cluster_3 = Cluster(curve=curve_6)  # disabled
cluster_4 = Cluster(curve=curve_5)  # disabled
construct_plane = ConstructPlane(Origin=curve_curve.Points, XAxis=curve_6, YAxis=curve_5)  # disabled
vector_display = VectorDisplay(Anchor=curve_curve.Points, Vector=[cluster_4, cluster_3])  # disabled

# ---- group: female joint bounding box at origin
curve_7 = Curve(<curve referenced from the Rhino model>)  # disabled
curve_8 = Curve(<curve referenced from the Rhino model>)  # disabled
curve_curve_2 = CurveCurve(CurveA=curve_8, CurveB=curve_7)  # -> Points, ParamsA, ParamsB; disabled
mesh_2 = Mesh(<mesh referenced from the Rhino model>)  # disabled
cluster_5 = Cluster(curve=curve_8)  # disabled
cluster_6 = Cluster(curve=curve_7)  # disabled
construct_plane_2 = ConstructPlane(Origin=curve_curve_2.Points, XAxis=curve_8, YAxis=curve_7)  # disabled
vector_display_2 = VectorDisplay(Anchor=curve_curve_2.Points, Vector=[cluster_6, cluster_5])  # disabled

# ----
plane = Plane(cluster)  # disabled
plane_2 = Plane(cluster_2)  # disabled
cluster_7 = Cluster_2(curve=curve_4, curve_2=curve_3)  # disabled

# ---- group: female joint
orient = Orient(Geometry=mesh_2, Source=construct_plane_2, Target=plane)  # -> Geometry, Transform; disabled

orient_2 = Orient(Geometry=mesh_2, Source=construct_plane_2, Target=plane_2)  # -> Geometry, Transform; disabled

# ----
mesh_3 = Mesh([<mesh referenced from the Rhino model> x2])  # disabled
plane_3 = Plane(cluster_7)  # disabled

# ---- group: male joint
orient_3 = Orient(Geometry=mesh, Source=construct_plane, Target=PlaneXY(0, 0, 0))  # -> Geometry, Transform; disabled

# ----
merge = Merge(Data1=mesh_3, Data2=orient_2.Geometry, Data3=orient.Geometry)  # -> flatten(Result); disabled
mesh_4 = Mesh(merge)

rotation_angle_sim_jig = Slider(0.55, range=-2..4)
seq_id = Slider(8, range=0..12)

construct_path = ConstructPath(Indices=seq_id)
point = Point(<point referenced from the Rhino model>)
# for female joints: hole close to start point of bar is 0,
# otherwise 1.
# Male joint always 2
pi = Pi(Factor=rotation_angle_sim_jig)
xz_plane = XZPlane(Origin=point)
mirror = Mirror(Geometry=xz_plane, Plane=PlaneYZ(0, 0, 0))  # -> Geometry, Transform
rotate = Rotate(Geometry=mirror.Geometry, Angle=pi, Plane=mirror.Geometry)  # -> Geometry, Transform

# ---- group: g3 / screw installation directions
curve_9 = Curve([<curve referenced from the Rhino model> x3])

# ---- group: g3 / bar longitude direction, y axis hole close to far
curve_10 = Curve([<curve referenced from the Rhino model> x3])

# ---- group: g1 / bar longitude direction, y axis hole close to far
curve_11 = Curve([<curve referenced from the Rhino model> x5])

# ---- group: g1 / screw installation directions
curve_12 = Curve([<curve referenced from the Rhino model> x5])

# ---- group: g1 foundation standoffs
mesh_5 = Mesh([<mesh referenced from the Rhino model> x2])

mesh_6 = Mesh([<mesh referenced from the Rhino model> x2])

# ---- group: g2 / screw installation directions
curve_13 = Curve([<curve referenced from the Rhino model> x5])

# ---- group: g2 / bar longitude direction, y axis hole close to far
curve_14 = Curve([<curve referenced from the Rhino model> x5])

# ---- group: v1 / screw installation directions
curve_15 = Curve([<curve referenced from the Rhino model> x6])

# ---- group: v1 / bar longitude direction, y axis hole close to far
curve_16 = Curve([<curve referenced from the Rhino model> x6])

# ---- group: v1g2 / bar longitude direction, y axis hole close to far
curve_17 = Curve([<curve referenced from the Rhino model> x2])

# ---- group: v1g2 / screw installation directions
curve_18 = Curve([<curve referenced from the Rhino model> x2])

# ---- group: g4 / screw installation directions
curve_19 = Curve([<curve referenced from the Rhino model> x3])

# ---- group: g4 / bar longitude direction, y axis hole close to far
curve_20 = Curve([<curve referenced from the Rhino model> x3])

# ---- group: v1g1 / bar longitude direction, y axis hole close to far
curve_21 = Curve([<curve referenced from the Rhino model> x2])

# ---- group: v1g1 / screw installation directions
curve_22 = Curve([<curve referenced from the Rhino model> x2])

# ---- group: v2 / bar longitude direction, y axis hole close to far
curve_23 = Curve([<curve referenced from the Rhino model> x5])

# ---- group: v2 / screw installation directions
curve_24 = Curve([<curve referenced from the Rhino model> x5])

# ---- group: v2g1 / bar longitude direction, y axis hole close to far
curve_25 = Curve([<curve referenced from the Rhino model> x2])

# ---- group: v2g1 / screw installation directions
curve_26 = Curve([<curve referenced from the Rhino model> x2])

# ---- group: D1 / bar longitude direction, y axis hole close to far
curve_27 = Curve([<curve referenced from the Rhino model> x2])

# ---- group: D1 / screw installation directions
curve_28 = Curve([<curve referenced from the Rhino model> x2])

# ---- group: v2g2 / bar longitude direction, y axis hole close to far
curve_29 = Curve([<curve referenced from the Rhino model> x2])

# ---- group: v2g2 / screw installation directions
curve_30 = Curve([<curve referenced from the Rhino model> x2])

# ---- group: H1 / bar longitude direction, y axis hole close to far
curve_31 = Curve([<curve referenced from the Rhino model> x2])

# ---- group: H1 / screw installation directions
curve_32 = Curve([<curve referenced from the Rhino model> x2])

# ---- group: v3 / bar longitude direction, y axis hole close to far
curve_33 = Curve([<curve referenced from the Rhino model> x2])

# ---- group: v3 / screw installation directions
curve_34 = Curve([<curve referenced from the Rhino model> x2])

# ----
entwine = Entwine(Branch00=mesh_5, Branch01=mesh_6, FlattenInputs=True)
entwine_2 = Entwine(
    Branch00=curve_12,
    Branch01=curve_13,
    Branch02=curve_9,
    Branch03=curve_19,
    Branch04=curve_15,
    Branch05=curve_22,
    Branch06=curve_18,
    Branch07=curve_24,
    Branch08=curve_26,
    Branch09=curve_30,
    Branch010=curve_32,
    Branch011=curve_28,
    Branch012=curve_34,
    FlattenInputs=True)
entwine_3 = Entwine(
    Branch00=curve_11,
    Branch01=curve_14,
    Branch02=curve_10,
    Branch03=curve_20,
    Branch04=curve_16,
    Branch05=curve_21,
    Branch06=curve_17,
    Branch07=curve_23,
    Branch08=curve_25,
    Branch09=curve_29,
    Branch010=curve_31,
    Branch011=curve_27,
    Branch012=curve_33,
    FlattenInputs=True)
tree_statistics = TreeStatistics(Tree=entwine_3)  # -> Paths, Length, Count
curve_middle = CurveMiddle(Curve=entwine_3)
curve_middle_2 = CurveMiddle(Curve=entwine_2)
plane_4 = Plane(xz_plane)
plane_5 = Plane(mirror.Geometry)
unit_x = UnitX(Factor=1)
jig_wall_thickness_change_to_4_if_using = Panel("0")  # "jig wall thickness (change to 4 if using manual)"
unit_x_2 = UnitX(Factor=1)
initial_reading_change_if_using_manual_r = Panel("0")  # "initial reading (change if using manual ruler)"
pipe_holder_end_to_sensor_wall = Panel("14.85")
multiplication = Multiplication(A=unit_x, B=Slider(1.04, range=0..2))

# ---- group: female collision geo
brep = Brep(<brep referenced from the Rhino model>)

# ---- group: male collision geo
brep_2 = Brep(<brep referenced from the Rhino model>)

# ----
multiplication_2 = Multiplication(A=unit_x_2, B=Slider(0.04, range=0..1))
negative = Negative(Value=multiplication)
number_slider = Slider(0.05, range=0..1)
colour_swatch = ColourSwatch(SwatchColor=RGB(255, 0, 255))
unit_y = UnitY(Factor=Slider(0.01, range=0..0.01))
negative_2 = Negative(Value=unit_y)
multiplication_3 = Multiplication(A=number_slider, B=Slider(0.21, range=0..1))
initial_reading = Panel("-60")
subtraction = Subtraction(A="0.05", B="14.85", C="4", D=initial_reading)
settings_quality = SettingsQuality()
panel = Panel(subtraction)
d1 = Panel("""3
3""")
h1 = Panel("""2
1
2""")
v2 = Panel("""2
1
0
0
0""")
v3 = Panel("""2
2""")
v1 = Panel("""3
0
0
0
1""")
v1g1 = Panel("""3
3""")
v1g2 = Panel("""2
2""")
v2g1 = Panel("""2
3""")
g4 = Panel("""2
0
2""")
v2g2 = Panel("""3
2""")
g1 = Panel("""1
0
1
3
0""")
g2 = Panel("""1
0
0
3
0""")
g3 = Panel("""3
0
3""")
entwine_4 = Entwine(
    Branch00=g1,
    Branch01=g2,
    Branch02=g3,
    Branch03=g4,
    Branch04=v1,
    Branch05=v1g1,
    Branch06=v1g2,
    Branch07=v2,
    Branch08=v2g1,
    Branch09=v2g2,
    Branch010=h1,
    Branch011=d1,
    Branch012=v3,
    FlattenInputs=True)  # -> simplify(Result)
data = Data(entwine_4)
tree_branch = TreeBranch(Tree=data, Path=construct_path, MaintainPaths=True)
integer = Integer(tree_branch)
integer_2 = Integer(entwine_4)
python_3_script = Python3Script(x=integer)  # -> out, a; inputs x: Int32
# ---------- python_3_script: Python ----------
if x == 0 or x == 1:
    a = 'Female - hole {}'.format('front' if x == 0 else 'back')
else:
    a = 'Male - tap {}'.format('right' if x == 2 else 'left')
# ---------- end python_3_script ----------
brep_3 = Brep([<brep referenced from the Rhino model> x3])
brep_4 = Brep([<brep referenced from the Rhino model> x2])
brep_5 = Brep([<brep referenced from the Rhino model> x2])
brep_6 = Brep([<brep referenced from the Rhino model> x2])
brep_7 = Brep([<brep referenced from the Rhino model> x2])
brep_8 = Brep([<brep referenced from the Rhino model> x2])
brep_9 = Brep([<brep referenced from the Rhino model> x2])
settings_quality_2 = SettingsQuality()
mesh_7 = Mesh(brep_3)
settings_quality_3 = SettingsQuality()
settings_quality_4 = SettingsQuality()
brep_10 = Brep([<brep referenced from the Rhino model> x6])
mesh_8 = Mesh(brep_4)
brep_11 = Brep([<brep referenced from the Rhino model> x9])
mesh_9 = Mesh(brep_5)
mesh_10 = Mesh(brep_6)
mesh_11 = Mesh(brep_7)
mesh_12 = Mesh(brep_8)
mesh_13 = Mesh(brep_9)
brep_12 = Brep(<brep referenced from the Rhino model>)
brep_13 = Brep([<brep referenced from the Rhino model> x4])
brep_14 = Brep(<brep referenced from the Rhino model>)
brep_15 = Brep(<brep referenced from the Rhino model>)
group = Group(Geometry=mesh_7)
group_2 = Group(Geometry=mesh_8)
group_3 = Group(Geometry=mesh_9)
group_4 = Group(Geometry=mesh_10)
brep_16 = Brep([<brep referenced from the Rhino model> x7])
mesh_14 = Mesh(brep_10)
curve_35 = Curve([<curve referenced from the Rhino model> x3])

brep_17 = Brep(<brep referenced from the Rhino model>)
data_2 = Data([brep_17, "H1", group, curve_35])

mesh_15 = Mesh(brep_11)
group_5 = Group(Geometry=mesh_11)
brep_18 = Brep([<brep referenced from the Rhino model> x4])
group_6 = Group(Geometry=mesh_12)
mesh_brep = MeshBrep(Brep=brep_15, Settings=settings_quality_4)
group_7 = Group(Geometry=mesh_13)
curve_36 = Curve([<curve referenced from the Rhino model> x2])

brep_19 = Brep(<brep referenced from the Rhino model>)
data_3 = Data([brep_19, "S-V2G2", group_2, curve_36])

mesh_brep_2 = MeshBrep(Brep=brep_12, Settings=settings_quality_2)
curve_37 = Curve([<curve referenced from the Rhino model> x2])

brep_20 = Brep(<brep referenced from the Rhino model>)
data_4 = Data([brep_20, "V3", group_3, curve_37])

mesh_brep_3 = MeshBrep(Brep=brep_14, Settings=settings_quality_3)
curve_38 = Curve([<curve referenced from the Rhino model> x2])

brep_21 = Brep(<brep referenced from the Rhino model>)
data_5 = Data([brep_21, "D1", group_4, curve_38])

mesh_16 = Mesh(brep_13)
brep_22 = Brep([<brep referenced from the Rhino model> x7])
curve_39 = Curve([<curve referenced from the Rhino model> x2])
curve_40 = Curve([<curve referenced from the Rhino model> x2])

brep_23 = Brep(<brep referenced from the Rhino model>)
data_6 = Data([brep_23, "S-V2G1", group_6, curve_40])

curve_41 = Curve([<curve referenced from the Rhino model> x2])
group_8 = Group(Geometry=mesh_14)

brep_24 = Brep(<brep referenced from the Rhino model>)
data_7 = Data([brep_24, "S-V1G2", group_5, curve_39])

group_9 = Group(Geometry=mesh_15)
mesh_17 = Mesh(brep_16)
mesh_18 = Mesh(brep_18)

brep_25 = Brep(<brep referenced from the Rhino model>)
data_8 = Data([brep_25, "S-V1G1", group_7, curve_41])

group_10 = Group(Geometry=mesh_16)
curve_42 = Curve([<curve referenced from the Rhino model> x5])
curve_43 = Curve([<curve referenced from the Rhino model> x6])

brep_26 = Brep(<brep referenced from the Rhino model>)
data_9 = Data([brep_26, "V1", group_9, curve_43])

brep_27 = Brep(<brep referenced from the Rhino model>)
data_10 = Data([brep_27, "V2", group_8, curve_42])

mesh_19 = Mesh(brep_22)
curve_44 = Curve([<curve referenced from the Rhino model> x3])
triangulate = Triangulate(Mesh=mesh_brep)  # -> Mesh, Count

brep_28 = Brep(<brep referenced from the Rhino model>)
data_11 = Data([brep_28, "G4", group_10, curve_44])

triangulate_2 = Triangulate(Mesh=mesh_brep_2)  # -> Mesh, Count
triangulate_3 = Triangulate(Mesh=mesh_brep_3)  # -> Mesh, Count
group_11 = Group(Geometry=mesh_17)
group_12 = Group(Geometry=mesh_18)
curve_45 = Curve([<curve referenced from the Rhino model> x5])

brep_29 = Brep(<brep referenced from the Rhino model>)
data_12 = Data([brep_29, "G1", group_11, curve_45])

group_13 = Group(Geometry=mesh_19)
curve_46 = Curve([<curve referenced from the Rhino model> x3])

brep_30 = Brep(<brep referenced from the Rhino model>)
data_13 = Data([brep_30, "G3", group_12, curve_46])

curve_47 = Curve([<curve referenced from the Rhino model> x5])

brep_31 = Brep(<brep referenced from the Rhino model>)
data_14 = Data([brep_31, "G2", group_13, curve_47])

mesh_20 = Mesh(triangulate_2.Mesh)
mesh_21 = Mesh(triangulate_3.Mesh)
mesh_22 = Mesh(triangulate.Mesh)
rigid_body_box = Python3Script(name="rock", has_visual=Toggle(True), has_collision=Toggle(True), mesh=mesh_20)  # -> out, rigid_body; inputs mesh: Mesh
# ---------- rigid_body_box: Python ----------
# venv: compas_fab_dev

from compas_fab.robots import RigidBody
from compas_rhino.conversions import mesh_to_compas

from compas.geometry import Box

box_visuals= []
box_collisions = []
cp_mesh = mesh_to_compas(mesh)
if (has_visual):
    box_visuals.append(cp_mesh) #Box(x_size, y_size, z_size))
if (has_collision):
    box_collisions.append(cp_mesh) #Box(x_size, y_size, z_size))

rigid_body = RigidBody(box_visuals,box_collisions)
if name:
    rigid_body.name = name
# ---------- end rigid_body_box ----------
rigid_body_box_2 = Python3Script(name="wall", has_visual=Toggle(True), has_collision=Toggle(True), mesh=mesh_21)  # -> out, rigid_body; inputs mesh: Mesh; same code as rigid_body_box
rigid_body_box_3 = Python3Script(name="foundation_bed", has_visual=Toggle(True), has_collision=Toggle(True), mesh=mesh_22)  # -> out, rigid_body; inputs mesh: Mesh; same code as rigid_body_box
entwine_5 = Entwine(
    Branch00=data_12,
    Branch01=data_14,
    Branch02=data_13,
    Branch03=data_11,
    Branch04=data_9,
    Branch05=data_8,
    Branch06=data_7,
    Branch07=data_10,
    Branch08=data_6,
    Branch09=data_3,
    Branch010=data_2,
    Branch011=data_5,
    Branch012=data_4,
    FlattenInputs=True)  # -> simplify(Result)
data_15 = Data(entwine_5)
tree_branch_2 = TreeBranch(Tree=data_15, Path=construct_path, MaintainPaths=True)
list_item = ListItem(List=tree_branch_2, Index=0, Wrap=True)  # -> Item, Item1
replace_items = ReplaceItems(List=tree_branch_2, Indices="1", Wrap=False)
clean_tree = CleanTree(RemoveNulls=True, RemoveInvalid=True, RemoveEmpty=False, Tree=replace_items)
merge_2 = Merge(Data1=rigid_body_box_2.rigid_body, Data2=rigid_body_box_3.rigid_body, Data3=rigid_body_box.rigid_body)

# ---- group: G2 / screw rotational direction (x)
curve_48 = Curve(<curve referenced from the Rhino model>)

# ---- group: G1 / screw rotational direction (x)
curve_49 = Curve(<curve referenced from the Rhino model>)

# ---- group: G2 / bar axis direction (z)
curve_50 = Curve(<curve referenced from the Rhino model>)

# ---- group: G1 / bar axis direction (z)
curve_51 = Curve(<curve referenced from the Rhino model>)

# ---- group: H2 / screw rotational direction (x)
curve_52 = Curve(<curve referenced from the Rhino model>)

curve_53 = Curve(<curve referenced from the Rhino model>)

# ---- group: H2 / bar axis direction (z)
curve_54 = Curve(<curve referenced from the Rhino model>)

curve_55 = Curve(<curve referenced from the Rhino model>)

# ---- group: V3 / screw rotational direction (x)
curve_56 = Curve(<curve referenced from the Rhino model>)

curve_57 = Curve(<curve referenced from the Rhino model>)

# ---- group: V3 / bar axis direction (z)
curve_58 = Curve(<curve referenced from the Rhino model>)

curve_59 = Curve(<curve referenced from the Rhino model>)

# ---- group: H1 / screw rotational direction (x)
curve_60 = Curve(<curve referenced from the Rhino model>)

curve_61 = Curve(<curve referenced from the Rhino model>)

# ---- group: H1 / bar axis direction (z)
curve_62 = Curve(<curve referenced from the Rhino model>)

curve_63 = Curve(<curve referenced from the Rhino model>)

# ---- group: G3 / screw rotational direction (x)
curve_64 = Curve(<curve referenced from the Rhino model>)

curve_65 = Curve(<curve referenced from the Rhino model>)

# ---- group: V2 / screw rotational direction (x)
curve_66 = Curve(<curve referenced from the Rhino model>)

# ---- group: G4 / screw rotational direction (x)
curve_67 = Curve(<curve referenced from the Rhino model>)

# ---- group: G3 / bar axis direction (z)
curve_68 = Curve(<curve referenced from the Rhino model>)

curve_69 = Curve(<curve referenced from the Rhino model>)

# ---- group: V2 / bar axis direction (z)
curve_70 = Curve(<curve referenced from the Rhino model>)

# ---- group: G4 / screw rotational direction (x)
curve_71 = Curve(<curve referenced from the Rhino model>)

# ---- group: G4 / bar axis direction (z)
curve_72 = Curve(<curve referenced from the Rhino model>)

curve_73 = Curve(<curve referenced from the Rhino model>)

# ---- group: V1 / screw rotational direction (x)
curve_74 = Curve(<curve referenced from the Rhino model>)

# ---- group: V1 / bar axis direction (z)
curve_75 = Curve(<curve referenced from the Rhino model>)

# ---- group: G2
merge_3 = Merge(Data1=curve_50, Data2=curve_48)

# ----
panel_2 = Panel("right_high")

# ---- group: G1
merge_4 = Merge(Data1=curve_51, Data2=curve_49)

# ---- group: H2
merge_5 = Merge(Data1=curve_55, Data2=curve_53, Data3=curve_54, Data4=curve_52)

# ---- group: V3
merge_6 = Merge(Data1=curve_58, Data2=curve_57, Data3=curve_59, Data4=curve_56)

# ---- group: H1
merge_7 = Merge(Data1=curve_63, Data2=curve_61, Data3=curve_62, Data4=curve_60)

# ---- group: V2
merge_8 = Merge(Data1=curve_70, Data2=curve_66)

# ---- group: G3
merge_9 = Merge(Data1=curve_68, Data2=curve_65, Data3=curve_69, Data4=curve_64)

# ---- group: G4
merge_10 = Merge(Data1=curve_72, Data2=curve_71, Data3=curve_73, Data4=curve_67)

# ---- group: V1
merge_11 = Merge(Data1=curve_75, Data2=curve_74)

# ----
concatenate = Concatenate(FragmentA="IK_test_")
brep_32 = Brep(<brep referenced from the Rhino model>)
merge_12 = Merge(Data1=brep_32, Data2=concatenate)

panel_3 = Panel("D:\0_Project\03-2025_husky_assembly\Code\husky-assembly-teleop\data\husky_urdf")

# ---- group: jaw_center_from_tool0
point_2 = Point(Point(-8.330831417e-05, 0.09375, -0.09747390072))
point_3 = Point(Point(-8.330831417e-05, 0.09375, -0.003398979218))
point_4 = Point(Point(0.1825777231, 0.09375, -0.003398979218))
xy_plane = XYPlane(Origin=Point(0, 0, 0))
plane_3pt = Plane3Pt(PointA=point_3, PointB=point_2, PointC=point_4)
python_3_script_2 = Python3Script(plane_a=xy_plane, plane_b=plane_3pt)  # -> out, bar_grasp_from_tool0
# ---------- python_3_script_2: Python ----------
# Inputs: plane_a, plane_b (both should be Rhino.Geometry.Plane)
# Output: T (compas.geometry.Transformation)

from compas.geometry import Frame, Transformation
from compas_rhino.conversions import plane_to_compas_frame
from compas_rhino.conversions import transformation_to_rhino

# Convert Rhino planes to COMPAS frames
frame_a = plane_to_compas_frame(plane_a)
frame_b = plane_to_compas_frame(plane_b)

# Compute the transformation from frame_a to frame_b
bar_grasp_from_tool0 = Transformation.from_frame_to_frame(frame_a, frame_b)
ghT = transformation_to_rhino(bar_grasp_from_tool0)
# ---------- end python_3_script_2 ----------

# ----
split_list = SplitList(List=entwine_5, Index="2")  # -> simplify(ListA), simplify(ListB)
entwine_6 = Entwine(
    Branch00=merge_4,
    Branch01=merge_3,
    Branch02=merge_9,
    Branch03=merge_10,
    Branch04=merge_11,
    Branch07=merge_8,
    Branch010=merge_7,
    Branch011=merge_5,
    Branch012=merge_6,
    FlattenInputs=True)  # -> simplify(Result)

# ---- group: detailed tool block
block_instance = BlockInstance(<block instance referenced from the Rhino model>)

# ---- group: tool with both M F joints
mesh_23 = Mesh([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])

# ---- group: tool with no joint
mesh_24 = Mesh([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])

# ----
bounding_box = BoundingBox(Content=mesh_24, Plane=PlaneXY(0, 0, 0), UnionBox=True)  # -> Box, Box_2
list_item_2 = ListItem(List=split_list.ListA, Index=0, Wrap=True)  # -> Item, Item1

# ---- group: tool at orign for grasping
block_instance_2 = BlockInstance(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)

# ----
number_slider_2 = Slider(0, range=0..2)
brep_33 = Brep(list_item_2.Item)
panel_4 = Panel(list_item_2.Item1)
cap_holes = CapHoles(Brep=brep_33)
brep_34 = Brep(cap_holes)

point_5 = Point(Point(0, 100, 0))  # disabled
point_6 = Point(Point(0, 0, 0))  # disabled
point_7 = Point(Point(100, 0, 0))  # disabled
mesh_25 = Mesh([<mesh referenced from the Rhino model> x4])  # disabled
plane_3pt_2 = Plane3Pt(PointA=point_6, PointB=point_7, PointC=point_5)  # disabled
orient_4 = Orient(Geometry=mesh_25, Source=plane_3pt_2, Target=PlaneXY(0, 0, 0))  # -> Geometry, Transform; disabled
panel_5 = Panel("0.001")  # disabled
point_8 = Point(Point(3.917690688e-09, 100, 166.1309561))  # disabled
point_9 = Point(Point(3.917690688e-09, -8.756071423e-10, 166.1309561))  # disabled
point_10 = Point(Point(100, -8.756071423e-10, 166.1309561))  # disabled
panel_6 = Panel("RobotiqGripper")  # disabled
scale = Scale(Geometry=orient_4.Geometry, Center=Point(0, 0, 0), Factor=panel_5)  # -> Geometry, Transform; disabled
plane_3pt_3 = Plane3Pt(PointA=point_9, PointB=point_10, PointC=point_8)  # disabled
python_3_script_3 = Python3Script(name=panel_6, tool_visual_meshes=scale.Geometry, tool_collision_meshes=scale.Geometry, tool_frame=plane_3pt_3)  # -> out, tool_model; inputs tool_visual_meshes: list of Mesh, tool_collision_meshes: list of Mesh, tool_frame: Plane; disabled
# ---------- python_3_script_3: Python ----------
from compas_robots import ToolModel
from compas.geometry import Transformation
from compas_rhino.conversions import plane_to_compas_frame, mesh_to_compas

cp_visual_meshes = [mesh_to_compas(vm) for vm in tool_visual_meshes]
cp_collision_meshes = [mesh_to_compas(vm) for vm in tool_collision_meshes]
cp_tool_frame = plane_to_compas_frame(tool_frame)

tool_model = ToolModel(None, cp_tool_frame, None, name)

tool_model.add_link("attached_tool_link", visual_meshes=cp_visual_meshes, collision_meshes=cp_collision_meshes)
tool_model._rebuild_tree()
tool_model._create(tool_model.root, Transformation())
# ---------- end python_3_script_3 ----------

settings_quality_5 = SettingsQuality()

# ---- group: left with DETAILED male joint
mesh_26 = Mesh([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])
clean_tree_2 = CleanTree(RemoveNulls=True, RemoveInvalid=True, RemoveEmpty=False, Tree=mesh_26)
mesh_27 = Mesh([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])
merge_13 = Merge(Data1=mesh_27, Data2=clean_tree_2)

# ---- group: right with DETAILED female joint
mesh_28 = Mesh([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])
clean_tree_3 = CleanTree(RemoveNulls=True, RemoveInvalid=True, RemoveEmpty=False, Tree=mesh_28)
merge_14 = Merge(Data1=mesh_27, Data2=clean_tree_3)

# ----
mesh_brep_4 = MeshBrep(Brep=bounding_box.Box, Settings=settings_quality_5)
construct_point = ConstructPoint(XCoordinate=number_slider_2, YCoordinate=0, ZCoordinate=number_slider_2)
triangulate_4 = Triangulate(Mesh=mesh_brep_4)  # -> Mesh, Count

point_11 = Point(Point(-45, 70, -109.75))
point_12 = Point(Point(-45, -30, -109.75))
point_13 = Point(Point(55, -30, -109.75))
plane_3pt_4 = Plane3Pt(PointA=point_12, PointB=point_13, PointC=point_11)
orient_5 = Orient(Geometry=triangulate_4.Mesh, Source=plane_3pt_4, Target=PlaneXY(0, 0, 0))  # -> Geometry, Transform
xy_plane_2 = XYPlane(Origin=Point(0, 0, 0))
scale_2 = Scale(Geometry=orient_5.Geometry, Center=Point(0, 0, 0), Factor="0.001")  # -> Geometry, Transform
python_3_script_4 = Python3Script(name="AssemblyTool", tool_visual_meshes=scale_2.Geometry, tool_frame=xy_plane_2)  # -> out, tool_model; inputs tool_visual_meshes: list of Mesh, tool_collision_meshes: list of Mesh, tool_frame: Plane
# ---------- python_3_script_4: Python ----------
from compas_robots import ToolModel
from compas.geometry import Transformation
from compas_rhino.conversions import plane_to_compas_frame, mesh_to_compas

cp_visual_meshes = [mesh_to_compas(vm) for vm in tool_visual_meshes]
cp_collision_meshes = [mesh_to_compas(vm) for vm in tool_collision_meshes] if tool_collision_meshes is not None else []
cp_tool_frame = plane_to_compas_frame(tool_frame)

tool_model = ToolModel(None, cp_tool_frame, None, name)

tool_model.add_link("attached_tool_link", visual_meshes=cp_visual_meshes, collision_meshes=cp_collision_meshes)
tool_model._rebuild_tree()
tool_model._create(tool_model.root, Transformation())
# ---------- end python_3_script_4 ----------

scale_3 = Scale(Geometry=plane_3pt_4, Center=Point(0, 0, 0), Factor="0.001")  # -> Geometry, Transform
construct_plane_3 = ConstructPlane(Origin=construct_point, XAxis=Vector(1, 0, 0), YAxis=Vector(0, 1, 0))

# ---- group: male joint from tool0
point_14 = Point(Point(-0.09375, 0, 0.045))  # disabled
point_15 = Point(Point(-0.09375, 0.002305065622, -0.04904667739))  # disabled
point_16 = Point(Point(-0.09375, 0.1826061911, 0.04947564194))  # disabled
xy_plane_3 = XYPlane(Origin=Point(0, 0, 0))  # disabled
plane_3pt_5 = Plane3Pt(PointA=point_14, PointB=point_15, PointC=point_16)  # disabled
python_3_script_5 = Python3Script(plane_a=xy_plane_3, plane_b=plane_3pt_5)  # -> out, x_from_tool0; disabled
# ---------- python_3_script_5: Python ----------
# Inputs: plane_a, plane_b (both should be Rhino.Geometry.Plane)
# Output: T (compas.geometry.Transformation)

from compas.geometry import Frame, Transformation
from compas_rhino.conversions import plane_to_compas_frame
from compas_rhino.conversions import transformation_to_rhino

# Convert Rhino planes to COMPAS frames
frame_a = plane_to_compas_frame(plane_a)
frame_b = plane_to_compas_frame(plane_b)

# Compute the transformation from frame_a to frame
x_from_tool0 = Transformation.from_frame_to_frame(frame_a, frame_b)
ghT = transformation_to_rhino(x_from_tool0)
# ---------- end python_3_script_5 ----------

# ----
boolean_toggle = BooleanToggle(True)

# ----
# Step 1: load robot model
load_robot = Button()
python_3_script_6 = Python3Script(
    load=load_robot,
    pkg_path=panel_3,
    pkg_name="mt_husky_dual_ur5_e_moveit_config",
    urdf_file="husky_dual_ur5_e_no_base_joint_All_Calibrated.urdf",
    srdf_file="dual_arm_husky.srdf")  # -> out, robot_model, robot_semantics
# ---------- python_3_script_6: Python ----------
from scriptcontext import sticky as st
import os
import compas

from compas_robots import RobotModel
from compas_robots.resources import GithubPackageMeshLoader
from compas_robots.resources import LocalPackageMeshLoader
from compas_robots.ghpython.scene import RobotModelObject
# from compas_fab.robots import Robot
from compas_fab.robots import RobotSemantics
# from compas_ghpython.artists import RobotModelArtist

# Robot meshes are usually in meters
# Set a high percision to prevent parsing errors
# and configure Rhino itself in meters
compas.PRECISION = '12f'

# Store robot in component-based key
# ghenv.Component.InstanceGuid
robot_key = 'robot_{}'.format(str('dual-arm_husky_Cindy'))

if robot_key not in st:
    st[robot_key] = None

loader = LocalPackageMeshLoader(os.path.join(pkg_path), pkg_name)

if load:
# if True:
    # Also load geometry
    husky_loader = LocalPackageMeshLoader(os.path.join(pkg_path), "husky_description")
    dualarm_husky_loader = LocalPackageMeshLoader(os.path.join(pkg_path), "husky_ur_description")
    ur_loader = LocalPackageMeshLoader(os.path.join(pkg_path), "ur_description")
    
    # Create robot model from URDF
    model = RobotModel.from_urdf_string(loader.load_urdf(urdf_file).read())
    model.load_geometry(loader, husky_loader, dualarm_husky_loader, ur_loader)
    print(model)

    # # artist = RobotModelArtist(model)
    # scene_object = RobotModelObject(item=model)

    # # robot = Robot(model)
    # robot = Robot(model, scene_object, semantics=robot_semantics)
##    robot.scale(1000)
    st[robot_key] = model

robot_model = st[robot_key]
robot_semantics = None
if srdf_file:
    robot_semantics = RobotSemantics.from_srdf_file(loader.build_path('config', srdf_file), robot_model)


#repo    = 'ros-industrial/abb'
#package = 'abb_irb6600_support'
#branch  = 'kinetic-devel'
#
#github = GithubPackageMeshLoader(repo, package, branch)
#
#model = RobotModel.from_urdf_file(github.load_urdf('irb6640.urdf'))
#model.load_geometry(github)
#artist = RobotModelArtist(model)
#robot = Robot(model, artist)
# ---------- end python_3_script_6 ----------

python_3_script_7 = Python3Script(
    robot_model=python_3_script_6.robot_model,
    robot_semantics=python_3_script_6.robot_semantics,
    assembly_tool=python_3_script_4.tool_model,
    support_tool=python_3_script_3.tool_model,
    rigid_bodies=merge_2,
    object_frame=construct_plane_3,
    is_hidden=Toggle(False))  # -> out, robot_cell, robot_cell_state; inputs rigid_bodies: list, object_frame: Plane
# ---------- python_3_script_7: Python ----------
#aasss venv: compas_fab_dev

from compas_fab.robots import RobotCell
from compas_fab.robots import RobotCellState
from compas_fab.robots import RigidBodyState
from compas.geometry import Box
from compas.geometry import Frame
from compas_rhino.conversions import plane_to_compas_frame

from compas_fab.robots import RobotCellLibrary
from compas_robots import ToolModel

robot_cell = RobotCell(robot_model, robot_semantics)

# robot_cell.tool_models['Alice'] = ToolModel.from_robot_model(support_robot_model.copy(), Frame.worldXY())
# robot_cell.tool_models['Belle'] = ToolModel.from_robot_model(support_robot_model.copy(), Frame.worldXY())

robot_cell.tool_models['AL'] = assembly_tool.copy()
robot_cell.tool_models['AR'] = assembly_tool.copy()

#################
# robot_cell.tool_models['SGAlice'] = support_tool.copy()
# robot_cell.tool_models['SGBelle'] = support_tool.copy()

#################
robot_cell_state = robot_cell.default_cell_state()

robot_cell_state.tool_states['AL'].attached_to_group = 'base_left_arm_manipulator'
robot_cell_state.tool_states['AL'].touch_links = ['left_ur_arm_wrist_3_link']

robot_cell_state.tool_states['AR'].attached_to_group = 'base_right_arm_manipulator'
robot_cell_state.tool_states['AR'].touch_links = ['right_ur_arm_wrist_3_link']

if (rigid_bodies):
    # Make sure RBs have unique names
    assert len(set([rb.name for rb in rigid_bodies])) == len(rigid_bodies)
    for rb in rigid_bodies:
        assert rb.name
        robot_cell.rigid_body_models[rb.name] = rb
        robot_cell_state.rigid_body_states[rb.name] = RigidBodyState(
            plane_to_compas_frame(object_frame),
            is_hidden=False,
        )

from compas.scene import Scene
scene = Scene()
scene.add(robot_cell)
# ---------- end python_3_script_7 ----------
orient_6 = Orient(Geometry=block_instance, Source=scale_3.Geometry, Target=PlaneXY(0, 0, 0))  # -> Geometry, Transform

# ---- group: assembly stage
# Step 2: select assembly stage
assembly_stage = Slider(11, range=0..12)
retreat_distance = Slider(0.05, range=0..0.5)
approach_distance = Slider(0.05, range=0..0.5)

# ----
integer_3 = Integer(assembly_stage)
addition = Addition(A=integer_3, B=1)

# ---- group: grasp
# Step 4: select grasps
panel_7 = Panel("0.5")
grasp_offset = Slider(-0.226, range=-0.5..0.5)
grasp_theta = Slider(3.457, range=0..4)
grasp_offset_2 = Slider(-0.059, range=-0.5..0.5)
pi_2 = Pi(Factor=panel_7)
multiplication_4 = Multiplication(A=pi_2, B=grasp_theta)

# ----
data_16 = Data(python_3_script_7.robot_cell_state)
construct_path_2 = ConstructPath(Indices=assembly_stage)
data_17 = Data(python_3_script_7.robot_cell)

# ---- group: bar_grasp_from_tool0
data_18 = Data(python_3_script_2.bar_grasp_from_tool0)

# ----
python_3_script_8 = Python3Script(robot_cell=python_3_script_7.robot_cell, robot_cell_state=python_3_script_7.robot_cell_state)  # -> out, a
# ---------- python_3_script_8: Python ----------
new_robot_cell_state = robot_cell_state
# print(new_robot_cell_state.robot_configuration.joint_names)

for joint_name in new_robot_cell_state.robot_configuration.joint_names:
    joint = robot_cell.robot_model.get_joint_by_name(joint_name)
    print('{} : lower: {}, upper: {}'.format(joint_name, joint.limit.lower, joint.limit.upper))
# ---------- end python_3_script_8 ----------
tree_branch_3 = TreeBranch(Tree=entwine_6, Path=construct_path_2, MaintainPaths=True)
panel_8 = Panel(python_3_script_8.out)

# ---- group: mobile base position
base_x = Slider(0, range=-2..2)
base_y = Slider(0, range=-2..2)
yaw = Slider(0, range=0..6.283)
unit_x_3 = UnitX(Factor=1)
unit_y_2 = UnitY(Factor=1)
construct_point_2 = ConstructPoint(XCoordinate=base_x, YCoordinate=base_y, ZCoordinate=0)
rotate_2 = Rotate(Geometry=[unit_x_3, unit_y_2], Angle=yaw, Plane=PlaneXY(0, 0, 0))  # -> Geometry, Transform
list_item_3 = ListItem(List=rotate_2.Geometry, Index=0, Wrap=True)  # -> Item, Item1
construct_plane_4 = ConstructPlane(Origin=construct_point_2, XAxis=list_item_3.Item, YAxis=list_item_3.Item1)

# ---- group: joint conf initial guess
# Step 5: choose arm and base initial conf
gene_pool = GenePool(Decimals=2, Maximum=3.14, Minimum=-3.14, Value=[1.18, -2.31, 1.21, -0.25, -0.76, -1.17])
gene_pool_2 = GenePool(Decimals=2, Maximum=3.14, Minimum=-3.14, Value=[0.4, -0.99, -0.11, -0.56, -0.13, 0.49])
merge_15 = Merge(Data1=gene_pool_2, Data2=gene_pool)

# ----
partition_list = PartitionList(List=tree_branch_3, Size="2")
panel_9 = Panel(partition_list)

# ---- group: female joint at a particular pose / bar axis direction (z)
curve_76 = Curve(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)

# ----
stream_filter = StreamFilter(Gate=0, Stream0=merge_15, Stream1=gene_pool_2)
list_item_4 = ListItem(List=partition_list, Index=0, Wrap=True)  # -> Item, Item1

python_3_script_9 = Python3Script(draw_collision=Toggle(False), draw_visual=Toggle(True))  # -> out, options
# ---------- python_3_script_9: Python ----------
from compas.data import Data
class RobotCellVisualizationOptions(Data):
    def __init__(self, draw_collision, draw_visual, scale):
        super(RobotCellVisualizationOptions, self).__init__()
        self.draw_collision = draw_collision
        self.draw_visual = draw_visual
        self.scale = scale

    @property
    def __data__(self):
        data = {
            'draw_collision': self.draw_collision,
            'draw_visual': self.draw_visual,
            'scale': self.scale,
            }
        return data

options = RobotCellVisualizationOptions(draw_collision, draw_visual, scale)

print(options.sha256(True))
# ---------- end python_3_script_9 ----------

# ---- group: female joint at a particular pose / screw rotational direction (x)
curve_77 = Curve(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)

# ---- group: male joint at a particular pose
curve_78 = Curve(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)
point_17 = Point(Point(-0.1444282622, 0.4227656459, 0.153654582))
curve_79 = Curve(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)
cross_product = CrossProduct(VectorA=curve_78, VectorB=curve_79, Unitize=True)  # -> Vector, Length
construct_plane_5 = ConstructPlane(Origin=point_17, XAxis=curve_79, YAxis=cross_product.Vector)
xy_plane_4 = XYPlane(Origin=Point(0, 0, 0))
mesh_29 = Mesh(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)
block_instance_3 = BlockInstance(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)
orient_7 = Orient(Geometry=mesh_29, Source=construct_plane_5, Target=xy_plane_4)  # -> Geometry, Transform

# ---- group: bar axis direction (z)
curve_80 = Curve(list_item_4.Item)

# ----
plane_6 = Plane(Plane(origin=(0.6879349322, -0.2189899321, 1.211250362), x=(1, 0, 0), y=(0, 0, -1)))

# ---- group: screw rotational direction (x)
curve_81 = Curve(list_item_4.Item1)

# ----
panel_10 = Panel("D:\0_Project\03-2025_husky_assembly\Code\husky-assembly-teleop\data\husky_assembly_design_study\250714_robot_centric_IK_grasp_test")

# ---- group: tool
block_instance_4 = BlockInstance(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)
mesh_30 = Mesh(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)
mesh_31 = Mesh(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)
orient_8 = Orient(Geometry=mesh_31, Source=construct_plane_5, Target=xy_plane_4)  # -> Geometry, Transform
orient_9 = Orient(Geometry=mesh_30, Source=construct_plane_5, Target=xy_plane_4)  # -> Geometry, Transform
orient_10 = Orient(Geometry=block_instance_4, Source=construct_plane_5, Target=xy_plane_4)  # -> Geometry, Transform

# ----
flip_z_axis = BooleanToggle(False)
flip_curve = FlipCurve(Curve=curve_80)  # -> Curve, Flag
curve_82 = Curve(curve_80)
viz_traj = BooleanToggle(False)
xy_plane_5 = XYPlane(Origin=Point(0, 0, 0))
data_19 = Data(block_instance_2)
data_20 = Data(data_17)
curve_middle_3 = CurveMiddle(Curve=curve_82)
stream_filter_2 = StreamFilter(Gate=flip_z_axis, Stream0=curve_80, Stream1=flip_curve.Curve)
orient_11 = Orient(Geometry=data_19, Source=plane_3pt, Target=xy_plane_5)  # -> Geometry, Transform

# ---- group: joint jaw center line mid point
point_18 = Point(curve_middle_3)

# ----
cross_product_2 = CrossProduct(VectorA=curve_82, VectorB=curve_81, Unitize=True)  # -> Vector, Length
python_3_script_10 = Python3Script(folder_path=panel_10)  # -> out, files
# ---------- python_3_script_10: Python ----------
"""  
Given a folder path, list all files that end with '_RobotCellState.json'.  

Inputs:  
    folder_path: str  - Folder to search in  
Outputs:  
    files: list       - Matching file paths  
"""

import os

files = []
cell_state_path = os.path.join(folder_path, 'RobotCellStates')
# Ensure the folder exists
if not folder_path or not os.path.isdir(cell_state_path):
    print('No path exists')
else:
    for fname in os.listdir(cell_state_path):
        if fname.endswith("_RobotCellState.json"):
            files.append(fname)
# ---------- end python_3_script_10 ----------
construct_plane_6 = ConstructPlane(Origin=point_18, XAxis=curve_81, YAxis=cross_product_2.Vector)  # -> flatten(Plane)
list_item_5 = ListItem(List=construct_plane_6, Index=0, Wrap=True)  # -> Item, Item1

# ----
# Step 6: click compute IK, and reverse IK targets if needed
switch_arm_targets = BooleanToggle(False)
compute_ik = BooleanToggle(True)

plane_7 = Plane(list_item_5.Item1)
deconstruct_plane = DeconstructPlane(Plane=plane_7)  # -> Origin, XAxis, YAxis, ZAxis
list_item_6 = ListItem(List=python_3_script_10.files, Index=0, Wrap=False)
xy_plane_6 = XYPlane(Origin=Point(0, 0, 0))
# z axis: bar axis
# x axis: screw rotational vec
geometry = Geometry(orient_7.Geometry)  # disabled
move = Move(Geometry=deconstruct_plane.Origin, Motion=deconstruct_plane.XAxis)  # -> Geometry, Transform
geometry_2 = Geometry(orient_10.Geometry)
merge_16 = Merge(Data1=geometry, Data2=geometry_2)
data_21 = Data(list_item_6)

# ---- group: dual arm
# Step 3: click connect dual arm
use_gui = BooleanToggle(False)
connect_dual_arm = Button()
python_3_script_11 = Python3Script(trigger=connect_dual_arm, robot_cell=python_3_script_7.robot_cell, use_gui=use_gui)  # -> out, client, planner
# ---------- python_3_script_11: Python ----------
from compas_fab.backends import PyBulletClient
from compas_fab.backends import PyBulletPlanner
import pybullet as p
from scriptcontext import sticky as st
from compas_ghpython import create_id

gh_component = ghenv.Component
sticky_id = create_id(gh_component, '__')
if sticky_id not in st:
    st[sticky_id] = None, None

if trigger:
    client = PyBulletClient(connection_type="gui" if use_gui else "direct", verbose=True)
    client.__enter__()

    # Use PyBullet debug mode by enabling the debug visualizer and optionally adding debug lines/info
    # This will show joint axes, link frames, and other debug info in the GUI
    if use_gui:
        pass
        # p.configureDebugVisualizer(p.COV_ENABLE_GUI, 1, physicsClientId=client.client_id)
        # p.configureDebugVisualizer(p.COV_ENABLE_SHADOWS, 1, physicsClientId=client.client_id)
        # p.configureDebugVisualizer(p.COV_ENABLE_WIREFRAME, 1, physicsClientId=client.client_id)

    planner = PyBulletPlanner(client)
    planner.set_robot_cell(robot_cell)
    st[sticky_id] = client, planner

client, planner = st[sticky_id]
# ---------- end python_3_script_11 ----------

# ----
panel_11 = Panel(python_3_script_10.files)

disconnect_pybullet_client = Button()
remove_debug = Button()
python_3_script_12 = Python3Script(x=remove_debug)  # -> remove_all_debug
# ---------- python_3_script_12: Python ----------
import pybullet_planning as pp
pp.remove_all_debug()
# ---------- end python_3_script_12 ----------
python_3_script_13 = Python3Script(trigger=disconnect_pybullet_client)  # -> out
# ---------- python_3_script_13: Python ----------
import pybullet_planning as pp
if trigger:
    # client.__exit__()
    pp.disconnect()
# ---------- end python_3_script_13 ----------

number_slider_3 = Slider(0, range=0..1)

# ---- group: parse state
# Example for parsing a cell state
python_3_script_14 = Python3Script(file_path=panel_10, file_name=data_21)  # -> out, robot_cell_state; inputs file_path: String, file_name: String
# ---------- python_3_script_14: Python ----------
import os
from compas import json_load

with open(os.path.join(file_path, 'RobotCellStates', file_name), "r") as f:
    robot_cell_state = json_load(f)
print(robot_cell_state.robot_configuration)
# ---------- end python_3_script_14 ----------

# ----
line_3 = Line(StartPoint=deconstruct_plane.Origin, EndPoint=move.Geometry)
pi_3 = Pi(Factor=1)
rotate_axis = RotateAxis(Geometry=plane_7, Angle=pi_3, Axis=line_3)  # -> Geometry, Transform
merge_17 = Merge(Data1=list_item_5.Item, Data2=rotate_axis.Geometry)
plane_8 = Plane(merge_17)

# ---- group: male joint from tool0
point_19 = Point(Point(0.5941849322, -0.1739899321, 1.211150362))
curve_83 = Curve(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)
curve_84 = Curve(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)
list_item_7 = ListItem(List=plane_8, Index=0, Wrap=True)
construct_plane_7 = ConstructPlane(Origin=point_19, XAxis=curve_83, YAxis=curve_84)
python_3_script_15 = Python3Script(plane_a=plane_6, plane_b=construct_plane_7)  # -> out, a_from_b
# ---------- python_3_script_15: Python ----------
# Inputs: plane_a, plane_b (both should be Rhino.Geometry.Plane)
# Output: T (compas.geometry.Transformation)

from compas.geometry import Frame, Transformation
from compas_rhino.conversions import plane_to_compas_frame
from compas_rhino.conversions import transformation_to_rhino

# # Convert Rhino planes to COMPAS frames
# frame_a = plane_to_compas_frame(plane_a)
# frame_b = plane_to_compas_frame(plane_b)

# # Compute the transformation from frame_a to frame
# a_from_b = Transformation.from_frame_to_frame(frame_a, frame_b)
# ghT = transformation_to_rhino(a_from_b)

from compas.geometry import Transformation, Frame
from compas_rhino.conversions import plane_to_compas_frame, frame_to_rhino_plane

def GHPlane_to_tf(plane):
    return Transformation.from_frame(plane_to_compas_frame(plane))

world_from_a = GHPlane_to_tf(plane_a)
world_from_b = GHPlane_to_tf(plane_b)
a_from_b = world_from_a.inverse() * world_from_b
# ---------- end python_3_script_15 ----------

# ----
orient_12 = Orient(Geometry=merge_16, Source=xy_plane_6, Target=plane_8)  # -> Geometry, Transform
use_parsed_grasptargets = BooleanToggle(False)

# ---- group: male joint grasp tool breps
list_item_8 = ListItem(List=orient_12.Geometry, Index=0, Wrap=True)  # -> Item, Item1

# ----
panel_12 = Panel(python_3_script_14.out)
check_collisions = BooleanToggle(False)
subtraction_2 = Subtraction(A=assembly_stage, B="4")

# ---- group: tool breps
merge_18 = Merge(Data1=list_item_8.Item, Data2=list_item_8.Item1)  # -> flatten(Result)

# ----
merge_19 = Merge(Data1="base_left_arm_manipulator", Data2="base_right_arm_manipulator")
ik_stage = Slider(1, range=0..2)
viz_tool = BooleanToggle(False)
stream_filter_3 = StreamFilter(Gate=viz_tool, Stream1=merge_18)
construct_path_3 = ConstructPath(Indices=ik_stage)
construct_path_4 = ConstructPath(Indices=Slider(1, range=0..2))
save_traj = Button()
save_state = Button()
panel_13 = Panel("v-shape")
compute_approach_traj = BooleanToggle(False)
number_slider_4 = Slider(1, range=0..10)
viz_which_traj = Slider(0, range=0..1)
traj_t = Slider(0, range=0..1)
block_instance_5 = BlockInstance(orient_6.Geometry)
colour_swatch_2 = ColourSwatch(SwatchColor=RGB(255, 255, 255))

# ---- group: extract bar centroid frame from breps
deconstruct_brep = DeconstructBrep(Brep=cap_holes)  # -> Faces, Edges, Vertices
volume = Volume(Geometry=cap_holes)  # -> Volume, Centroid
xy_plane_7 = XYPlane(Origin=Point(0, 0, 0))

# ----
length = Length(Curve=deconstruct_brep.Edges)
sort_list = SortList(Keys=length, ValuesValuesA=deconstruct_brep.Edges)  # -> Keys, ValuesValuesA

# ---- group: extract bar centroid frame from breps (continued)
list_item_9 = ListItem(List=sort_list.ValuesValuesA, Index=0, Wrap=True)  # -> Item1, Item, Item1_2
vector = Vector(list_item_9.Item1)
python_3_script_16 = Python3Script(vec=vector, pt=volume.Centroid)  # -> out, simplify(pln); inputs vec: Vector3d, pt: Point3d
# ---------- python_3_script_16: Python ----------
import Rhino.Geometry as rg

# Ensure the input vector is not zero
if vec.IsZero:
    raise ValueError("Input vector cannot be zero.")

# Normalize the input vector to use as Z axis
z_axis = vec
z_axis.Unitize()

# Choose an arbitrary vector not parallel to z_axis for cross product
if abs(z_axis.X) < 0.9:
    temp = rg.Vector3d(1, 0, 0)
else:
    temp = rg.Vector3d(0, 1, 0)

# X axis is perpendicular to Z and temp
x_axis = rg.Vector3d.CrossProduct(temp, z_axis)
x_axis.Unitize()

# Y axis is perpendicular to Z and X
y_axis = rg.Vector3d.CrossProduct(z_axis, x_axis)
y_axis.Unitize()

# Construct the plane
pln = rg.Plane(pt, x_axis, y_axis)
# ---------- end python_3_script_16 ----------
orient_13 = Orient(Geometry=cap_holes, Source=python_3_script_16.pln, Target=xy_plane_7)  # -> simplify(Geometry), Transform

# ----
plane_9 = Plane(python_3_script_16.pln)
tree_branch_4 = TreeBranch(Tree=plane_9, Path=construct_path, MaintainPaths=True)
orient_14 = Orient(Geometry=clean_tree, Source=tree_branch_4, Target=rotate.Geometry)  # -> Geometry, Transform
split_list_2 = SplitList(List=orient_14.Geometry, Index="2")  # -> ListA, ListB
ungroup = Ungroup(Group=split_list_2.ListA)
curve_85 = Curve(split_list_2.ListB)
curve_86 = Curve(curve_85)
curve_middle_4 = CurveMiddle(Curve=curve_86)
curve_87 = Curve(simplify(list_item_9.Item1))
tree_statistics_2 = TreeStatistics(Tree=curve_87)  # -> Paths, Length, Count
deconstruct = Deconstruct(Point=curve_middle_4)  # -> XComponent, YComponent, ZComponent
sort_list_2 = SortList(Keys=deconstruct.YComponent, ValuesValuesA=curve_86)  # -> Keys, ValuesValuesA
split_list_3 = SplitList(List=tree_statistics_2.Paths, Index=tree_statistics.Count)  # -> flatten(ListA), ListB
panel_14 = Panel(split_list_3.ListA)
end_points = EndPoints(Curve=sort_list_2.ValuesValuesA)  # -> Start, End
curve_middle_5 = CurveMiddle(Curve=sort_list_2.ValuesValuesA)
vector_2pt = Vector2Pt(PointA=end_points.Start, PointB=end_points.End, Unitize=False)  # -> Vector, Length
tree_branch_5 = TreeBranch(Tree=integer_2, Path=panel_14, MaintainPaths=True)
tree_branch_6 = TreeBranch(Tree=curve_87, Path=panel_14, MaintainPaths=True)
list_item_10 = ListItem(List=sort_list_2.ValuesValuesA, Index=Slider(0, range=0..5), Wrap=False)
curve_88 = Curve(sort_list_2.ValuesValuesA)
curve_closest_point = CurveClosestPoint(Point=curve_middle, Curve=reparameterize(tree_branch_6))  # -> Point, Parameter, Distance
list_item_11 = ListItem(List=sort_list_2.ValuesValuesA, Index=0, Wrap=True)
curve_closest_point_2 = CurveClosestPoint(Point=curve_middle_2, Curve=reparameterize(tree_branch_6))  # -> Point, Parameter, Distance
sort_list_3 = SortList(Keys=curve_closest_point.Parameter, ValuesValuesA=entwine_3)  # -> Keys, ValuesValuesA
sort_list_4 = SortList(Keys=curve_closest_point_2.Parameter, ValuesValuesA=entwine_2)  # -> Keys, ValuesValuesA
multiplication_5 = Multiplication(A=vector_2pt.Vector, B=Slider(1.9, range=1..2))
vector_display_ex = VectorDisplayEx(Point=end_points.Start, Vector=multiplication_5, Colour=RGB(0, 0, 0), Width=2)
curve_89 = Curve(list_item_11)
vector_2 = Vector(unitize(curve_89))
multiplication_6 = Multiplication(A=vector_2, B=Slider(0.07, range=0..0.1))
angle = Angle(VectorA=curve_89, VectorB=curve_88, Plane=plane_4)  # -> Angle, Reflex
vector_3 = Vector(unitize(sort_list_2.ValuesValuesA))
curve_middle_6 = CurveMiddle(Curve=curve_88)

# ---- group: screw dir
curve_90 = Curve(sort_list_4.ValuesValuesA)

# ---- group: longitude dir
curve_91 = Curve(sort_list_3.ValuesValuesA)

# ----
vector_4 = Vector(unitize(curve_88))
degrees = Degrees(Radians=angle.Angle)
python_3_script_17 = Python3Script(gate=tree_branch_5, data=curve_91)  # -> out, a0, a1, a2, a3
# ---------- python_3_script_17: Python ----------
if gate == 0:
    a0 = data
elif gate == 1:
    a1 = data
elif gate == 2:
    a2 = data
elif gate == 3:
    a3 = data
else:
    raise ValueError
# ---------- end python_3_script_17 ----------
python_3_script_18 = Python3Script(gate=tree_branch_5, data=curve_90)  # -> out, a0, a1, a2, a3; same code as python_3_script_17
python_3_script_19 = Python3Script(in_deg=degrees)  # -> out, a, b; inputs in_deg: Double
# ---------- python_3_script_19: Python ----------
def remove_tolerance(value, tol=1e-3):
    """
    Removes numerical tolerance smaller than 'tol'.
    Example: 90.00004 → 90.0 (if tol=1e-3)
    """
    if abs(value - round(value)) < tol:
        return round(value)
    return value

x = remove_tolerance(in_deg)
print(x)

if x >= 0.0 and x <= 90.0:
    a = x
    b = 0
elif x > 90 and x <= 180:
    b = 1
    a = 90.0 - (x - 90 * b)
elif x > 180 and x <= 270:
    b = 2
    a = (x - 90 * b)
elif x > 270 and x <= 360:
    b =3
    a = 90.0 - (x - 90 * b)

if abs(x - 360.0) < 1e-3:
    a = 0.0
    b = 0
# ---------- end python_3_script_19 ----------
panel_15 = Panel(python_3_script_19.out)
flip_curve_2 = FlipCurve(Curve=python_3_script_17.a1)  # -> Curve, Flag
flip_curve_3 = FlipCurve(Curve=python_3_script_17.a3)  # -> Curve, Flag
move_2 = Move(Geometry=curve_middle_6, Motion=multiplication_2)  # -> Geometry, Transform
format = Format(Format="{0:0.0} + {1}x90 deg", Culture=127, Data0=python_3_script_19.a, Data1=python_3_script_19.b)
merge_20 = Merge(Data1=python_3_script_18.a2, Data2=python_3_script_18.a3)
merge_21 = Merge(Data1=python_3_script_18.a0, Data2=python_3_script_18.a1)
merge_22 = Merge(Data1=python_3_script_17.a2, Data2=flip_curve_3.Curve)
merge_23 = Merge(Data1=python_3_script_17.a0, Data2=flip_curve_2.Curve)

# ---- group: male
cluster_8 = Cluster_3(curve=merge_20, curve_2=merge_22)

# ----
panel_16 = Panel(format)

# ---- group: female
cluster_9 = Cluster_3(curve=merge_21, curve_2=merge_23)

# ----
text_tag_3d = TextTag3D(
    Location=move_2.Geometry,
    Text=format,
    Size=number_slider,
    Colour=ColourSwatch(SwatchColor=RGB(0, 0, 255)),
    Justification=7)
clean_tree_4 = CleanTree(RemoveNulls=True, RemoveInvalid=True, RemoveEmpty=False, Tree=cluster_8)
clean_tree_5 = CleanTree(RemoveNulls=True, RemoveInvalid=True, RemoveEmpty=False, Tree=cluster_9)
plane_10 = Plane(clean_tree_4)
plane_11 = Plane(clean_tree_5)
orient_15 = Orient(Geometry=brep_2, Source=PlaneXY(0, 0, 0), Target=plane_10)  # -> Geometry, Transform
orient_16 = Orient(Geometry=brep, Source=PlaneXY(0, 0, 0), Target=plane_11)  # -> Geometry, Transform
merge_24 = Merge(Data1=orient_16.Geometry, Data2=orient_15.Geometry)
mesh_brep_5 = MeshBrep(Brep=merge_24, Settings=settings_quality)
triangulate_5 = Triangulate(Mesh=mesh_brep_5)  # -> Mesh, Count
mesh_32 = Mesh(triangulate_5.Mesh)
merge_25 = Merge(Data1=mesh_32, Data2=entwine)  # -> simplify(Result)
mesh_33 = Mesh(merge_25)
merge_26 = Merge(Data1=mesh_33, Data2=brep_34)  # -> simplify(Result)
tree_statistics_3 = TreeStatistics(Tree=merge_26)  # -> Paths, Length, Count
split_list_4 = SplitList(List=tree_statistics_3.Paths, Index=addition)  # -> flatten(ListA), ListB

# ---- group: as built viz + current one
tree_branch_7 = TreeBranch(Tree=merge_26, Path=split_list_4.ListA, MaintainPaths=True)

# ----
curve_92 = Curve(list_item_9.Item1)
curve_93 = Curve(simplify(curve_92))
tree_branch_8 = TreeBranch(Tree=curve_93, Path=construct_path, MaintainPaths=True)
curve_middle_7 = CurveMiddle(Curve=tree_branch_8)
vector_2pt_2 = Vector2Pt(PointA=curve_middle_7, PointB=tree_branch_4, Unitize=False)  # -> Vector, Length
move_3 = Move(Geometry=tree_branch_8, Motion=vector_2pt_2.Vector)  # -> Geometry, Transform
orient_17 = Orient(Geometry=move_3.Geometry, Source=tree_branch_4, Target=rotate.Geometry)  # -> Geometry, Transform
curve_94 = Curve(orient_17.Geometry)
end_points_2 = EndPoints(Curve=curve_94)  # -> Start, End
move_4 = Move(Geometry=end_points_2.Start, Motion=multiplication_6)  # -> Geometry, Transform
dot_display = DotDisplay(Point=end_points_2.Start, Colour=ColourSwatch(SwatchColor=RGB(255, 0, 42)), Size="0.01")
curve_closest_point_3 = CurveClosestPoint(Point=curve_middle_5, Curve=curve_94)  # -> Point, Parameter, Distance
line_4 = Line(StartPoint=end_points_2.Start, EndPoint=move_4.Geometry)
distance = Distance(PointA=end_points_2.Start, PointB=curve_closest_point_3.Point)
multiplication_7 = Multiplication(A=distance, B=1000)
vector_5 = Vector(unitize(curve_94))

# ---- group: sanity checks
angle_2 = Angle(VectorA=curve_94, VectorB=curve_88)  # -> Angle, Reflex
degrees_2 = Degrees(Radians=angle_2.Angle)
sanity_check_90 = Panel(degrees_2)

# ----
negative_3 = Negative(Value=vector_5)
length_2 = Length(Curve=curve_94)
move_5 = Move(Geometry=curve_closest_point_3.Point, Motion=negative)  # -> Geometry, Transform
subtraction_3 = Subtraction(
    A=multiplication_7,
    B=pipe_holder_end_to_sensor_wall,
    C=jig_wall_thickness_change_to_4_if_using,
    D=initial_reading_change_if_using_manual_r)
multiplication_8 = Multiplication(A=negative_3, B=Slider(0.16, range=0..1))
multiplication_9 = Multiplication(A=length_2, B=1000)
move_6 = Move(Geometry=end_points_2.Start, Motion=multiplication_8)  # -> Geometry, Transform
format_2 = Format(Format="{1} : TL {0:0.0} mm", Culture=127, Data0=multiplication_9, Data1=list_item.Item1)
format_3 = Format(Format="{0:0.0} mm | {1}", Culture=127, Data0=subtraction_3, Data1=python_3_script.a)
python_3_script_20 = Python3Script(x=subtraction_3, y=integer)  # -> out, gap_vals; inputs x: list of Double, y: list of Int32
# ---------- python_3_script_20: Python ----------
last_val = 0.0
gap_vals = []
for a,b in zip(x,y):
    print(a)
    print(last_val)
    print(b)
    print('---')
    gap_vals.append(a-last_val)
    joint_lenth = 0.05*1000 if b == 2 else 0.06*1000
    last_val = a + joint_lenth
# ---------- end python_3_script_20 ----------
panel_17 = Panel(format_3)
text_tag_3d_2 = TextTag3D(Location=move_6.Geometry, Text=format_2, Size=Slider(0.07, range=0..1), Justification=7)
format_4 = Format(Format="     gap: {0:0.0} mm / min 4 mm", Culture=127, Data0=python_3_script_20.gap_vals)
text_tag_3d_3 = TextTag3D(Location=move_5.Geometry, Text=format_3, Size=number_slider, Colour=colour_swatch, Justification=7)
move_7 = Move(Geometry=curve_closest_point_3.Point, Motion=negative_2)  # -> Geometry, Transform
text_tag_3d_4 = TextTag3D(Location=move_7.Geometry, Text=format_4, Size=multiplication_3, Colour=colour_swatch, Justification=7)
length_3 = Length(Curve=curve_92)
number = Number(flatten(length_3))
panel_18 = Panel(number)
sort_list_5 = SortList(Keys=number)  # -> Keys, ValuesValuesA
panel_19 = Panel(sort_list_5.Keys)
pie_chart = PieChart(number)
format_5 = Format(Format="- {0:0.0000} m", Culture=127, Data0=length_3)
concatenate_2 = Concatenate(FragmentA=list_item_2.Item1, FragmentB=format_5)
end_points_3 = EndPoints(Curve=list_item_9.Item1)  # -> Start, End

# ---- group: bar object frame
construct_path_5 = ConstructPath(Indices=assembly_stage)
tree_branch_9 = TreeBranch(Tree=python_3_script_16.pln, Path=construct_path_5, MaintainPaths=True)

# ---- group: flip bar pose - should be turn into a grasp parameter later
deconstruct_plane_2 = DeconstructPlane(Plane=tree_branch_9)  # -> Origin, XAxis, YAxis, ZAxis
move_8 = Move(Geometry=deconstruct_plane_2.Origin, Motion=deconstruct_plane_2.XAxis)  # -> Geometry, Transform
line_5 = Line(StartPoint=deconstruct_plane_2.Origin, EndPoint=move_8.Geometry)
pi_4 = Pi(Factor=1)
rotate_axis_2 = RotateAxis(Geometry=tree_branch_9, Angle=pi_4, Axis=line_5)  # -> Geometry, Transform
plane_12 = Plane(rotate_axis_2.Geometry)

# ----
text_tag = TextTag(Location=volume.Centroid, Text=concatenate_2)
dot_display_2 = DotDisplay(Point=end_points_3.Start, Colour=RGB(0, 0, 0), Size=Slider(0.005, range=0..1))

# ---- group: inflate the geometry for safe collisions
number_slider_5 = Slider(1, range=1..1.5)
brep_35 = Brep(orient_13.Geometry)
scale_nu = ScaleNU(Geometry=brep_35, Plane=PlaneXY(0, 0, 0), ScaleX=number_slider_5, ScaleY=number_slider_5, ScaleZ=Slider(1, range=1..1.5))  # -> Geometry, Transform

# ----
tree_branch_10 = TreeBranch(Tree=list_item_2.Item1, Path=construct_path_5, MaintainPaths=True)
orient_18 = Orient(Geometry=block_instance_2, Source=PlaneXY(0, 0, 0), Target=plane_12)  # -> Geometry, Transform
deconstruct_plane_3 = DeconstructPlane(Plane=plane_12)  # -> Origin, XAxis, YAxis, ZAxis
mesh_34 = Mesh(scale_nu.Geometry)
tree_branch_11 = TreeBranch(Tree=mesh_34, Path=construct_path_5, MaintainPaths=True)
python_3_script_21 = Python3Script(
    base_robot_cell=data_17,
    base_robot_cell_state=data_16,
    bar_geometry_tree=mesh_34,
    joint_geometry_tree=mesh_33,
    frame_tree=python_3_script_16.pln)  # -> out, result_tree; inputs bar_geometry_tree: tree of Mesh, joint_geometry_tree: tree of Mesh, frame_tree: tree
# ---------- python_3_script_21: Python ----------
"""
Grasshopper RobotCellState Processor

This script processes Grasshopper tree data containing geometry and frames
to create RobotCellState objects with proper temporal sequencing.
"""

import Rhino.Geometry as rg
from compas_fab.robots import RobotCell, RobotCellState, RigidBody, RigidBodyState, RobotCellLibrary
from compas.geometry import Box, Frame
from compas_rhino.conversions import mesh_to_compas, plane_to_compas_frame
from compas.scene import Scene
import ghpythonlib.treehelpers as th


def create_rigid_body_from_mesh(mesh, name):
    # # Convert Brep to mesh for visualization and collision
    # mesh_params = rg.MeshingParameters.Default
    # meshes = rg.Mesh.CreateFromBrep(brep, mesh_params)
    
    visuals = []
    collisions = []
    
    # for mesh in meshes:
    #     if mesh:
    compas_mesh = mesh_to_compas(mesh)
    visuals.append(compas_mesh)
    collisions.append(compas_mesh)
    
    rigid_body = RigidBody(visuals, collisions)
    rigid_body.name = name
    return rigid_body


def process_gh_tree_data(bar_geometry_tree, frame_tree, joint_geometry_tree, base_robot_cell, base_robot_cell_state):
    """
    Process Grasshopper tree data to create RobotCellState objects with temporal sequencing.
    
    Args:
        geometry_tree: Grasshopper tree containing Brep geometries at origin
        frame_tree: Grasshopper tree containing world coordinate frames
        base_robot_cell: Optional base robot cell, if None will use ABB IRB4600
        
    Returns:
        DataTree: Grasshopper tree containing RobotCellState objects
    """
    # Convert trees to Python lists for easier processing
    bar_geometry_data = th.tree_to_list(bar_geometry_tree, lambda x:x)
    joint_geometry_data = th.tree_to_list(joint_geometry_tree, lambda x:x)
    frame_data = th.tree_to_list(frame_tree, lambda x:x)
    
    # Ensure both trees have the same structure
    if len(bar_geometry_data) != len(frame_data):
        raise ValueError("Geometry and frame trees must have the same structure")

    if len(bar_geometry_data) != len(joint_geometry_data):
        raise ValueError("Geometry and joint trees must have the same structure")

    # Initialize base robot cell if not provided
    # if base_robot_cell_state is None:
    #     _, default_robot_cell_state = RobotCellLibrary.abb_irb4600_40_255_gripper_one_beam()
    # else:
    #     default_robot_cell_state = base_robot_cell_state
    robot_cell = base_robot_cell
    # robot_cell_state = base_robot_cell_state

    # Create a list to store all rigid bodies for naming
    rigid_bodies_by_step = [[] for _ in range(len(bar_geometry_data))]
    
    # First pass: create all rigid bodies
    for branch_idx, (geometry_branch, frame_branch) in enumerate(zip(bar_geometry_data, frame_data)):
        for item_idx, (geometry, frame) in enumerate(zip(geometry_branch, frame_branch)):
            if geometry and frame:
                # Create unique name for the rigid body
                body_name = f"b{branch_idx}_{item_idx}"
                rigid_body = create_rigid_body_from_mesh(geometry, body_name)
                rigid_bodies_by_step[branch_idx].append((rigid_body, branch_idx, item_idx))
    
    for branch_idx, geometry_branch in enumerate(joint_geometry_data):
        for item_idx, geometry in enumerate(geometry_branch):
                # Create unique name for the rigid body
                body_name = f"b{branch_idx}_joint_{item_idx}"
                rigid_body = create_rigid_body_from_mesh(geometry, body_name)
                rigid_bodies_by_step[branch_idx].append((rigid_body, branch_idx, item_idx))
    
    # Add all rigid bodies to the robot cell
    for rbs_per_step in rigid_bodies_by_step:
        for rigid_body, _, _ in rbs_per_step:
            # print(rigid_body.name)
            robot_cell.rigid_body_models[rigid_body.name] = rigid_body

    # Second pass: create RobotCellState for each temporal step
    robot_cell_states = []
    
    for current_step in range(len(bar_geometry_data)):
        # Create a new robot cell state
        robot_cell_state = base_robot_cell_state.copy()
        
        # Set up rigid body states for this temporal step
        for temporal_step, rbs_per_step in enumerate(rigid_bodies_by_step):
            for rigid_body, temporal_step, item_idx in rbs_per_step:
                if temporal_step < current_step:
                    # This object has appeared or is current - use its world frame
                    frame_branch = frame_data[temporal_step]                
                    if 'joint' not in rigid_body.name and item_idx < len(frame_branch) and frame_branch[item_idx]:
                        print(rigid_body.name)
                        world_frame = plane_to_compas_frame(frame_branch[item_idx])
                        is_hidden = False
                    else:
                        # Fallback to origin if frame is missing
                        world_frame = Frame.worldXY()
                        is_hidden = False
                else:
                    # This object hasn't appeared yet - place it far away and hide it
                    world_frame = Frame.worldXY()
                    world_frame.point.z = 10  # Move far away

                    # TODO hidden is not working properly with PybulletClient
                    is_hidden = False
            
                robot_cell_state.rigid_body_states[rigid_body.name] = RigidBodyState(
                    world_frame,
                    is_hidden=is_hidden
                )

        robot_cell_states.append(robot_cell_state)
    
    # Convert back to Grasshopper tree structure
    result_tree = th.list_to_tree(robot_cell_states)
    return result_tree


def create_scene_from_robot_cell_state(robot_cell, robot_cell_state):
    """
    Create a COMPAS scene from a RobotCellState for visualization.
    
    Args:
        robot_cell: The RobotCell containing the models
        robot_cell_state: The RobotCellState containing the poses
        
    Returns:
        Scene: COMPAS scene object
    """
    scene = Scene()
    scene.add(robot_cell, robot_cell_state)
    return scene

# try:
result_tree = process_gh_tree_data(bar_geometry_tree, frame_tree, joint_geometry_tree, base_robot_cell, base_robot_cell_state)
# except Exception as e:
#     print(f"Error processing tree data: {str(e)}")
# ---------- end python_3_script_21 ----------
rotate_3 = Rotate(Geometry=orient_18.Geometry, Angle=multiplication_4, Plane=plane_12)  # -> Geometry, Transform
list_item_12 = ListItem(List=python_3_script_21.result_tree, Index=assembly_stage, Wrap=True)
multiplication_10 = Multiplication(A=deconstruct_plane_3.ZAxis, B=grasp_offset_2)
multiplication_11 = Multiplication(A=deconstruct_plane_3.ZAxis, B=grasp_offset)
move_9 = Move(Geometry=rotate_3.Geometry, Motion=multiplication_11)  # -> Geometry, Transform
move_10 = Move(Geometry=rotate_3.Geometry, Motion=multiplication_10)  # -> Geometry, Transform
data_22 = Data(list_item_12)
merge_27 = Merge(Data1=rotate_3.Transform, Data2=move_9.Transform)
python_3_script_22 = Python3Script(robot_cell_state=data_22, joint_values=stream_filter, base_frame=construct_plane_4)  # -> out, new_robot_cell_state; inputs joint_values: list of Double, base_frame: Plane
# ---------- python_3_script_22: Python ----------
# BUG: this will lose all object data
# new_robot_cell_state = robot_cell_state.copy()

new_robot_cell_state = robot_cell_state.copy()
for i, joint_value in enumerate(joint_values):
    new_robot_cell_state.robot_configuration.joint_values[i] = joint_value

from compas_rhino.conversions import plane_to_compas_frame

new_robot_cell_state.robot_base_frame = plane_to_compas_frame(base_frame)

print(new_robot_cell_state.rigid_body_ids) #states['b0'].frame)
# ---------- end python_3_script_22 ----------
merge_28 = Merge(Data1=rotate_3.Transform, Data2=move_10.Transform)
compound = Compound(Transforms=merge_27)
plane_13 = Plane(plane_12)
compound_2 = Compound(Transforms=merge_28)
transform = Transform(Geometry=plane_13, Transform=compound_2)
transform_2 = Transform(Geometry=plane_13, Transform=compound)
python_3_script_23 = Python3Script(plane=transform, bar_grasp_from_tool0=data_18)  # -> out, plane_out
# ---------- python_3_script_23: Python ----------
# Inputs: plane (Rhino.Geometry.Plane), T (compas.geometry.Transformation)
# Output: plane_out (Rhino.Geometry.Plane)

from compas_rhino.conversions import plane_to_compas_frame, frame_to_rhino_plane
from compas.geometry import Transformation, Frame

# Convert Rhino plane to COMPAS frame
frame = plane_to_compas_frame(plane)
world_from_bar_grasp = Transformation.from_frame(frame)

# Apply the transformation
# frame_transformed = frame.transformed(T)
world_from_tool0 = world_from_bar_grasp * bar_grasp_from_tool0

# Convert back to Rhino plane
plane_out = frame_to_rhino_plane(Frame.from_transformation(world_from_tool0))
# ---------- end python_3_script_23 ----------
python_3_script_24 = Python3Script(plane=transform_2, bar_grasp_from_tool0=data_18)  # -> out, plane_out
# ---------- python_3_script_24: Python ----------
# Inputs: plane (Rhino.Geometry.Plane), T (compas.geometry.Transformation)
# Output: plane_out (Rhino.Geometry.Plane)

from compas_rhino.conversions import plane_to_compas_frame, frame_to_rhino_plane
from compas.geometry import Transformation, Frame

# Convert Rhino plane to COMPAS frame
frame = plane_to_compas_frame(plane)
world_from_bar_grasp = Transformation.from_frame(frame)

# Apply the transformation
# frame_transformed = frame.transformed(T)
world_from_tool0 = world_from_bar_grasp * bar_grasp_from_tool0

# Convert back to Rhino plane
print(Frame.from_transformation(world_from_tool0))
plane_out = frame_to_rhino_plane(Frame.from_transformation(world_from_tool0))
# ---------- end python_3_script_24 ----------
plane_14 = Plane(python_3_script_23.plane_out)
plane_15 = Plane(python_3_script_24.plane_out)
plane_16 = Plane(plane_12)
python_3_script_25 = Python3Script(world_from_bar=plane_12, world_from_male_joint=plane_8, male_joint_from_tool0=python_3_script_15.a_from_b)  # -> out, flatten(target), tf_bar_from_male_joint
# ---------- python_3_script_25: Python ----------
from compas.data import Data
class GraspTarget(Data):
    def __init__(self, target_type, **kwargs):
        super(GraspTarget, self).__init__()
        self.type = target_type
        for k, v in kwargs.items():
            setattr(self, k, v)

    @property
    def __data__(self):
        # Customize this to serialize all relevant attributes
        data = {'type': self.type}
        for k, v in self.__dict__.items():
            if k not in ['type', '_guid', '_name']:
                data[k] = v
        return data

    @classmethod
    def __from_data__(cls, data):
        target_type = data.pop('type')
        return cls(target_type, **data)

##################

from compas.geometry import Transformation, Frame
from compas_rhino.conversions import plane_to_compas_frame, frame_to_rhino_plane


def GHPlane_to_tf(plane):
    return Transformation.from_frame(plane_to_compas_frame(plane))

tf_world_from_bar = Transformation.from_frame(plane_to_compas_frame(world_from_bar))
tf_world_from_male_joint = Transformation.from_frame(plane_to_compas_frame(world_from_male_joint))
tf_bar_from_male_joint = tf_world_from_bar.inverse() * tf_world_from_male_joint

target = GraspTarget(
    "male_joint",
    world_from_bar=tf_world_from_bar,
    bar_from_male_joint=tf_bar_from_male_joint,
    male_joint_from_tool0=male_joint_from_tool0,
    world_from_tool0=tf_world_from_male_joint * male_joint_from_tool0
)
# ---------- end python_3_script_25 ----------

# ---- group: LEFT tool0 target
geometry_3 = Geometry(move_9.Geometry)

# ----
geometry_4 = Geometry(move_10.Geometry)
merge_29 = Merge(Data1=plane_15, Data2=plane_14)
merge_30 = Merge(Data1=geometry_3, Data2=geometry_4)
python_3_script_26 = Python3Script(world_from_bar=plane_12, world_from_tool0=merge_29)  # -> out, target
# ---------- python_3_script_26: Python ----------
from compas.data import Data
class GraspTarget(Data):
    def __init__(self, target_type, **kwargs):
        super(GraspTarget, self).__init__()
        self.type = target_type
        for k, v in kwargs.items():
            setattr(self, k, v)

    @property
    def __data__(self):
        # Customize this to serialize all relevant attributes
        data = {'type': self.type}
        for k, v in self.__dict__.items():
            if k not in ['type', '_guid', '_name']:
                data[k] = v
        return data

    @classmethod
    def __from_data__(cls, data):
        target_type = data.pop('type')
        return cls(target_type, **data)

from compas_rhino.conversions import plane_to_compas_frame, frame_to_rhino_plane
from compas.geometry import Transformation, Frame

def GHPlane_to_tf(plane):
    return Transformation.from_frame(plane_to_compas_frame(plane))

target = GraspTarget(
    "direct",
    world_from_bar=GHPlane_to_tf(world_from_bar),
    world_from_tool0=GHPlane_to_tf(world_from_tool0)
)
# ---------- end python_3_script_26 ----------
list_item_13 = ListItem(List=merge_30, Index=number_slider_3, Wrap=True)  # -> Item, Item1
list_item_14 = ListItem(List=python_3_script_26.target, Index=number_slider_3, Wrap=True)  # -> Item, Item1

# ---- group: male joint grasp targets
list_item_15 = ListItem(List=python_3_script_25.target, Index=0, Wrap=True)  # -> Item, Item1

# ----
python_3_script_27 = Python3Script(planner=python_3_script_11.planner, robot_cell_state=python_3_script_22.new_robot_cell_state)  # -> out, planner
# ---------- python_3_script_27: Python ----------
import pybullet_planning as pp
from compas.geometry import Frame, Transformation

def pose_from_frame(frame, scale=1.0):
    return ([v*scale for v in frame.point], frame.quaternion.xyzw)

def frame_from_pose(pose, scale=1.0):
    point, (x, y, z, w) = pose
    return Frame.from_quaternion([w, x, y, z], point=[v*scale for v in point])

planner.set_robot_cell_state(robot_cell_state)
robot_base_frame = robot_cell_state.robot_base_frame
robot_base_pose = pose_from_frame(robot_base_frame)
pp.set_pose(planner.client.robot_puid, robot_base_pose)
# ---------- end python_3_script_27 ----------

# ---- group: world from bar in assembled state
world_from_bar_assembled_state = Plane(plane_12)

# ---- group: tool targets
merge_31 = Merge(Data1=list_item_15.Item, Data2=list_item_15.Item1)  # -> flatten(Result)

# ----
data_23 = Data(tree_branch_10)
concatenate_3 = Concatenate(A="A", Fragment_A=subtraction_2, B="-", Fragment_B=data_23)
panel_20 = Panel(world_from_bar_assembled_state)

# ---- group: female joint at a particular pose
curve_middle_8 = CurveMiddle(Curve=curve_76)
cross_product_3 = CrossProduct(VectorA=curve_76, VectorB=curve_77, Unitize=True)  # -> Vector, Length
mesh_35 = Mesh(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)
block_instance_6 = BlockInstance(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)
xy_plane_8 = XYPlane(Origin=Point(0, 0, 0))

# ---- group: female joint at a particular pose / joint jaw center line mid point
point_20 = Point(curve_middle_8)

# ---- group: female joint at a particular pose (continued)
construct_plane_8 = ConstructPlane(Origin=point_20, XAxis=curve_77, YAxis=cross_product_3.Vector)
orient_19 = Orient(Geometry=mesh_35, Source=construct_plane_8, Target=xy_plane_8)  # -> Geometry, Transform

# ---- group: female at origin
# z axis: bar axis
# x axis: screw rotational vec
mesh_36 = Mesh(orient_19.Geometry)

# ---- group: viz switcher
# Step 8: change viz mode to planned (1) to see the result in Rhino
viz_mode = Slider(0, range=0..2)
panel_21 = Panel("0:guess|1:planned|2:parsed|3:traj")

# ----
python_3_script_28 = Python3Script(x=compute_ik, y=viz_mode)  # -> out, a
# ---------- python_3_script_28: Python ----------
a = 1 if x else y
# ---------- end python_3_script_28 ----------

# ---- group: export json
# Step 7: when IK is computed, the RobotCellState is saved as a JSON automatically,
# but make sure you click the `save robot cell` button at least once (cell saving takes long compared to state)
panel_22 = Panel("D:\0_Project\03-2025_husky_assembly\Code\husky-assembly-teleop\data\husky_assembly_design_study\250929_New_Antenna_with_GH_RH_Packed")
data_24 = Data(tree_branch_10)
concatenate_4 = Concatenate(FragmentA="robotx_box_", FragmentB=concatenate_3)  # disabled
panel_23 = Panel(data_24)
save_robot_cell = Button()

# ---- group: parse state
python_3_script_29 = Python3Script(x=viz_mode, file_path=panel_22, state_name=concatenate_4)  # -> out, robot_cell_state; inputs file_path: String, state_name: String; disabled
# ---------- python_3_script_29: Python ----------
import os
from compas import json_load

with open(os.path.join(file_path, 'RobotCellStates', '{}_{}.json'.format(state_name, 'RobotCellState')), "r") as f:
    robot_cell_state = json_load(f)
# ---------- end python_3_script_29 ----------

# ----
panel_24 = Panel(data_24)
python_3_script_30 = Python3Script(load=use_parsed_grasptargets, file_path=panel_22, state_name=data_24)  # -> out, grasp_targets
# ---------- python_3_script_30: Python ----------
import os
import json
from compas.data import Data
from compas.geometry import Transformation

class GraspTarget(Data):
    def __init__(self, target_type, **kwargs):
        super(GraspTarget, self).__init__()
        self.type = target_type
        for k, v in kwargs.items():
            setattr(self, k, v)

    @property
    def __data__(self):
        data = {'type': self.type}
        for k, v in self.__dict__.items():
            if k not in ['type', '_guid', '_name']:
                data[k] = v
        return data

    @classmethod
    def __from_data__(cls, data):
        target_type = data.pop('type')
        return cls(target_type, **data)

def parse_transformation(data):
    """Parse a transformation from a dict with a 'matrix' key."""
    if isinstance(data, dict) and 'matrix' in data:
        return Transformation(data['matrix'])
    return data

def parse_grasp_target_dict(d):
    """Parse a dict (from JSON) into a GraspTarget, converting transformations."""
    target_type = d.get('type')
    kwargs = {}
    for k, v in d.items():
        if k == 'type':
            continue
        # Handle nested 'data' for transformations
        if isinstance(v, dict) and v.get('dtype', '').endswith('Transformation'):
            kwargs[k] = parse_transformation(v['data'])
        else:
            kwargs[k] = v
    return GraspTarget(target_type, **kwargs)

def load_grasp_targets(file_path, state_name):
    in_path = os.path.join(file_path, 'RobotCellStates', state_name + '_GraspTargets.json')
    with open(in_path, 'r') as f:
        raw = json.load(f)
    # raw is a list of objects, each with a 'data' key
    targets = []
    for item in raw:
        data = item['data'] if 'data' in item else item
        print(data)
        targets.append(parse_grasp_target_dict(data))
    return targets

# GHPython inputs: file_path, state_name, load
# Output: grasp_targets

grasp_targets = None
if load:
    grasp_targets = load_grasp_targets(file_path, state_name)
    # print(grasp_targets[0].type)
# ---------- end python_3_script_30 ----------
stream_filter_4 = StreamFilter(Gate=use_parsed_grasptargets, Stream0=merge_31, Stream1=python_3_script_30.grasp_targets)

# ---- group: assembled state
data_25 = Data(stream_filter_4)

# ----
python_3_script_31 = Python3Script(targets=data_25)  # -> out, tool0_planes, approach_vector, retreat_vectors; inputs targets: list
# ---------- python_3_script_31: Python ----------
# GHPython inputs: world_from_bar, world_from_tool0
# Output: target
from compas_rhino.conversions import frame_to_rhino_plane
from compas.geometry import Frame
plane = None

approach_vector = None
retreat_vectors = []

def tf_to_plane(tf):
    return frame_to_rhino_plane(Frame.from_transformation(tf))

tool0_planes = [tf_to_plane(t.world_from_tool0) for t in targets]
print([targets[0].type, targets[1].type])
for t in targets:
    print(t.world_from_tool0)
if targets[0].type == 'male_joint' and targets[1].type == 'male_joint':
    approach_vector = -(tf_to_plane(targets[0].world_from_tool0).ZAxis + tf_to_plane(targets[1].world_from_tool0).ZAxis)/2
    retreat_vectors = [-tf_to_plane(targets[0].world_from_tool0).ZAxis, -tf_to_plane(targets[1].world_from_tool0).ZAxis]
elif targets[0].type == 'direct' and targets[1].type == 'direct':
    raise ValueError
elif targets[0].type == 'direct' and targets[1].type == 'male_joint':
    approach_vector = -tf_to_plane(targets[1].world_from_tool0).ZAxis
    retreat_vectors = [-tf_to_plane(targets[0].world_from_tool0).ZAxis, -tf_to_plane(targets[1].world_from_tool0).ZAxis]
elif targets[1].type == 'direct' and targets[0].type == 'male_joint':
    approach_vector = -tf_to_plane(targets[0].world_from_tool0).ZAxis
    retreat_vectors = [-tf_to_plane(targets[0].world_from_tool0).ZAxis, -tf_to_plane(targets[1].world_from_tool0).ZAxis]
else:
    raise ValueError
# ---------- end python_3_script_31 ----------
plane_17 = Plane(python_3_script_31.tool0_planes)
panel_25 = Panel(python_3_script_31.out)
plane_18 = Plane(python_3_script_31.tool0_planes)
multiplication_12 = Multiplication(A=python_3_script_31.retreat_vectors, B=retreat_distance)
vector_6 = Vector(multiplication_12)
multiplication_13 = Multiplication(A=python_3_script_31.approach_vector, B=approach_distance)
move_11 = Move(Geometry=plane_18, Motion=vector_6)  # -> Geometry, Transform
vector_7 = Vector(multiplication_13)
move_12 = Move(Geometry=world_from_bar_assembled_state, Motion=vector_7)  # -> Geometry, Transform
python_3_script_32 = Python3Script(input_targets=stream_filter_4, world_from_bar=move_12.Geometry)  # -> out, flatten(targets); inputs input_targets: list
# ---------- python_3_script_32: Python ----------
from compas.data import Data
class GraspTarget(Data):
    def __init__(self, target_type, **kwargs):
        super(GraspTarget, self).__init__()
        self.type = target_type
        for k, v in kwargs.items():
            setattr(self, k, v)

    @property
    def __data__(self):
        # Customize this to serialize all relevant attributes
        data = {'type': self.type}
        for k, v in self.__dict__.items():
            if k not in ['type', '_guid', '_name']:
                data[k] = v
        return data

    @classmethod
    def __from_data__(cls, data):
        target_type = data.pop('type')
        return cls(target_type, **data)

##################

from compas.geometry import Transformation, Frame
from compas_rhino.conversions import plane_to_compas_frame, frame_to_rhino_plane


def GHPlane_to_tf(plane):
    return Transformation.from_frame(plane_to_compas_frame(plane))

tf_world_from_bar = Transformation.from_frame(plane_to_compas_frame(world_from_bar))
targets = []

for input_target in input_targets:
    if input_target.type != 'direct':
        tf_bar_from_male_joint = input_target.bar_from_male_joint
        tf_world_from_male_joint = tf_world_from_bar * tf_bar_from_male_joint

        target = GraspTarget(
            "male_joint",
            world_from_bar=tf_world_from_bar,
            bar_from_male_joint=tf_bar_from_male_joint,
            male_joint_from_tool0=input_target.male_joint_from_tool0,
            world_from_tool0=tf_world_from_male_joint * input_target.male_joint_from_tool0
        )
    else:
        # print(type(input_target))
        # target = input_target.copy()
        target = GraspTarget(
            "direct",
            world_from_bar=None,
            world_from_tool0=None,
        )
        tf_bar_from_tool = input_target.world_from_bar.inverse() * input_target.world_from_tool0
        target.world_from_bar = tf_world_from_bar
        target.world_from_tool0 = tf_world_from_bar * tf_bar_from_tool
    print(target.world_from_tool0)
    targets.append(target)
# ---------- end python_3_script_32 ----------
python_3_script_33 = Python3Script(input_target=stream_filter_4, world_from_tool0=move_11.Geometry)  # -> out, flatten(target)
# ---------- python_3_script_33: Python ----------
from compas.data import Data
class GraspTarget(Data):
    def __init__(self, target_type, **kwargs):
        super(GraspTarget, self).__init__()
        self.type = target_type
        for k, v in kwargs.items():
            setattr(self, k, v)

    @property
    def __data__(self):
        # Customize this to serialize all relevant attributes
        data = {'type': self.type}
        for k, v in self.__dict__.items():
            if k not in ['type', '_guid', '_name']:
                data[k] = v
        return data

    @classmethod
    def __from_data__(cls, data):
        target_type = data.pop('type')
        return cls(target_type, **data)

##################

from compas.geometry import Transformation, Frame
from compas_rhino.conversions import plane_to_compas_frame, frame_to_rhino_plane


def GHPlane_to_tf(plane):
    return Transformation.from_frame(plane_to_compas_frame(plane))

# tf_world_from_bar = Transformation.from_frame(plane_to_compas_frame(world_from_bar))

target = GraspTarget(
    "direct",
    world_from_bar=None,
    world_from_tool0=GHPlane_to_tf(world_from_tool0)
)

# if input_target.type != 'direct':
#     tf_bar_from_male_joint = input_target.bar_from_male_joint
#     tf_world_from_male_joint = tf_world_from_bar * tf_bar_from_male_joint

#     target = GraspTarget(
#         "male_joint",
#         world_from_bar=tf_world_from_bar,
#         bar_from_male_joint=tf_bar_from_male_joint,
#         male_joint_from_tool0=male_joint_from_tool0,
#         world_from_tool0=tf_world_from_male_joint * male_joint_from_tool0
#     )
# else:
#     target = input_target.copy()
#     target.world_from_bar = tf_world_from_bar
# ---------- end python_3_script_33 ----------
entwine_7 = Entwine(Branch00=python_3_script_32.targets, Branch01=data_25, Branch02=python_3_script_33.target, FlattenInputs=True)  # -> simplify(Result)
reverse_list = ReverseList(List=entwine_7)
stream_filter_5 = StreamFilter(Gate=switch_arm_targets, Stream0=entwine_7, Stream1=reverse_list)

# ---- group: we save the assembled state
construct_path_6 = ConstructPath(Indices="1")
tree_branch_12 = TreeBranch(Tree=stream_filter_5, Path=construct_path_6, MaintainPaths=True)
python_3_script_34 = Python3Script(target=tree_branch_12)  # -> out, plane
# ---------- python_3_script_34: Python ----------
# GHPython inputs: world_from_bar, world_from_tool0
# Output: target
from compas_rhino.conversions import frame_to_rhino_plane
from compas.geometry import Frame
plane = None
if target:
    plane = frame_to_rhino_plane(Frame.from_transformation(target.world_from_tool0))
# ---------- end python_3_script_34 ----------

# ----
tree_branch_13 = TreeBranch(Tree=stream_filter_5, Path=construct_path_3, MaintainPaths=True)

python_3_script_35 = Python3Script(target=python_3_script_32.targets)  # -> out, plane
# ---------- python_3_script_35: Python ----------
# GHPython inputs: world_from_bar, world_from_tool0
# Output: target
from compas_rhino.conversions import frame_to_rhino_plane
from compas.geometry import Frame
plane = None
if target:
    print(target.world_from_tool0)
    plane = frame_to_rhino_plane(Frame.from_transformation(target.world_from_tool0))

    # tf_bar_from_male_joints = target.bar_from_male_joint
# ---------- end python_3_script_35 ----------
negative_4 = Negative(Value=multiplication_13)
deconstruct_plane_4 = DeconstructPlane(Plane=python_3_script_35.plane)  # -> Origin, XAxis, YAxis, unitize(ZAxis)
vector_display_ex_2 = VectorDisplayEx(
    Point=deconstruct_plane_4.Origin,
    Vector=negative_4,
    Colour=ColourSwatch(SwatchColor=RGB(255, 0, 255)),
    Width=Slider(6, range=2..10))

python_3_script_36 = Python3Script(target=tree_branch_13)  # -> out, plane; same code as python_3_script_34
tree_branch_14 = TreeBranch(Tree=stream_filter_5, Path=construct_path_4, MaintainPaths=True)
python_3_script_37 = Python3Script(target=tree_branch_14)  # -> out, plane
# ---------- python_3_script_37: Python ----------
# GHPython inputs: world_from_bar, world_from_tool0
# Output: target
from compas_rhino.conversions import frame_to_rhino_plane
from compas.geometry import Frame
plane = None
if target:
    plane = frame_to_rhino_plane(Frame.from_transformation(target.world_from_tool0))

    # tf_bar_from_male_joints = target.bar_from_male_joint
# ---------- end python_3_script_37 ----------

deconstruct_plane_5 = DeconstructPlane(Plane=plane_18)  # -> Origin, XAxis, YAxis, unitize(ZAxis)
vector_display_ex_3 = VectorDisplayEx(
    Point=deconstruct_plane_5.Origin,
    Vector=multiplication_12,
    Colour=ColourSwatch(SwatchColor=RGB(0, 0, 255)),
    Width=Slider(6, range=2..10))

panel_26 = Panel(python_3_script_32.out)
plane_19 = Plane(python_3_script_36.plane)
plane_20 = Plane(flatten(plane_19))

# ---- group: pb backend ik test
python_3_script_38 = Python3Script(
    trigger=compute_ik,
    planner=python_3_script_27.planner,
    robot_cell_state=python_3_script_22.new_robot_cell_state,
    target_planes=plane_20,
    groups=merge_19,
    check_collision=check_collisions,
    tolerance_position="0.0001",
    tolerance_orientation="0.0001",
    max_descend_iterations="30")  # -> out, new_robot_cell_state; inputs target_planes: list of Plane, groups: list, tolerance_position: Double, tolerance_orientation: Double, max_descend_iterations: Int32
# ---------- python_3_script_38: Python ----------
from compas.geometry import Frame

from compas_fab.backends import PyBulletClient
from compas_fab.backends import PyBulletPlanner
from compas_fab.robots import FrameTarget
from compas_fab.robots import RobotCellLibrary
from compas_fab.robots import TargetMode
from compas_rhino.conversions import plane_to_compas_frame
import pybullet_planning as pp
import pybullet as p

from compas.geometry import Frame, Transformation

def pose_from_frame(frame, scale=1.0):
    return ([v*scale for v in frame.point], frame.quaternion.xyzw)

def frame_from_pose(pose, scale=1.0):
    point, (x, y, z, w) = pose
    return Frame.from_quaternion([w, x, y, z], point=[v*scale for v in point])

targets = []
for tp in target_planes:    
    target = FrameTarget(plane_to_compas_frame(tp), 
                         TargetMode.ROBOT,
                         tolerance_position=tolerance_position,
                         tolerance_orientation=tolerance_orientation
                         )
    targets.append(target)
    pp.draw_pose(pose_from_frame(target.target_frame))

new_robot_cell_state = None
        
if trigger:
    print(planner.client._get_pose_joint_names_and_puids())

    options = {
        "max_results": 20, 
        "check_collision": check_collision,
        "max_descend_iterations" : max_descend_iterations,
        "verbose" : False,
        }

    new_robot_cell_state = robot_cell_state.copy()
    for target, group in zip(targets, groups):
        print(f'ik for {group}')
        try:
        # if 1:
            config = planner.inverse_kinematics(
                target, 
                new_robot_cell_state, 
                group=group, 
                options=options
            )
        except Exception as e:
            print(f"IK failed for {group}: {e}")
            config = None

        if config is not None:
                # To verify the IK result, we can compute the FK with the obtained joint positions
            print(config)
            new_robot_cell_state.robot_configuration.merge(config)

            # # Only update the joints in this group
            # group_joint_names = planner.client.robot_cell.get_configurable_joint_names(group)
            # for joint_name, joint_value in zip(config.joint_names, config.joint_values):
            #     if joint_name in group_joint_names:
            #         new_robot_cell_state.robot_configuration[joint_name] = joint_value

if new_robot_cell_state:
    planner.client._set_robot_configuration(new_robot_cell_state.robot_configuration)

print("Found configuration", config)
# result_count += 1
# print("Found %d configurations" % result_count)
# ---------- end python_3_script_38 ----------

# ---- group: viz switcher (continued)
stream_filter_6 = StreamFilter(
    Gate=python_3_script_28.a,
    Stream0=python_3_script_22.new_robot_cell_state,
    Stream1=python_3_script_38.new_robot_cell_state,
    Stream2=python_3_script_14.robot_cell_state)

# ----
panel_27 = Panel(python_3_script_38.out)

# ---- group: tool and bar - second target
geometry_5 = Geometry(tree_branch_11)
move_13 = Move(Geometry=merge_18, Motion=vector_7)  # -> Geometry, Transform
orient_20 = Orient(Geometry=geometry_5, Source=PlaneXY(0, 0, 0), Target=move_12.Geometry)  # -> Geometry, Transform

# ----
python_3_script_39 = Python3Script(grasp_targets=stream_filter_5)  # -> out, start_world_from_bar, goal_world_from_bar, left_bar_from_tool0, right_bar_from_tool0; inputs grasp_targets: tree
# ---------- python_3_script_39: Python ----------
"""
Grasshopper Python Script: Extract Dual Arm Transformation Data from GraspTarget Tree

This script processes a Grasshopper Tree structure containing GraspTarget objects
and extracts the required transformation data for dual arm planning.

Tree Structure:
- Branch 0: Start poses (2 items: left arm, right arm)
- Branch 1: Goal poses (2 items: left arm, right arm)

Each item is a GraspTarget with the following attributes:
- world_from_bar: Frame representing the bar pose in world coordinates
- bar_from_male_joint: Transformation from bar to male joint
- male_joint_from_tool0: Transformation from male joint to tool0
- world_from_tool0: Computed world to tool0 transformation
"""

import Rhino.Geometry as rg
from compas.geometry import Frame, Transformation

def extract_dual_arm_transformations(grasp_target_tree):
    """
    Extract transformation data from GraspTarget tree for dual arm planning.
    
    Parameters:
    -----------
    grasp_target_tree : Grasshopper.DataTree
        Tree containing GraspTarget objects with start/end and left/right arm data
        
    Returns:
    --------
    tuple : (start_world_from_bar, goal_world_from_bar, left_bar_from_tool0, right_bar_from_tool0)
    """
    
    # Validate tree structure
    if grasp_target_tree.BranchCount < 2:
        raise ValueError(f"Expected at least 2 branches (start/end), got {grasp_target_tree.BranchCount}")
    
    # Extract start poses (Branch 0)
    start_branch = grasp_target_tree.Branch(0)
    if len(start_branch) < 2:
        raise ValueError(f"Expected at least 2 items in start branch (left/right), got {len(start_branch)}")
    
    start_left_target = start_branch[0]  # Left arm start
    start_right_target = start_branch[1]  # Right arm start
    
    # Extract goal poses (Branch 1) 
    goal_branch = grasp_target_tree.Branch(1)
    if len(goal_branch) < 2:
        raise ValueError(f"Expected at least 2 items in goal branch (left/right), got {len(goal_branch)}")
    
    goal_left_target = goal_branch[0]  # Left arm goal
    goal_right_target = goal_branch[1]  # Right arm goal
    
    # Validate that all targets have required attributes
    # required_attrs = ['world_from_bar', 'bar_from_male_joint', 'male_joint_from_tool0']
    # for target_name, target in [("start_left", start_left_target), ("start_right", start_right_target), 
    #                            ("goal_left", goal_left_target), ("goal_right", goal_right_target)]:
    #     for attr in required_attrs:
    #         if not hasattr(target, attr):
    #             raise AttributeError(f"{target_name} target missing required attribute: {attr}")
    
    # Extract world_from_bar frames
    # For start: use the left arm's world_from_bar (both arms should have same bar pose)
    start_world_from_bar = start_left_target.world_from_bar
    
    # For goal: use the left arm's world_from_bar (both arms should have same bar pose)
    goal_world_from_bar = goal_left_target.world_from_bar
    
    # Compute bar_from_tool0 transformations for each arm
    # Formula: bar_from_tool0 = bar_from_male_joint * male_joint_from_tool0
    
    # Left arm transformation
    if start_left_target.type != 'direct':
        left_bar_from_tool0 = start_left_target.bar_from_male_joint * start_left_target.male_joint_from_tool0
    else:
        left_bar_from_tool0 = start_left_target.world_from_bar.inverse() * start_left_target.world_from_tool0
    
    # Right arm transformation  
    if start_right_target.type != 'direct':
        right_bar_from_tool0 = start_right_target.bar_from_male_joint * start_right_target.male_joint_from_tool0
    else:
        right_bar_from_tool0 = start_right_target.world_from_bar.inverse() * start_right_target.world_from_tool0

    # Verify that start and goal have consistent bar poses for each arm
    verbose = getattr(options, 'get', lambda x, y: False)("verbose", False)
    if verbose:
        print("=== Dual Arm Transformation Extraction ===")
        print(f"Start world_from_bar: {start_world_from_bar}")
        print(f"Goal world_from_bar: {goal_world_from_bar}")
        print(f"Left bar_from_tool0: {left_bar_from_tool0}")
        print(f"Right bar_from_tool0: {right_bar_from_tool0}")
        
        # Verify consistency between start and goal
        # Extract translation vectors from transformations
        start_translation = start_world_from_bar.translation_vector
        goal_translation = goal_world_from_bar.translation_vector
        start_goal_bar_diff = (start_translation - goal_translation).length
        print(f"Bar position difference (start to goal): {start_goal_bar_diff:.6f}")
        
        # Verify left/right arm consistency at start
        start_left_translation = start_left_target.world_from_bar.translation_vector
        start_right_translation = start_right_target.world_from_bar.translation_vector
        left_right_start_diff = (start_left_translation - start_right_translation).length
        print(f"Left/Right bar position difference at start: {left_right_start_diff:.6f}")
        
        # Verify left/right arm consistency at goal
        goal_left_translation = goal_left_target.world_from_bar.translation_vector
        goal_right_translation = goal_right_target.world_from_bar.translation_vector
        left_right_goal_diff = (goal_left_translation - goal_right_translation).length
        print(f"Left/Right bar position difference at goal: {left_right_goal_diff:.6f}")
        
        if left_right_start_diff > 0.001 or left_right_goal_diff > 0.001:
            print("WARNING: Left and right arms have different bar poses!")
        else:
            print("✓ Left and right arms have consistent bar poses")
    
    return start_world_from_bar, goal_world_from_bar, left_bar_from_tool0, right_bar_from_tool0

# Main execution
if __name__ == "__main__" or True:  # Always execute in Grasshopper
    # Default options for verbose output
    options = {
        "verbose": True,
        "check_collision": True,
        "tolerance_position": 0.001,
        "tolerance_orientation": 0.01
    }
    
    try:
        # Extract the transformation data
        start_world_from_bar, goal_world_from_bar, left_bar_from_tool0, right_bar_from_tool0 = extract_dual_arm_transformations(grasp_targets)
        
        # These variables are now available for use in the dual arm planning script
        print("Successfully extracted dual arm transformation data!")
        print("Variables available:")
        print("- start_world_from_bar")
        print("- goal_world_from_bar") 
        print("- left_bar_from_tool0")
        print("- right_bar_from_tool0")
        
    except Exception as e:
        print(f"Error extracting dual arm transformations: {str(e)}")
        print("Please check your GraspTarget tree structure:")
        print("- Should have 2 branches (start/end)")
        print("- Each branch should have 2 items (left/right arm)")
        print("- Each GraspTarget should have: world_from_bar, bar_from_male_joint, male_joint_from_tool0")
        raise e
# ---------- end python_3_script_39 ----------
python_3_script_40 = Python3Script(grasp_targets=stream_filter_5)  # -> out, left_targets, right_targets; inputs grasp_targets: tree
# ---------- python_3_script_40: Python ----------
# Validate tree structure
if grasp_targets.BranchCount < 3:
    raise ValueError(f"Expected at least 2 branches (start/end), got {grasp_target_tree.BranchCount}")

start_branch = grasp_targets.Branch(1)
if len(start_branch) < 2:
    raise ValueError(f"Expected at least 2 items in start branch (left/right), got {len(start_branch)}")

start_left_target = start_branch[0]  # Left arm start
start_right_target = start_branch[1]  # Right arm start

goal_branch = grasp_targets.Branch(2)
if len(goal_branch) < 2:
    raise ValueError(f"Expected at least 2 items in goal branch (left/right), got {len(goal_branch)}")

goal_left_target = goal_branch[0]  # Left arm goal
goal_right_target = goal_branch[1]  # Right arm goal

left_targets = [start_left_target, goal_left_target]
right_targets = [start_right_target, goal_right_target]
# ---------- end python_3_script_40 ----------
python_3_script_41 = Python3Script(grasp_targets=stream_filter_5)  # -> out, left_planes, right_planes; inputs grasp_targets: tree
# ---------- python_3_script_41: Python ----------
from compas_rhino.conversions import frame_to_rhino_plane
from compas.geometry import Transformation, Frame

left_planes = [frame_to_rhino_plane(Frame.from_transformation(grasp_targets.Branch(i)[0].world_from_tool0)) for i in range(3)]
right_planes = [frame_to_rhino_plane(Frame.from_transformation(grasp_targets.Branch(i)[1].world_from_tool0)) for i in range(3)]
# ---------- end python_3_script_41 ----------
# TODO: double check the transformation between two EE and see
# if they are consistent across the traj.
python_3_script_42 = Python3Script(
    trigger=compute_approach_traj,
    planner=python_3_script_27.planner,
    start_state=stream_filter_6,
    groups=merge_19,
    start_world_from_bar=python_3_script_39.start_world_from_bar,
    goal_world_from_bar=python_3_script_39.goal_world_from_bar,
    bar_from_left_tool0=python_3_script_39.left_bar_from_tool0,
    bar_from_right_tool0=python_3_script_39.right_bar_from_tool0,
    check_collision=check_collisions,
    tolerance_position="0.0001",
    tolerance_orientation="0.0001",
    max_descend_iterations="30")  # -> out, new_trajectory, bar_planes, left_arm_planes, right_arm_planes; inputs groups: list, tolerance_position: Double, tolerance_orientation: Double, max_descend_iterations: Int32
# ---------- python_3_script_42: Python ----------
from copy import deepcopy
from math import ceil
from math import pi

from compas.geometry import Frame
from compas.geometry import Point
from compas.geometry import Quaternion
from compas.geometry import Transformation
from compas.geometry import Vector
from compas.geometry import axis_angle_from_quaternion
from compas.geometry import cross_vectors
from compas.geometry import is_parallel_vector_vector
from compas.geometry import angle_vectors
from compas_robots import Configuration

from compas_fab.backends import PyBulletClient
from compas_fab.backends import PyBulletPlanner
from compas_fab.backends import CollisionCheckError
from compas_fab.backends import InverseKinematicsError
from compas_fab.backends import MPInterpolationInCollisionError
from compas_fab.backends import MPMaxJumpError
from compas_fab.backends import MPNoIKSolutionError
from compas_fab.backends import MPNoPlanFoundError
from compas_fab.backends import MPStartStateInCollisionError
from compas_fab.backends import MPTargetInCollisionError
from compas_fab.backends.interfaces import PlanCartesianMotion
from compas_fab.robots import FrameTarget
from compas_fab.robots import FrameWaypoints
from compas_fab.robots import JointTrajectory
from compas_fab.robots import JointTrajectoryPoint
from compas_fab.robots import PointAxisTarget
from compas_fab.robots import PointAxisWaypoints
from compas_fab.robots import RobotCell
from compas_fab.robots import RobotCellState
from compas_fab.robots import TargetMode
from compas_fab.robots import Waypoints
from compas_fab.robots import Duration

from compas_fab.backends.pybullet.backend_features.helpers import check_max_jump
from compas_fab.backends.pybullet.backend_features.pybullet_plan_cartesian_motion import FrameInterpolator

from compas_rhino.conversions import frame_to_rhino_plane


def pose_from_frame(frame, scale=1.0):
    return ([v*scale for v in frame.point], frame.quaternion.xyzw)

def frame_from_pose(pose, scale=1.0):
    point, (x, y, z, w) = pose
    return Frame.from_quaternion([w, x, y, z], point=[v*scale for v in point])

import pybullet_planning as pp

def plan_dual_arm_cartesian_motion(planner, start_state, options, 
                                    start_world_from_bar, goal_world_from_bar, 
                                    bar_from_left_tool0, bar_from_right_tool0,
                                    groups):
    """
    Plan synchronized dual arm Cartesian motion.
    
    Parameters:
    -----------
    planner : PyBulletPlanner
        The planner instance
    start_state : RobotCellState
        The starting state of the robot
    options : dict
        Planning options
    start_world_from_bar : Frame
        Starting pose of the bar in world coordinates
    goal_world_from_bar : Frame
        Goal pose of the bar in world coordinates
    bar_from_left_tool0 : Transformation
        Transformation from bar frame to left arm tool0 frame
    bar_from_right_tool0 : Transformation
        Transformation from bar frame to right arm tool0 frame
    groups : list
        List containing two planning group names: [base_left_arm_manipulator, base_right_arm_manipulator]
        
    Returns:
    --------
    dict : Dictionary containing waypoints and trajectories for both arms
    """
    
    robot_cell: RobotCell = planner.client.robot_cell
    
    # Extract left and right arm group names from the groups list
    left_arm_group = groups[0]  # base_left_arm_manipulator
    right_arm_group = groups[1]  # base_right_arm_manipulator

    # Setting robot cell state
    planner.set_robot_cell_state(start_state)

    # Check start state input for collision if requested, it will throw an exception if the robot is in collision
    if options.get("check_collision"):
        # This allows options such as `full_report` and `verbose` to pass through to the check_collision method
        options.update({"_skip_set_robot_cell_state": True})

        # Check if the start state is in collision
        try:
            # Note: This is using the CheckCollision Backend Feature
            planner.check_collision(start_state, options)
        except CollisionCheckError as e:
            message = (
                "plan_dual_arm_cartesian_motion: The start_state for plan_cartesian_motion is in collision. \n  - "
                + e.message
            )
            raise MPStartStateInCollisionError(message, start_state=start_state, collision_pairs=e.collision_pairs)

    ## Checking the attached tool and workpiece for collision at every target
    # if options.get("check_collision") and not options.get("skip_preplanning_collision_check"):
    #     intermediate_state = deepcopy(start_state)
    #     intermediate_state.robot_configuration = None
    #     # Convert the targets to PCFs for collision checking
    #     pcf_frames = client.robot_cell.target_frames_to_pcf(
    #         start_state, waypoints.target_frames, waypoints.target_mode, group
    #     )

    #     for pcf_frame in pcf_frames:
    #         try:
    #             planner.check_collision_for_attached_objects_in_planning_group(
    #                 intermediate_state,
    #                 group,
    #                 pcf_frame,
    #                 options,
    #             )
    #         except CollisionCheckError as e:
    #             message = (
    #                 "plan_cartesian_motion_frame_waypoints: The target frame for plan_cartesian_motion is in collision. \n  - "
    #                 + e.message
    #             )
    #             raise MPTargetInCollisionError(message, target=pcf_frame, collision_pairs=e.collision_pairs)

    # Options for Inverse Kinematics
    ik_options = deepcopy(options)
    # NOTE: PyBullet IK is gradient based and will snap to the nearest configuration of the start state
    # NOTE: We are running this IK solver without random search (by setting max_results = 1) to ensure determinism
    #       In this mode, planner.inverse_kinematics() will raise an InverseKinematicsError if no IK solution is found,
    #       or CollisionCheckError if the configuration is found but in collision. We will handle these errors below.
    ik_options["max_results"] = 1
    # NOTE: # We only need the joint values for the group to construct the JointTrajectoryPoint
    ik_options["return_full_configuration"] = False
    # NOTE: The PyBullet IK function is responsible for performing collision checking for this planning function
    # The ["check_collision"] in options is passed also to the ik_options

    # Echo target_mode
    if options["verbose"]:
        print("Target Mode is: {}. Interpolation will happen with this reference".format("TOOL"))

    # target = GraspTarget(
    #     "male_joint",
    #     world_from_bar=tf_world_from_bar,
    #     bar_from_male_joint=tf_bar_from_male_joint,
    #     male_joint_from_tool0=male_joint_from_tool0,
    #     world_from_tool0=tf_world_from_male_joint * male_joint_from_tool0
    # )
    # !* I should use start and goal world_from_bar pose and the bar_from_bar_from_male_joint, and male_joint_from_tool0 to create the target waypoints

    # Create synchronized dual arm waypoint constructs
    # The key insight: interpolate the bar motion first, then derive arm targets
    # This ensures both arms maintain fixed relative transformation throughout the trajectory

    # Assuming we have:
    # - start_world_from_bar: Frame representing the starting pose of the bar in world coordinates
    # - goal_world_from_bar: Frame representing the goal pose of the bar in world coordinates  
    # - bar_from_left_tool0: Transformation from bar frame to left arm tool0 frame
    # - bar_from_right_tool0: Transformation from bar frame to right arm tool0 frame

    # Step 1: Convert transformations to frames for interpolation
    # FrameInterpolator requires Frame objects, not Transformation objects
    start_world_from_bar_frame = Frame.from_transformation(start_world_from_bar)
    goal_world_from_bar_frame = Frame.from_transformation(goal_world_from_bar)
    
    # Create bar interpolation object for consistent motion
    # bar_interpolator = FrameInterpolator(start_world_from_bar_frame, goal_world_from_bar_frame, options)

    # # Step 2: Generate interpolated bar waypoints
    # # Calculate number of waypoints based on distance and angle, similar to original implementation
    # num_bar_waypoints = max(2, bar_interpolator.regular_interpolation_steps + 1)
    # bar_waypoints = []
    # for i in range(num_bar_waypoints):
    #     t = i / (num_bar_waypoints - 1) if num_bar_waypoints > 1 else 0
    #     print(f't: {t}')
    #     interpolated_bar_frame = bar_interpolator.get_interpolated_frame(t)
    #     bar_waypoints.append(interpolated_bar_frame)
    
    import pybullet_planning as pp
    import numpy as np
    bar_poses = pp.interpolate_poses(pose_from_frame(start_world_from_bar_frame), pose_from_frame(goal_world_from_bar_frame), 
        pos_step_size=0.01, ori_step_size=np.pi/90)
    bar_waypoints = [frame_from_pose(bp) for bp in bar_poses]

    # Step 3: For each bar waypoint, compute corresponding arm targets
    left_arm_frames = []
    right_arm_frames = []

    for bar_frame in bar_waypoints:
        world_from_bar_frame = Transformation.from_frame(bar_frame)

        # Left arm target: apply bar_from_left_tool0 transformation to bar_frame
        # Use the transformed() method to apply the transformation
        left_arm_tf = world_from_bar_frame * bar_from_left_tool0
        left_arm_frames.append(Frame.from_transformation(left_arm_tf))
        
        # Right arm target: apply bar_from_right_tool0 transformation to bar_frame
        # Use the transformed() method to apply the transformation
        right_arm_tf = world_from_bar_frame * bar_from_right_tool0
        right_arm_frames.append(Frame.from_transformation(right_arm_tf))

    # Step 4: Create synchronized waypoint objects
    left_arm_waypoints = FrameWaypoints(
        target_frames=left_arm_frames,
        target_mode=TargetMode.ROBOT,
        name="Left Arm Synchronized Waypoints",
        tolerance_position=options.get("tolerance_position", 0.001),
        tolerance_orientation=options.get("tolerance_orientation", 0.01)
    )

    right_arm_waypoints = FrameWaypoints(
        target_frames=right_arm_frames,
        target_mode=TargetMode.ROBOT,
        name="Right Arm Synchronized Waypoints",
        tolerance_position=options.get("tolerance_position", 0.001),
        tolerance_orientation=options.get("tolerance_orientation", 0.01)
    )

    # Store both waypoint sets for later use
    dual_arm_waypoints = {
        "left_arm": left_arm_waypoints,
        "right_arm": right_arm_waypoints
    }

    # Store bar waypoints for reference
    bar_waypoints_obj = FrameWaypoints(
        target_frames=bar_waypoints,
        target_mode=TargetMode.WORKPIECE,  # Bar is the workpiece
        name="Bar Waypoints"
    )
    
    # Create visualization objects for debugging - bar frames and left/right arm tool0 frames
    # if options.get("verbose", False):
    if True:
        print("Creating visualization objects for bar frames and left/right arm tool0 frames...")
        
        # Convert bar frames to Rhino planes
        bar_planes = []
        for frame in bar_waypoints:
            plane = frame_to_rhino_plane(frame)
            bar_planes.append(plane)
        
        # Convert left arm frames to Rhino planes
        left_arm_planes = []
        for frame in left_arm_frames:
            plane = frame_to_rhino_plane(frame)
            left_arm_planes.append(plane)
        
        # Convert right arm frames to Rhino planes
        right_arm_planes = []
        for frame in right_arm_frames:
            plane = frame_to_rhino_plane(frame)
            right_arm_planes.append(plane)
        
        visualization_objects = {
            "bar_planes": bar_planes,
            "left_arm_planes": left_arm_planes,
            "right_arm_planes": right_arm_planes
        }
        
        print(f"Created visualization objects:")
        print(f"  Bar planes: {len(bar_planes)}")
        print(f"  Left arm planes: {len(left_arm_planes)}")
        print(f"  Right arm planes: {len(right_arm_planes)}")
    
    # Store visualization objects in the result for output
    dual_arm_waypoints["visualization"] = visualization_objects

    # DUAL ARM SYNCHRONIZED INTERPOLATION
    # Instead of interpolating between arm waypoints, we use the pre-computed synchronized waypoints
    # This ensures both arms maintain fixed relative transformation throughout the trajectory

    # Get the synchronized waypoints for both arms
    left_arm_waypoints = dual_arm_waypoints["left_arm"]
    right_arm_waypoints = dual_arm_waypoints["right_arm"]

    # Verify we have the same number of waypoints for both arms
    assert len(left_arm_waypoints.target_frames) == len(right_arm_waypoints.target_frames), \
        "Left and right arm waypoints must have the same number of frames for synchronization"

    num_synchronized_waypoints = len(left_arm_waypoints.target_frames)

    if options["verbose"]:
        print(f"Using {num_synchronized_waypoints} synchronized waypoints for dual arm motion")
        print(f"Bar start frame: {start_world_from_bar}")
        print(f"Bar goal frame: {goal_world_from_bar}")

    # Initialize trajectories for both arms using input group names
    left_arm_trajectory = JointTrajectory(
        joint_names=robot_cell.get_configurable_joint_names(left_arm_group), 
        start_configuration=start_state.robot_configuration
    )
    right_arm_trajectory = JointTrajectory(
        joint_names=robot_cell.get_configurable_joint_names(right_arm_group), 
        start_configuration=start_state.robot_configuration
    )

    # Add start configurations
    left_joint_names = robot_cell.get_configurable_joint_names(left_arm_group)
    left_joint_types = robot_cell.get_configurable_joint_types(left_arm_group)
    right_joint_names = robot_cell.get_configurable_joint_names(right_arm_group) 
    right_joint_types = robot_cell.get_configurable_joint_types(right_arm_group)

    # Get start joint values for each arm
    left_start_joints = [start_state.robot_configuration[name] for name in left_joint_names]
    right_start_joints = [start_state.robot_configuration[name] for name in right_joint_names]

    left_arm_trajectory.points.append(
        JointTrajectoryPoint(joint_values=left_start_joints, joint_types=left_joint_types, joint_names=left_joint_names)
    )
    right_arm_trajectory.points.append(
        JointTrajectoryPoint(joint_values=right_start_joints, joint_types=right_joint_types, joint_names=right_joint_names)
    )

    # Process each synchronized waypoint
    for i in range(num_synchronized_waypoints):
        if options["verbose"]:
            print(f"Processing synchronized waypoint {i+1}/{num_synchronized_waypoints}")
        
        # Get the current synchronized frames for both arms
        left_target_frame = left_arm_waypoints.target_frames[i]
        right_target_frame = right_arm_waypoints.target_frames[i]
        
        # Create targets for both arms
        left_target = FrameTarget(
            left_target_frame,
            target_mode=TargetMode.ROBOT,
            tolerance_position=left_arm_waypoints.tolerance_position or 0.001,
            tolerance_orientation=left_arm_waypoints.tolerance_orientation or 0.01
        )
        
        right_target = FrameTarget(
            right_target_frame,
            target_mode=TargetMode.ROBOT,
            tolerance_position=right_arm_waypoints.tolerance_position or 0.001,
            tolerance_orientation=right_arm_waypoints.tolerance_orientation or 0.01
        )
        # print(ik_options)
    
        # Solve IK for both arms simultaneously with error handling for debugging
        try:
            # Solve IK for left arm
            # TODO this might cause collision if the start right arm state is not good
            # can ignore this collision for this check?
            # pp.draw_pose(pose_from_frame(left_target.target_frame))

            left_configuration = planner.inverse_kinematics(
                left_target, start_state, left_arm_group, ik_options
            )
            # print('left', left_configuration)
            
            # Solve IK for right arm  
            right_configuration = planner.inverse_kinematics(
                right_target, start_state, right_arm_group, ik_options
            )
            # print('right', right_configuration)
            
            # Extract joint values
            left_joint_values = [left_configuration[name] for name in left_joint_names]
            right_joint_values = [right_configuration[name] for name in right_joint_names]
            
            if options["verbose"]:
                print(f"Segment {i+1}, Left arm joint_values: {left_joint_values}")
                print(f"Segment {i+1}, Right arm joint_values: {right_joint_values}")
            
        # Catch errors and return None trajectories for debugging instead of raising
        except InverseKinematicsError as e:
            message = f"plan_dual_arm_cartesian_motion(): Segment {i+1}, Inverse Kinematics failed for dual arm motion.\n"
            message = message + e.message
            print(f"WARNING: {message}")
            print("Returning None trajectories for debugging - check frame visualization")
            
            # Return None trajectories with visualization data for debugging
            dual_arm_waypoints["left_arm_trajectory"] = None
            dual_arm_waypoints["right_arm_trajectory"] = None
            dual_arm_waypoints["error_message"] = message
            dual_arm_waypoints["error_segment"] = i + 1
            return dual_arm_waypoints

        except CollisionCheckError as e:
            message = f"plan_dual_arm_cartesian_motion(): Segment {i+1}, Collision detected for dual arm motion.\n"
            message = message + e.message
            print(f"WARNING: {message}")
            print("Returning None trajectories for debugging - check frame visualization")
            
            # Return None trajectories with visualization data for debugging
            dual_arm_waypoints["left_arm_trajectory"] = None
            dual_arm_waypoints["right_arm_trajectory"] = None
            dual_arm_waypoints["error_message"] = message
            dual_arm_waypoints["error_segment"] = i + 1
            return dual_arm_waypoints
        
        # Check joint jumps between the current and previous point's configuration for both arms
        if i > 0:  # Skip for first waypoint
            try:
                # Check left arm joint jump
                check_max_jump(
                    left_joint_names, left_joint_types, 
                    left_arm_trajectory.points[-1].joint_values, left_joint_values, options
                )
                
                # Check right arm joint jump
                check_max_jump(
                    right_joint_names, right_joint_types, 
                    right_arm_trajectory.points[-1].joint_values, right_joint_values, options
                )
                
            except MPMaxJumpError as e:
                # For dual arm, we can't easily subdivide like single arm, so we return None trajectories for debugging
                message = f"plan_dual_arm_cartesian_motion(): Segment {i+1}, Joint jump too large for dual arm motion.\n"
                message += f"Left arm jump: {e.message}\n"
                message += "Cannot subdivide dual arm motion - consider reducing step size or adjusting trajectory."
                print(f"WARNING: {message}")
                print("Returning None trajectories for debugging - check frame visualization")
                
                # Return None trajectories with visualization data for debugging
                dual_arm_waypoints["left_arm_trajectory"] = None
                dual_arm_waypoints["right_arm_trajectory"] = None
                dual_arm_waypoints["error_message"] = message
                dual_arm_waypoints["error_segment"] = i + 1
                return dual_arm_waypoints
        
        # This point is successful, add the JointTrajectoryPoint to both trajectories
        left_arm_trajectory.points.append(
            JointTrajectoryPoint(
                joint_values=left_joint_values, 
                joint_types=left_joint_types, 
                joint_names=left_joint_names,
                time_from_start=Duration(secs=i * 0.5, nsecs=0)
            )
        )
        
        right_arm_trajectory.points.append(
            JointTrajectoryPoint(
                joint_values=right_joint_values, 
                joint_types=right_joint_types, 
                joint_names=right_joint_names,
                time_from_start=Duration(secs=i * 0.5, nsecs=0)
            )
        )
        
        if options["verbose"]:
            print(f"Segment {i+1} of {num_synchronized_waypoints} completed - JointTrajectoryPoint added for both arms")

    # Store both trajectories in the dual_arm_waypoints for return
    dual_arm_waypoints["left_arm_trajectory"] = left_arm_trajectory
    dual_arm_waypoints["right_arm_trajectory"] = right_arm_trajectory

    if options["verbose"]:
        print(f"Dual arm synchronized motion planning completed:")
        print(f"  Left arm: {len(left_arm_trajectory.points)} trajectory points")
        print(f"  Right arm: {len(right_arm_trajectory.points)} trajectory points")

    # Merge both arm trajectories into one combined trajectory
    if left_arm_trajectory is not None and right_arm_trajectory is not None:
        print("Merging left and right arm trajectories into combined trajectory...")
        
        # Start with left arm trajectory as base
        new_trajectory = left_arm_trajectory.copy()
        
        # Get joint names for the right arm group
        group_joint_names = planner.client.robot_cell.get_configurable_joint_names(groups[1])
        print(group_joint_names)
        
        new_robot_cell_state = start_state.copy()
        # Merge each point from right arm trajectory
        for i, point in enumerate(right_arm_trajectory.points):
            new_trajectory.points[i] = JointTrajectoryPoint(
                joint_values=new_robot_cell_state.robot_configuration.joint_values, 
                joint_types=new_robot_cell_state.robot_configuration.joint_types, 
                joint_names=new_robot_cell_state.robot_configuration.joint_names,
                time_from_start=Duration(secs=i * 0.5, nsecs=0)
            )
            new_trajectory.points[i].merge(left_arm_trajectory.points[i])
            new_trajectory.points[i].merge(point)
        
        # Store the merged trajectory
        dual_arm_waypoints["combined_trajectory"] = new_trajectory
        
        if options["verbose"]:
            print(f"  Combined trajectory: {len(new_trajectory.points)} trajectory points")
            print(f"  Joint names: {new_trajectory.joint_names}")

    # Return the dual arm waypoints object containing both trajectories
    return dual_arm_waypoints

options = {
    "verbose": False,
    "check_collision": check_collision,
    "tolerance_position": tolerance_position,
    "tolerance_orientation": tolerance_orientation,
    "max_step_distance": 0.01,  # meters
    "max_step_angle": 0.1,  # radians
    "max_jump_prismatic": 0.1,
    "max_jump_revolute": pi / 2
}

# Call the function with the input parameters
# Note: These variables should be provided as inputs to the script from Grasshopper
# The following variables are expected to be defined in the Grasshopper environment:
# - planner: PyBulletPlanner instance
# - start_state: RobotCellState instance
# - start_world_from_bar: Transformation (starting bar pose in world coordinates)
# - goal_world_from_bar: Transformation (goal bar pose in world coordinates)
# - bar_from_left_tool0: Transformation (left arm tool0 offset from bar)
# - bar_from_right_tool0: Transformation (right arm tool0 offset from bar)
# - groups: list containing two planning group names [base_left_arm_manipulator, base_right_arm_manipulator]
if trigger:
    result = plan_dual_arm_cartesian_motion(
        planner, start_state, options,
        start_world_from_bar, goal_world_from_bar,
        bar_from_left_tool0, bar_from_right_tool0,
        groups
    )
    if 'combined_trajectory' in  result:
        new_trajectory = result["combined_trajectory"]

    # Extract visualization objects for debugging in Rhino
    if "visualization" in result:
        visualization = result["visualization"]
        
        # These variables are now available for visualization in Grasshopper:
        # - bar_planes: List of Rhino Plane objects for bar waypoint frames
        # - left_arm_planes: List of Rhino Plane objects for left arm tool0 frames
        # - right_arm_planes: List of Rhino Plane objects for right arm tool0 frames
        
        bar_planes = visualization["bar_planes"]
        left_arm_planes = visualization["left_arm_planes"]
        right_arm_planes = visualization["right_arm_planes"]
        
        print("Visualization objects created and available for debugging:")
        print(f"  bar_planes: {len(bar_planes)} planes")
        print(f"  left_arm_planes: {len(left_arm_planes)} planes")
        print(f"  right_arm_planes: {len(right_arm_planes)} planes")
        
        # Check if trajectories are None (due to errors)
        if result.get("left_arm_trajectory") is None or result.get("right_arm_trajectory") is None:
            print("\n⚠️  WARNING: Trajectories are None due to planning errors!")
            if "error_message" in result:
                print(f"Error: {result['error_message']}")
            if "error_segment" in result:
                print(f"Failed at segment: {result['error_segment']}")
            print("Use the visualization objects to debug the frame positions and orientations.")
        else:
            print(f"\n✓ Successfully created trajectories:")
            print(f"  Left arm: {len(result['left_arm_trajectory'].points)} trajectory points")
            print(f"  Right arm: {len(result['right_arm_trajectory'].points)} trajectory points")
            
            # Show combined trajectory info if available
            if "combined_trajectory" in result:
                combined_traj = result["combined_trajectory"]
                print(f"  Combined: {len(combined_traj.points)} trajectory points")
                print(f"  Combined joint names: {combined_traj.joint_names}")
                
                # Verify dual arm synchronization
                print("\n" + "="*60)
                print("DUAL ARM SYNCHRONIZATION VERIFICATION")
                print("="*60)
                
                def verify_dual_arm_synchronization(planner, combined_trajectory, groups, bar_from_left_tool0, bar_from_right_tool0, tolerance=0.001):
                    """
                    Verify that the transformation between the two robot arms' tool0 frames is consistent
                    across all trajectory points using forward kinematics.
                    """
                    robot_cell = planner.client.robot_cell
                    left_arm_group = groups[0]
                    right_arm_group = groups[1]
                    
                    # Get joint names for each arm
                    left_joint_names = robot_cell.get_configurable_joint_names(left_arm_group)
                    right_joint_names = robot_cell.get_configurable_joint_names(right_arm_group)
                    
                    # Expected transformation between arms (left_tool0_from_right_tool0)
                    # This should be: bar_from_left_tool0.inverse() * bar_from_right_tool0
                    expected_left_tool0_from_right_tool0 = bar_from_left_tool0.inverse() * bar_from_right_tool0
                    
                    verification_results = {
                        "success": True,
                        "max_position_error": 0.0,
                        "max_orientation_error": 0.0,
                        "failed_points": [],
                        "details": []
                    }
                    
                    print("Verifying dual arm synchronization across trajectory points...")
                    
                    for i, point in enumerate(combined_trajectory.points):
                        # Extract joint values for each arm from the combined trajectory point
                        left_joint_values = [point[joint_name] for joint_name in left_joint_names]
                        right_joint_values = [point[joint_name] for joint_name in right_joint_names]
                        
                        # Create temporary robot cell states for forward kinematics
                        temp_state = start_state.copy()
                        temp_state.robot_configuration = combined_trajectory.start_configuration.copy()
                        
                        # Set joint values for each arm
                        for j, joint_name in enumerate(left_joint_names):
                            temp_state.robot_configuration[joint_name] = left_joint_values[j]
                        for j, joint_name in enumerate(right_joint_names):
                            temp_state.robot_configuration[joint_name] = right_joint_values[j]
                        
                        # Set robot state and get forward kinematics
                        planner.set_robot_cell_state(temp_state)
                        
                        # Get forward kinematics for both arms' tool0 frames
                        left_tool0_frame = planner.forward_kinematics(temp_state, TargetMode.ROBOT, group=left_arm_group)
                        right_tool0_frame = planner.forward_kinematics(temp_state, TargetMode.ROBOT, group=right_arm_group)
                        
                        # Calculate actual transformation between arms
                        world_from_left_tool0 = Transformation.from_frame(left_tool0_frame)
                        world_from_right_tool0 = Transformation.from_frame(right_tool0_frame)
                        left_tool0_from_right_tool0 = world_from_left_tool0.inverse() * world_from_right_tool0
                        # left_tool0_from_right_tool0 = Transformation.from_frame_to_frame(right_tool0_frame, left_tool0_frame)
                        
                        # Compare with expected transformation
                        position_error = (left_tool0_from_right_tool0.translation_vector - expected_left_tool0_from_right_tool0.translation_vector).length
                        
                        # Calculate orientation error by comparing axis vectors
                        # Convert transformations to frames to get axis vectors directly
                        actual_frame = Frame.from_transformation(left_tool0_from_right_tool0)
                        expected_frame = Frame.from_transformation(expected_left_tool0_from_right_tool0)
                        
                        # Get axis vectors directly from frames
                        actual_x_axis = actual_frame.xaxis
                        actual_y_axis = actual_frame.yaxis
                        actual_z_axis = actual_frame.zaxis
                        
                        expected_x_axis = expected_frame.xaxis
                        expected_y_axis = expected_frame.yaxis
                        expected_z_axis = expected_frame.zaxis
                        
                        # Calculate angles between corresponding axis vectors
                        x_axis_error = angle_vectors(actual_x_axis, expected_x_axis)
                        y_axis_error = angle_vectors(actual_y_axis, expected_y_axis)
                        z_axis_error = angle_vectors(actual_z_axis, expected_z_axis)
                        
                        # Use the maximum axis error as the overall orientation error
                        orientation_error = max(x_axis_error, y_axis_error, z_axis_error)
                        
                        # Update max errors
                        verification_results["max_position_error"] = max(verification_results["max_position_error"], position_error)
                        verification_results["max_orientation_error"] = max(verification_results["max_orientation_error"], orientation_error)
                        
                        # Check if this point fails verification
                        if position_error > tolerance or orientation_error > tolerance:
                            print(f'pt#{i} - pos error {position_error}, ori error {orientation_error}')
                            verification_results["success"] = False
                            verification_results["failed_points"].append(i)
                            verification_results["details"].append({
                                "point": i,
                                "position_error": position_error,
                                "orientation_error": orientation_error,
                                "left_tool0_frame": left_tool0_frame,
                                "right_tool0_frame": right_tool0_frame
                            })
                    
                    # Print verification results
                    if verification_results["success"]:
                        print(f"✓ Dual arm synchronization verification PASSED")
                        print(f"  Max position error: {verification_results['max_position_error']:.6f} m")
                        print(f"  Max orientation error: {verification_results['max_orientation_error']:.6f} rad")
                    else:
                        print(f"✗ Dual arm synchronization verification FAILED")
                        print(f"  Failed points: {len(verification_results['failed_points'])}/{len(combined_trajectory.points)}")
                        print(f"  Max position error: {verification_results['max_position_error']:.6f} m")
                        print(f"  Max orientation error: {verification_results['max_orientation_error']:.6f} rad")
                        print(f"  Failed at points: {verification_results['failed_points']}")
                    
                    return verification_results
                
                # Run the verification
                verification_result = verify_dual_arm_synchronization(
                    planner, combined_traj, groups, bar_from_left_tool0, bar_from_right_tool0, tolerance=0.001
                )
                
                # Store verification results in the result dictionary
                result["verification"] = verification_result
# ---------- end python_3_script_42 ----------
data_26 = Data(python_3_script_42.new_trajectory)
python_3_script_43 = Python3Script(robot_cell_state=stream_filter_6, trajectory=python_3_script_42.new_trajectory)  # -> out, intermediate_robot_cell_state
# ---------- python_3_script_43: Python ----------
import math
intermediate_robot_cell_state = robot_cell_state.copy()  # type: RobotCellState
intermediate_robot_cell_state.robot_configuration.merge(trajectory.points[-1])
# planner.set_robot_cell_state(intermediate_robot_cell_state)
# ---------- end python_3_script_43 ----------
plane_21 = Plane(python_3_script_42.left_arm_planes)
plane_22 = Plane(python_3_script_42.right_arm_planes)
python_3_script_44 = Python3Script(
    trigger=compute_approach_traj,
    planner=python_3_script_27.planner,
    start_state=python_3_script_43.intermediate_robot_cell_state,
    groups=merge_19,
    left_targets=python_3_script_40.left_targets,
    right_targets=python_3_script_40.right_targets,
    check_collision=check_collisions,
    tolerance_position="0.0001",
    tolerance_orientation="0.0001",
    max_descend_iterations="30")  # -> out, new_trajectory, left_arm_planes, right_arm_planes; inputs groups: list, left_targets: list, right_targets: list, tolerance_position: Double, tolerance_orientation: Double, max_descend_iterations: Int32
# ---------- python_3_script_44: Python ----------
from copy import deepcopy
from math import ceil
from math import pi

from compas.geometry import Frame
from compas.geometry import Point
from compas.geometry import Quaternion
from compas.geometry import Transformation
from compas.geometry import Vector
from compas.geometry import axis_angle_from_quaternion
from compas.geometry import cross_vectors
from compas.geometry import is_parallel_vector_vector
from compas.geometry import angle_vectors
from compas_robots import Configuration

from compas_fab.backends import PyBulletClient
from compas_fab.backends import PyBulletPlanner
from compas_fab.backends import CollisionCheckError
from compas_fab.backends import InverseKinematicsError
from compas_fab.backends import MPInterpolationInCollisionError
from compas_fab.backends import MPMaxJumpError
from compas_fab.backends import MPNoIKSolutionError
from compas_fab.backends import MPNoPlanFoundError
from compas_fab.backends import MPStartStateInCollisionError
from compas_fab.backends import MPTargetInCollisionError
from compas_fab.backends.interfaces import PlanCartesianMotion
from compas_fab.robots import FrameTarget
from compas_fab.robots import FrameWaypoints
from compas_fab.robots import JointTrajectory
from compas_fab.robots import JointTrajectoryPoint
from compas_fab.robots import PointAxisTarget
from compas_fab.robots import PointAxisWaypoints
from compas_fab.robots import RobotCell
from compas_fab.robots import RobotCellState
from compas_fab.robots import TargetMode
from compas_fab.robots import Waypoints
from compas_fab.robots import Duration

from compas_fab.backends.pybullet.backend_features.helpers import check_max_jump
from compas_fab.backends.pybullet.backend_features.pybullet_plan_cartesian_motion import FrameInterpolator

from compas_rhino.conversions import frame_to_rhino_plane


def pose_from_frame(frame, scale=1.0):
    return ([v*scale for v in frame.point], frame.quaternion.xyzw)

def frame_from_pose(pose, scale=1.0):
    point, (x, y, z, w) = pose
    return Frame.from_quaternion([w, x, y, z], point=[v*scale for v in point])

import pybullet_planning as pp

def plan_dual_arm_cartesian_motion(planner, start_state, options, 
                                    start_world_from_left_tool0, goal_world_from_left_tool0,
                                    start_world_from_right_tool0, goal_world_from_right_tool0,
                                    groups):
    """
    Plan synchronized dual arm Cartesian motion.
    
    Parameters:
    -----------
    planner : PyBulletPlanner
        The planner instance
    start_state : RobotCellState
        The starting state of the robot
    options : dict
        Planning options
    start_world_from_left_tool0 : Transformation
        Starting pose of the left arm tool0 in world coordinates
    goal_world_from_left_tool0 : Transformation
        Goal pose of the left arm tool0 in world coordinates
    start_world_from_right_tool0 : Transformation
        Starting pose of the right arm tool0 in world coordinates
    goal_world_from_right_tool0 : Transformation
        Goal pose of the right arm tool0 in world coordinates
    groups : list
        List containing two planning group names: [base_left_arm_manipulator, base_right_arm_manipulator]
        
    Returns:
    --------
    dict : Dictionary containing waypoints and trajectories for both arms
    """
    
    robot_cell: RobotCell = planner.client.robot_cell
    
    # Extract left and right arm group names from the groups list
    left_arm_group = groups[0]  # base_left_arm_manipulator
    right_arm_group = groups[1]  # base_right_arm_manipulator

    # Setting robot cell state
    planner.set_robot_cell_state(start_state)

    # Check start state input for collision if requested, it will throw an exception if the robot is in collision
    if options.get("check_collision"):
        # This allows options such as `full_report` and `verbose` to pass through to the check_collision method
        options.update({"_skip_set_robot_cell_state": True})

        # Check if the start state is in collision
        try:
            # Note: This is using the CheckCollision Backend Feature
            planner.check_collision(start_state, options)
        except CollisionCheckError as e:
            message = (
                "plan_dual_arm_cartesian_motion: The start_state for plan_cartesian_motion is in collision. \n  - "
                + e.message
            )
            raise MPStartStateInCollisionError(message, start_state=start_state, collision_pairs=e.collision_pairs)

    ## Checking the attached tool and workpiece for collision at every target
    # if options.get("check_collision") and not options.get("skip_preplanning_collision_check"):
    #     intermediate_state = deepcopy(start_state)
    #     intermediate_state.robot_configuration = None
    #     # Convert the targets to PCFs for collision checking
    #     pcf_frames = client.robot_cell.target_frames_to_pcf(
    #         start_state, waypoints.target_frames, waypoints.target_mode, group
    #     )

    #     for pcf_frame in pcf_frames:
    #         try:
    #             planner.check_collision_for_attached_objects_in_planning_group(
    #                 intermediate_state,
    #                 group,
    #                 pcf_frame,
    #                 options,
    #             )
    #         except CollisionCheckError as e:
    #             message = (
    #                 "plan_cartesian_motion_frame_waypoints: The target frame for plan_cartesian_motion is in collision. \n  - "
    #                 + e.message
    #             )
    #             raise MPTargetInCollisionError(message, target=pcf_frame, collision_pairs=e.collision_pairs)

    # Options for Inverse Kinematics
    ik_options = deepcopy(options)
    # NOTE: PyBullet IK is gradient based and will snap to the nearest configuration of the start state
    # NOTE: We are running this IK solver without random search (by setting max_results = 1) to ensure determinism
    #       In this mode, planner.inverse_kinematics() will raise an InverseKinematicsError if no IK solution is found,
    #       or CollisionCheckError if the configuration is found but in collision. We will handle these errors below.
    ik_options["max_results"] = 1
    # NOTE: # We only need the joint values for the group to construct the JointTrajectoryPoint
    ik_options["return_full_configuration"] = False
    # NOTE: The PyBullet IK function is responsible for performing collision checking for this planning function
    # The ["check_collision"] in options is passed also to the ik_options

    # Echo target_mode
    # if options["verbose"]:
    #     print("Target Mode is: {}. Interpolation will happen with this reference".format("TOOL"))

    # Create synchronized dual arm waypoint constructs
    # Each arm will have its own FrameInterpolator for independent motion planning
    # This allows for more flexible dual arm coordination

    # Step 1: Convert transformations to frames for interpolation
    # FrameInterpolator requires Frame objects, not Transformation objects
    start_left_frame = Frame.from_transformation(start_world_from_left_tool0)
    goal_left_frame = Frame.from_transformation(goal_world_from_left_tool0)
    start_right_frame = Frame.from_transformation(start_world_from_right_tool0)
    goal_right_frame = Frame.from_transformation(goal_world_from_right_tool0)
    
    # Create separate interpolation objects for each arm
    left_arm_interpolator = FrameInterpolator(start_left_frame, goal_left_frame, options)
    right_arm_interpolator = FrameInterpolator(start_right_frame, goal_right_frame, options)

    # Step 2: Generate interpolated waypoints for each arm
    # Calculate number of waypoints based on distance and angle, using the maximum from both arms
    num_left_waypoints = max(2, left_arm_interpolator.regular_interpolation_steps + 1)
    num_right_waypoints = max(2, right_arm_interpolator.regular_interpolation_steps + 1)
    num_waypoints = max(num_left_waypoints, num_right_waypoints)
    
    left_arm_frames = []
    right_arm_frames = []

    for i in range(num_waypoints):
        t = i / (num_waypoints - 1) if num_waypoints > 1 else 0
        print(f't: {t}')
        
        # Interpolate each arm independently
        left_arm_frame = left_arm_interpolator.get_interpolated_frame(t)
        right_arm_frame = right_arm_interpolator.get_interpolated_frame(t)
        
        left_arm_frames.append(left_arm_frame)
        right_arm_frames.append(right_arm_frame)

    # Step 3: Create synchronized waypoint objects
    left_arm_waypoints = FrameWaypoints(
        target_frames=left_arm_frames,
        target_mode=TargetMode.ROBOT,
        name="Left Arm Waypoints",
        tolerance_position=options.get("tolerance_position", 0.001),
        tolerance_orientation=options.get("tolerance_orientation", 0.01)
    )

    right_arm_waypoints = FrameWaypoints(
        target_frames=right_arm_frames,
        target_mode=TargetMode.ROBOT,
        name="Right Arm Waypoints",
        tolerance_position=options.get("tolerance_position", 0.001),
        tolerance_orientation=options.get("tolerance_orientation", 0.01)
    )

    # Store both waypoint sets for later use
    dual_arm_waypoints = {
        "left_arm": left_arm_waypoints,
        "right_arm": right_arm_waypoints
    }
    
    # Create visualization objects for debugging - left/right arm tool0 frames
    # if options.get("verbose", False):
    if True:
        print("Creating visualization objects for left/right arm tool0 frames...")
        
        # Convert left arm frames to Rhino planes
        left_arm_planes = []
        for frame in left_arm_frames:
            plane = frame_to_rhino_plane(frame)
            left_arm_planes.append(plane)
        
        # Convert right arm frames to Rhino planes
        right_arm_planes = []
        for frame in right_arm_frames:
            plane = frame_to_rhino_plane(frame)
            right_arm_planes.append(plane)
        
        visualization_objects = {
            "left_arm_planes": left_arm_planes,
            "right_arm_planes": right_arm_planes
        }
        
        print(f"Created visualization objects:")
        print(f"  Left arm planes: {len(left_arm_planes)}")
        print(f"  Right arm planes: {len(right_arm_planes)}")
    
    # Store visualization objects in the result for output
    dual_arm_waypoints["visualization"] = visualization_objects

    # DUAL ARM SYNCHRONIZED INTERPOLATION
    # Instead of interpolating between arm waypoints, we use the pre-computed synchronized waypoints
    # This ensures both arms maintain fixed relative transformation throughout the trajectory

    # Get the synchronized waypoints for both arms
    left_arm_waypoints = dual_arm_waypoints["left_arm"]
    right_arm_waypoints = dual_arm_waypoints["right_arm"]

    # Verify we have the same number of waypoints for both arms
    assert len(left_arm_waypoints.target_frames) == len(right_arm_waypoints.target_frames), \
        "Left and right arm waypoints must have the same number of frames for synchronization"

    num_synchronized_waypoints = len(left_arm_waypoints.target_frames)

    if options["verbose"]:
        print(f"Using {num_synchronized_waypoints} synchronized waypoints for dual arm motion")
        print(f"Left arm start frame: {start_world_from_left_tool0}")
        print(f"Left arm goal frame: {goal_world_from_left_tool0}")
        print(f"Right arm start frame: {start_world_from_right_tool0}")
        print(f"Right arm goal frame: {goal_world_from_right_tool0}")

    # Initialize trajectories for both arms using input group names
    left_arm_trajectory = JointTrajectory(
        joint_names=robot_cell.get_configurable_joint_names(left_arm_group), 
        start_configuration=start_state.robot_configuration
    )
    right_arm_trajectory = JointTrajectory(
        joint_names=robot_cell.get_configurable_joint_names(right_arm_group), 
        start_configuration=start_state.robot_configuration
    )

    # Add start configurations
    left_joint_names = robot_cell.get_configurable_joint_names(left_arm_group)
    left_joint_types = robot_cell.get_configurable_joint_types(left_arm_group)
    right_joint_names = robot_cell.get_configurable_joint_names(right_arm_group) 
    right_joint_types = robot_cell.get_configurable_joint_types(right_arm_group)

    # Get start joint values for each arm
    left_start_joints = [start_state.robot_configuration[name] for name in left_joint_names]
    right_start_joints = [start_state.robot_configuration[name] for name in right_joint_names]

    left_arm_trajectory.points.append(
        JointTrajectoryPoint(joint_values=left_start_joints, joint_types=left_joint_types, joint_names=left_joint_names)
    )
    right_arm_trajectory.points.append(
        JointTrajectoryPoint(joint_values=right_start_joints, joint_types=right_joint_types, joint_names=right_joint_names)
    )

    # Process each synchronized waypoint
    for i in range(num_synchronized_waypoints):
        if options["verbose"]:
            print(f"Processing synchronized waypoint {i+1}/{num_synchronized_waypoints}")
        
        # Get the current synchronized frames for both arms
        left_target_frame = left_arm_waypoints.target_frames[i]
        right_target_frame = right_arm_waypoints.target_frames[i]
        
        # Create targets for both arms
        left_target = FrameTarget(
            left_target_frame,
            target_mode=TargetMode.ROBOT,
            tolerance_position=left_arm_waypoints.tolerance_position or 0.001,
            tolerance_orientation=left_arm_waypoints.tolerance_orientation or 0.01
        )
        
        right_target = FrameTarget(
            right_target_frame,
            target_mode=TargetMode.ROBOT,
            tolerance_position=right_arm_waypoints.tolerance_position or 0.001,
            tolerance_orientation=right_arm_waypoints.tolerance_orientation or 0.01
        )
        # print(ik_options)
    
        # Solve IK for both arms simultaneously with error handling for debugging
        try:
            # Solve IK for left arm
            # TODO this might cause collision if the start right arm state is not good
            # can ignore this collision for this check?
            # pp.draw_pose(pose_from_frame(left_target.target_frame))

            left_configuration = planner.inverse_kinematics(
                left_target, start_state, left_arm_group, ik_options
            )
            # print('left', left_configuration)
            
            # Solve IK for right arm  
            right_configuration = planner.inverse_kinematics(
                right_target, start_state, right_arm_group, ik_options
            )
            # print('right', right_configuration)
            
            # Extract joint values
            left_joint_values = [left_configuration[name] for name in left_joint_names]
            right_joint_values = [right_configuration[name] for name in right_joint_names]
            
            if options["verbose"]:
                print(f"Segment {i+1}, Left arm joint_values: {left_joint_values}")
                print(f"Segment {i+1}, Right arm joint_values: {right_joint_values}")
            
        # Catch errors and return None trajectories for debugging instead of raising
        except InverseKinematicsError as e:
            message = f"plan_dual_arm_cartesian_motion(): Segment {i+1}, Inverse Kinematics failed for dual arm motion.\n"
            message = message + e.message
            print(f"WARNING: {message}")
            print("Returning None trajectories for debugging - check frame visualization")
            
            # Return None trajectories with visualization data for debugging
            dual_arm_waypoints["left_arm_trajectory"] = None
            dual_arm_waypoints["right_arm_trajectory"] = None
            dual_arm_waypoints["error_message"] = message
            dual_arm_waypoints["error_segment"] = i + 1
            return dual_arm_waypoints

        except CollisionCheckError as e:
            message = f"plan_dual_arm_cartesian_motion(): Segment {i+1}, Collision detected for dual arm motion.\n"
            message = message + e.message
            print(f"WARNING: {message}")
            print("Returning None trajectories for debugging - check frame visualization")
            
            # Return None trajectories with visualization data for debugging
            dual_arm_waypoints["left_arm_trajectory"] = None
            dual_arm_waypoints["right_arm_trajectory"] = None
            dual_arm_waypoints["error_message"] = message
            dual_arm_waypoints["error_segment"] = i + 1
            return dual_arm_waypoints
        
        # Check joint jumps between the current and previous point's configuration for both arms
        if i > 0:  # Skip for first waypoint
            try:
                # Check left arm joint jump
                check_max_jump(
                    left_joint_names, left_joint_types, 
                    left_arm_trajectory.points[-1].joint_values, left_joint_values, options
                )
                
                # Check right arm joint jump
                check_max_jump(
                    right_joint_names, right_joint_types, 
                    right_arm_trajectory.points[-1].joint_values, right_joint_values, options
                )
                
            except MPMaxJumpError as e:
                # For dual arm, we can't easily subdivide like single arm, so we return None trajectories for debugging
                message = f"plan_dual_arm_cartesian_motion(): Segment {i+1}, Joint jump too large for dual arm motion.\n"
                message += f"Left arm jump: {e.message}\n"
                message += "Cannot subdivide dual arm motion - consider reducing step size or adjusting trajectory."
                print(f"WARNING: {message}")
                print("Returning None trajectories for debugging - check frame visualization")
                
                # Return None trajectories with visualization data for debugging
                dual_arm_waypoints["left_arm_trajectory"] = None
                dual_arm_waypoints["right_arm_trajectory"] = None
                dual_arm_waypoints["error_message"] = message
                dual_arm_waypoints["error_segment"] = i + 1
                return dual_arm_waypoints
        
        # This point is successful, add the JointTrajectoryPoint to both trajectories
        left_arm_trajectory.points.append(
            JointTrajectoryPoint(
                joint_values=left_joint_values, 
                joint_types=left_joint_types, 
                joint_names=left_joint_names,
                time_from_start=Duration(secs=i * 0.5, nsecs=0)
            )
        )
        
        right_arm_trajectory.points.append(
            JointTrajectoryPoint(
                joint_values=right_joint_values, 
                joint_types=right_joint_types, 
                joint_names=right_joint_names,
                time_from_start=Duration(secs=i * 0.5, nsecs=0)
            )
        )
        
        if options["verbose"]:
            print(f"Segment {i+1} of {num_synchronized_waypoints} completed - JointTrajectoryPoint added for both arms")

    # Store both trajectories in the dual_arm_waypoints for return
    dual_arm_waypoints["left_arm_trajectory"] = left_arm_trajectory
    dual_arm_waypoints["right_arm_trajectory"] = right_arm_trajectory

    if options["verbose"]:
        print(f"Dual arm synchronized motion planning completed:")
        print(f"  Left arm: {len(left_arm_trajectory.points)} trajectory points")
        print(f"  Right arm: {len(right_arm_trajectory.points)} trajectory points")

    # Merge both arm trajectories into one combined trajectory
    if left_arm_trajectory is not None and right_arm_trajectory is not None:
        print("Merging left and right arm trajectories into combined trajectory...")
        
        # Start with left arm trajectory as base
        new_trajectory = left_arm_trajectory.copy()
        
        # Get joint names for the right arm group
        group_joint_names = planner.client.robot_cell.get_configurable_joint_names(groups[1])
        print(group_joint_names)
        
        new_robot_cell_state = start_state.copy()
        # Merge each point from right arm trajectory
        for i, point in enumerate(right_arm_trajectory.points):
            new_trajectory.points[i] = JointTrajectoryPoint(
                joint_values=new_robot_cell_state.robot_configuration.joint_values, 
                joint_types=new_robot_cell_state.robot_configuration.joint_types, 
                joint_names=new_robot_cell_state.robot_configuration.joint_names,
                time_from_start=Duration(secs=i * 0.5, nsecs=0)
            )
            new_trajectory.points[i].merge(left_arm_trajectory.points[i])
            new_trajectory.points[i].merge(point)
        
        # Store the merged trajectory
        dual_arm_waypoints["combined_trajectory"] = new_trajectory
        
        if options["verbose"]:
            print(f"  Combined trajectory: {len(new_trajectory.points)} trajectory points")
            print(f"  Joint names: {new_trajectory.joint_names}")

    # Return the dual arm waypoints object containing both trajectories
    return dual_arm_waypoints

options = {
    "verbose": True,
    "check_collision": check_collision,
    "tolerance_position": tolerance_position,
    "tolerance_orientation": tolerance_orientation,
    "max_step_distance": 0.01,  # meters
    "max_step_angle": 0.1,  # radians
    "max_jump_prismatic": 0.1,
    "max_jump_revolute": pi / 2
}

# Call the function with the input parameters
# Note: These variables should be provided as inputs to the script from Grasshopper
# The following variables are expected to be defined in the Grasshopper environment:
# - planner: PyBulletPlanner instance
# - start_state: RobotCellState instance
# - start_world_from_left_tool0: Transformation (starting left arm tool0 pose in world coordinates)
# - goal_world_from_left_tool0: Transformation (goal left arm tool0 pose in world coordinates)
# - start_world_from_right_tool0: Transformation (starting right arm tool0 pose in world coordinates)
# - goal_world_from_right_tool0: Transformation (goal right arm tool0 pose in world coordinates)
# - groups: list containing two planning group names [base_left_arm_manipulator, base_right_arm_manipulator]
if trigger:
    start_world_from_left_tool0 = left_targets[0].world_from_tool0
    goal_world_from_left_tool0 = left_targets[1].world_from_tool0
    start_world_from_right_tool0 = right_targets[0].world_from_tool0
    goal_world_from_right_tool0 = right_targets[1].world_from_tool0

    result = plan_dual_arm_cartesian_motion(
        planner, start_state, options,
        start_world_from_left_tool0, goal_world_from_left_tool0,
        start_world_from_right_tool0, goal_world_from_right_tool0,
        groups
    )
    if 'combined_trajectory' in  result:
        new_trajectory = result["combined_trajectory"]

    # Extract visualization objects for debugging in Rhino
    if "visualization" in result:
        visualization = result["visualization"]
        
        # These variables are now available for visualization in Grasshopper:
        # - left_arm_planes: List of Rhino Plane objects for left arm tool0 frames
        # - right_arm_planes: List of Rhino Plane objects for right arm tool0 frames
        
        left_arm_planes = visualization["left_arm_planes"]
        right_arm_planes = visualization["right_arm_planes"]
        
        print("Visualization objects created and available for debugging:")
        print(f"  left_arm_planes: {len(left_arm_planes)} planes")
        print(f"  right_arm_planes: {len(right_arm_planes)} planes")
        
        # Check if trajectories are None (due to errors)
        if result.get("left_arm_trajectory") is None or result.get("right_arm_trajectory") is None:
            print("\n⚠️  WARNING: Trajectories are None due to planning errors!")
            if "error_message" in result:
                print(f"Error: {result['error_message']}")
            if "error_segment" in result:
                print(f"Failed at segment: {result['error_segment']}")
            print("Use the visualization objects to debug the frame positions and orientations.")
        else:
            print(f"\n✓ Successfully created trajectories:")
            print(f"  Left arm: {len(result['left_arm_trajectory'].points)} trajectory points")
            print(f"  Right arm: {len(result['right_arm_trajectory'].points)} trajectory points")
            
            # Show combined trajectory info if available
            if "combined_trajectory" in result:
                combined_traj = result["combined_trajectory"]
                print(f"  Combined: {len(combined_traj.points)} trajectory points")
                print(f"  Combined joint names: {combined_traj.joint_names}")
                
                # # Verify dual arm synchronization
                # print("\n" + "="*60)
                # print("DUAL ARM SYNCHRONIZATION VERIFICATION")
                # print("="*60)
                
                def verify_dual_arm_synchronization(planner, combined_trajectory, groups, start_world_from_left_tool0, start_world_from_right_tool0, tolerance=0.001):
                    """
                    Verify that the transformation between the two robot arms' tool0 frames is consistent
                    across all trajectory points using forward kinematics.
                    """
                    robot_cell = planner.client.robot_cell
                    left_arm_group = groups[0]
                    right_arm_group = groups[1]
                    
                    # Get joint names for each arm
                    left_joint_names = robot_cell.get_configurable_joint_names(left_arm_group)
                    right_joint_names = robot_cell.get_configurable_joint_names(right_arm_group)
                    
                    # Expected transformation between arms (left_tool0_from_right_tool0)
                    # This should be: start_world_from_left_tool0.inverse() * start_world_from_right_tool0
                    expected_left_tool0_from_right_tool0 = start_world_from_left_tool0.inverse() * start_world_from_right_tool0
                    
                    verification_results = {
                        "success": True,
                        "max_position_error": 0.0,
                        "max_orientation_error": 0.0,
                        "failed_points": [],
                        "details": []
                    }
                    
                    print("Verifying dual arm synchronization across trajectory points...")
                    
                    for i, point in enumerate(combined_trajectory.points):
                        # Extract joint values for each arm from the combined trajectory point
                        left_joint_values = [point[joint_name] for joint_name in left_joint_names]
                        right_joint_values = [point[joint_name] for joint_name in right_joint_names]
                        
                        # Create temporary robot cell states for forward kinematics
                        temp_state = start_state.copy()
                        temp_state.robot_configuration = combined_trajectory.start_configuration.copy()
                        
                        # Set joint values for each arm
                        for j, joint_name in enumerate(left_joint_names):
                            temp_state.robot_configuration[joint_name] = left_joint_values[j]
                        for j, joint_name in enumerate(right_joint_names):
                            temp_state.robot_configuration[joint_name] = right_joint_values[j]
                        
                        # Set robot state and get forward kinematics
                        planner.set_robot_cell_state(temp_state)
                        
                        # Get forward kinematics for both arms' tool0 frames
                        left_tool0_frame = planner.forward_kinematics(temp_state, TargetMode.ROBOT, group=left_arm_group)
                        right_tool0_frame = planner.forward_kinematics(temp_state, TargetMode.ROBOT, group=right_arm_group)
                        
                        # Calculate actual transformation between arms
                        world_from_left_tool0 = Transformation.from_frame(left_tool0_frame)
                        world_from_right_tool0 = Transformation.from_frame(right_tool0_frame)
                        left_tool0_from_right_tool0 = world_from_left_tool0.inverse() * world_from_right_tool0
                        # left_tool0_from_right_tool0 = Transformation.from_frame_to_frame(right_tool0_frame, left_tool0_frame)
                        
                        # Compare with expected transformation
                        position_error = (left_tool0_from_right_tool0.translation_vector - expected_left_tool0_from_right_tool0.translation_vector).length
                        
                        # Calculate orientation error by comparing axis vectors
                        # Convert transformations to frames to get axis vectors directly
                        actual_frame = Frame.from_transformation(left_tool0_from_right_tool0)
                        expected_frame = Frame.from_transformation(expected_left_tool0_from_right_tool0)
                        
                        # Get axis vectors directly from frames
                        actual_x_axis = actual_frame.xaxis
                        actual_y_axis = actual_frame.yaxis
                        actual_z_axis = actual_frame.zaxis
                        
                        expected_x_axis = expected_frame.xaxis
                        expected_y_axis = expected_frame.yaxis
                        expected_z_axis = expected_frame.zaxis
                        
                        # Calculate angles between corresponding axis vectors
                        x_axis_error = angle_vectors(actual_x_axis, expected_x_axis)
                        y_axis_error = angle_vectors(actual_y_axis, expected_y_axis)
                        z_axis_error = angle_vectors(actual_z_axis, expected_z_axis)
                        
                        # Use the maximum axis error as the overall orientation error
                        orientation_error = max(x_axis_error, y_axis_error, z_axis_error)
                        
                        # Update max errors
                        verification_results["max_position_error"] = max(verification_results["max_position_error"], position_error)
                        verification_results["max_orientation_error"] = max(verification_results["max_orientation_error"], orientation_error)
                        
                        # Check if this point fails verification
                        if position_error > tolerance or orientation_error > tolerance:
                            print(f'pt#{i} - pos error {position_error}, ori error {orientation_error}')
                            verification_results["success"] = False
                            verification_results["failed_points"].append(i)
                            verification_results["details"].append({
                                "point": i,
                                "position_error": position_error,
                                "orientation_error": orientation_error,
                                "left_tool0_frame": left_tool0_frame,
                                "right_tool0_frame": right_tool0_frame
                            })
                    
                    # Print verification results
                    if verification_results["success"]:
                        print(f"✓ Dual arm synchronization verification PASSED")
                        print(f"  Max position error: {verification_results['max_position_error']:.6f} m")
                        print(f"  Max orientation error: {verification_results['max_orientation_error']:.6f} rad")
                    else:
                        print(f"✗ Dual arm synchronization verification FAILED")
                        print(f"  Failed points: {len(verification_results['failed_points'])}/{len(combined_trajectory.points)}")
                        print(f"  Max position error: {verification_results['max_position_error']:.6f} m")
                        print(f"  Max orientation error: {verification_results['max_orientation_error']:.6f} rad")
                        print(f"  Failed at points: {verification_results['failed_points']}")
                    
                    return verification_results
                
                # # Run the verification
                # verification_result = verify_dual_arm_synchronization(
                #     planner, combined_traj, groups, start_world_from_left_tool0, start_world_from_right_tool0, tolerance=0.001
                # )
                
                # # Store verification results in the result dictionary
                # result["verification"] = verification_result
# ---------- end python_3_script_44 ----------
data_27 = Data(python_3_script_44.new_trajectory)

# ---- group: export json (continued)
data_28 = Data(tree_branch_12)
python_3_script_45 = Python3Script(
    save_robot_cell=save_robot_cell,
    save_state=save_state,
    save_traj=save_traj,
    robot_cell=python_3_script_7.robot_cell,
    robot_cell_state=stream_filter_6,
    approach_trajectory=data_26,
    retreat_trajectory=data_27,
    file_path=panel_22,
    state_name=panel_23)  # -> out, a; inputs file_path: String, state_name: String
# ---------- python_3_script_45: Python ----------
# export_robotcell_to_json.py

import json
import os
from datetime import datetime
from compas import json_dump, json_load
from compas_fab.robots import RobotCell, RobotCellState


def export_robotcell_and_state(content, filepath, file_prefix=None, approach_trajectory=None, retreat_trajectory=None):
    """
    Export RobotCell or RobotCellState to JSON with optional trajectory data.
    
    Parameters:
    -----------
    content : RobotCell or RobotCellState
        The content to export
    filepath : str
        Directory path where to save the files
    file_prefix : str, optional
        Prefix for the filename
    approach_trajectory : JointTrajectory, optional
        Approach trajectory to save alongside the state
    retreat_trajectory : JointTrajectory, optional
        Retreat trajectory to save alongside the state
    """
    os.makedirs(filepath, exist_ok=True)  # Ensure directory exists

    content_class = type(content).__name__
    if file_prefix:
        # If this is a RobotCellState, append timestamp for uniqueness
        if isinstance(content, RobotCellState):
            # timestamp = datetime.now().strftime("%Y%m%d_%H%M%S")
            # file_prefix = f"{file_prefix}_{timestamp}"
            pass
        file_name = f"{file_prefix}_{content_class}.json"
    else:
        file_name = f"{content_class}.json"

    full_path = os.path.join(filepath, file_name)

    with open(full_path, "w") as f:
        json_dump(content, f, pretty=True)

    print(f"Exported {content_class} to {full_path}")
    
    # If trajectories are provided and content is RobotCellState, also save the trajectories
    if isinstance(content, RobotCellState):
        if approach_trajectory is not None:
            trajectory_class = type(approach_trajectory).__name__
            if file_prefix:
                trajectory_file_name = f"{file_prefix}_approach_{trajectory_class}.json"
            else:
                trajectory_file_name = f"approach_{trajectory_class}.json"
            
            trajectory_path = os.path.join(filepath, trajectory_file_name)
            
            with open(trajectory_path, "w") as f:
                json_dump(approach_trajectory, f, pretty=True)
            
            print(f"Exported approach {trajectory_class} to {trajectory_path}")
        
        if retreat_trajectory is not None:
            trajectory_class = type(retreat_trajectory).__name__
            if file_prefix:
                trajectory_file_name = f"{file_prefix}_retreat_{trajectory_class}.json"
            else:
                trajectory_file_name = f"retreat_{trajectory_class}.json"
            
            trajectory_path = os.path.join(filepath, trajectory_file_name)
            
            with open(trajectory_path, "w") as f:
                json_dump(retreat_trajectory, f, pretty=True)
            
            print(f"Exported retreat {trajectory_class} to {trajectory_path}")


# Example usage:
# robot_cell, robot_cell_state, approach_trajectory, retreat_trajectory = ... (your objects)
if save_robot_cell and robot_cell is not None:
    export_robotcell_and_state(robot_cell, file_path)
if save_state and robot_cell_state is not None:
    export_robotcell_and_state(
        robot_cell_state,
        os.path.join(file_path, 'RobotCellStates'),
        state_name,
        approach_trajectory,  # Pass approach trajectory if available
        retreat_trajectory    # Pass retreat trajectory if available
    )
# ---------- end python_3_script_45 ----------
python_3_script_46 = Python3Script(save=save_state, targets=data_28, file_path=panel_22, state_name=panel_23)  # -> out, a; inputs targets: list
# ---------- python_3_script_46: Python ----------
import os
from compas.geometry import Transformation
from compas_rhino.conversions import plane_to_compas_frame
from compas import json_dump

def export_targets_to_json(targets, file_path, state_name):
    out_path = os.path.join(file_path, state_name + '_GraspTargets.json')
    with open(out_path, 'w') as f:
        json_dump(targets, f, pretty=True)
    print("Exported grasp targets to", out_path)

if save:
    cell_state_path = os.path.join(file_path, 'RobotCellStates')
    if not os.path.exists(cell_state_path):
        os.makedirs(cell_state_path)
    export_targets_to_json(targets, cell_state_path, state_name)
# ---------- end python_3_script_46 ----------
panel_28 = Panel(python_3_script_46.out)

# ----
panel_29 = Panel(python_3_script_45.out)
plane_23 = Plane(python_3_script_44.left_arm_planes)
list_item_16 = ListItem(List=plane_22, Index=number_slider_4, Wrap=False)
list_item_17 = ListItem(List=plane_21, Index=number_slider_4, Wrap=False)
list_item_18 = ListItem(List=plane_21, Index=0, Wrap=True)  # -> Item1, Item
list_item_19 = ListItem(List=python_3_script_41.left_planes, Index=0, Wrap=True)  # -> Item, Item1, Item2
stream_filter_7 = StreamFilter(Gate=viz_which_traj, Stream0=python_3_script_42.new_trajectory, Stream1=python_3_script_44.new_trajectory)
plane_24 = Plane(list_item_18.Item1)
plane_25 = Plane(list_item_19.Item1)
plane_26 = Plane(python_3_script_44.right_arm_planes)
deconstruct_plane_6 = DeconstructPlane(Plane=plane_24)  # -> Origin, XAxis, YAxis, ZAxis
deconstruct_plane_7 = DeconstructPlane(Plane=plane_25)  # -> Origin, XAxis, YAxis, ZAxis
panel_30 = Panel(python_3_script_42.out)
python_3_script_47 = Python3Script(planeA=plane_25, planeB=plane_24)  # -> out, a
# ---------- python_3_script_47: Python ----------
import Rhino.Geometry as rg
import numpy as np

# Inputs: planeA, planeB (both are Rhino.Geometry.Plane)
# Output: tf_matrix (4x4 transformation matrix as a list of lists)

def plane_to_matrix(plane):
    """Convert a Rhino Plane to a 4x4 transformation matrix."""
    x = plane.XAxis
    y = plane.YAxis
    z = plane.ZAxis
    o = plane.Origin
    return np.array([
        [x.X, y.X, z.X, o.X],
        [x.Y, y.Y, z.Y, o.Y],
        [x.Z, y.Z, z.Z, o.Z],
        [0,   0,   0,   1]
    ])

def compute_transformation_matrix(planeA, planeB):
    """Compute the transformation matrix from planeA to planeB."""
    matA = plane_to_matrix(planeA)
    matB = plane_to_matrix(planeB)
    tf = np.dot(np.linalg.inv(matA), matB)
    return tf

if planeA and planeB:
    tf_matrix = compute_transformation_matrix(planeA, planeB)
    # Print the transformation matrix
    print("Transformation matrix from planeA to planeB:")
    for row in tf_matrix:
        print(["{:.4f}".format(val) for val in row])
else:
    tf_matrix = None
    print("Please provide both planeA and planeB as inputs.")
# ---------- end python_3_script_47 ----------
panel_31 = Panel(python_3_script_44.out)
point_21 = Point(deconstruct_plane_7.Origin)
distance_2 = Distance(PointA=point_21, PointB=deconstruct_plane_6.Origin)
python_3_script_48 = Python3Script(robot_cell_state=stream_filter_6, trajectory=stream_filter_7, t=traj_t)  # -> out, intermediate_robot_cell_state; inputs t: Double
# ---------- python_3_script_48: Python ----------
import math
intermediate_robot_cell_state = robot_cell_state.copy()  # type: RobotCellState

step = math.floor(t*(len(trajectory.points)-1))

print("Step: {} - joint_values = {}".format(step, trajectory.points[step].joint_values))
intermediate_robot_cell_state.robot_configuration.merge(trajectory.points[step])
# planner.set_robot_cell_state(intermediate_robot_cell_state)
# ---------- end python_3_script_48 ----------
stream_filter_8 = StreamFilter(Gate=viz_traj, Stream0=stream_filter_6, Stream1=python_3_script_48.intermediate_robot_cell_state)

# ---- group: viz
python_3_script_49 = Python3Script(
    trigger=python_3_script_7.out,
    robot_cell=data_20,
    robot_cell_state=stream_filter_8,
    vis_options=python_3_script_9.options)  # -> out, draw, left_tool0_frame, right_tool0_frame
# ---------- python_3_script_49: Python ----------
#sss vsenv: compas_fab_dev

import scriptcontext as sc
from compas.scene import SceneObject
from compas.scene import Scene
from compas_rhino.conversions import frame_to_rhino_plane
from compas.geometry import Frame, Transformation
from compas_fab.robots import TargetMode

from compas_ghpython import create_id

# This script will leak memory due to unused and untracked sceneobject in sticky

debug = True
def debug_print(s):
    if debug:
        print(s)

# Create hash (scope limited to this component) for cacheing SceneObject
# The Data.sha256 function includes the guid of the compas object
#object_hash = object.sha256(as_string=True)
# The ID function is much faster than the sha256()
object_hash = str(id(robot_cell))
options_hash = vis_options.sha256(True)
# The ghenv.Component has a guid assigned by GH to each component instance
gh_component = ghenv.Component
sticky_id = create_id(gh_component, object_hash +"_"+ options_hash+str(single_arm))
debug_print("Cacheing ID: '{}'".format(sticky_id))

# If scene object exist in sticky
scene_object = None
if sc.sticky.has_key(sticky_id):
    scene_object = sc.sticky[sticky_id]
    # Double check if the item is the same
    if scene_object.item is robot_cell:
        debug_print("SceneObject '{}' reused for '{}'".format(type(scene_object).__name__, type(object).__name__))

# Create Scene Object
if scene_object is None:
    scene = Scene()
    kwargs = vis_options.__data__
    scene_object = scene.add(robot_cell, **kwargs)
    debug_print("SceneObject {} newly created for {}".format(type(scene_object).__name__, type(object).__name__))
    sc.sticky[sticky_id] = scene_object

# print(scene_object._scale)
draw = scene_object.draw(robot_cell_state)
world_from_base = Transformation.from_frame(robot_cell_state.robot_base_frame)
if not single_arm:
    left_tool0_cp_frame = robot_cell.robot_model.forward_kinematics(robot_cell_state.robot_configuration, link_name='left_ur_arm_tool0')
    base_from_left_tool0_frame = Transformation.from_frame(left_tool0_cp_frame)    
    left_tool0_frame = frame_to_rhino_plane(Frame.from_transformation(world_from_base * base_from_left_tool0_frame))

    right_tool0_cp_frame = robot_cell.robot_model.forward_kinematics(robot_cell_state.robot_configuration, link_name='right_ur_arm_tool0')
    base_from_right_tool0_frame = Transformation.from_frame(right_tool0_cp_frame)
    right_tool0_frame = frame_to_rhino_plane(Frame.from_transformation(world_from_base * base_from_right_tool0_frame))

    print(left_tool0_cp_frame)
    print(right_tool0_cp_frame)
else:
    base_from_tool0_frame = Transformation.from_frame(
        robot_cell.robot_model.forward_kinematics(robot_cell_state.robot_configuration, link_name='ur_arm_tool0'))
    tool0_frame = frame_to_rhino_plane(Frame.from_transformation(world_from_base * base_from_tool0_frame))
# ---------- end python_3_script_49 ----------
draw = GhPythonScript(planes=[python_3_script_49.left_tool0_frame, python_3_script_49.right_tool0_frame], scale=Slider(0.1, range=0..1))  # -> P, V, C, W; inputs planes: list
# ---------- draw: Python ----------
from System.Drawing import Color

red = Color.FromArgb(255, 0, 0)
green = Color.FromArgb(0, 255, 0)
blue = Color.FromArgb(0, 0, 255)

P = []
V = []
C = []

scale = float(scale)

for plane in planes:
    if not plane:
        continue
    P += [plane.Origin] * 3
    V.append(plane.XAxis * scale)
    V.append(plane.YAxis * scale)
    V.append(plane.ZAxis * scale)
    C += [red, green, blue]

W = 3
# ---------- end draw ----------
vdisex = VectorDisplayEx(Point=draw.P, Vector=draw.V, Colour=draw.C, Width=draw.W)

# ----
python_3_script_50 = Python3Script(planner=python_3_script_11.planner, robot_cell_state=stream_filter_8)  # -> out, a; disabled
# ---------- python_3_script_50: Python ----------
from compas_fab.robots import TargetMode

left_target_frame = planner.forward_kinematics(robot_cell_state, 
    TargetMode.ROBOT)
print(left_target_frame)
# ---------- end python_3_script_50 ----------

# ---- group: robot mesh
mesh_37 = Mesh(python_3_script_49.draw)

# ----
panel_32 = Panel(python_3_script_47.out)
angle_3 = Angle(VectorA=deconstruct_plane_7.XAxis, VectorB=deconstruct_plane_6.XAxis)  # -> Angle, Reflex
panel_33 = Panel(distance_2)
degrees_3 = Degrees(Radians=angle_3.Angle)
panel_34 = Panel(degrees_3)

# ---- group: loading traj
panel_35 = Panel("D:\0_Project\03-2025_husky_assembly\Code\husky-assembly-teleop\data\husky_assembly_design_study\250904_transfer_path_test\RobotCellStates")
panel_36 = Panel("IK_test__20250909_232554_JointTrajectory.json")
panel_37 = Panel("D:\Temp\husky_assembly_tamp\data")
panel_38 = Panel("robotx_box_A6-S4_end_robot_trajectory_joint_res_0.01deg.json")
python_3_script_51 = Python3Script(robot_cell_state=stream_filter_6, path=panel_37, file_name=panel_38, t=traj_t)  # -> out, intermediate_robot_cell_state; inputs t: Double; disabled
# ---------- python_3_script_51: Python ----------
import math
import os
from compas.data import json_load
from compas.geometry import Frame, Transformation
from compas.geometry import angle_vectors
from compas_fab.robots import TargetMode

# Joint names for dual arm Husky robot
HUSKY_DUAL_ARM_JOINT_NAMES_LEFT = [
    "left_ur_arm_shoulder_pan_joint", 
    "left_ur_arm_shoulder_lift_joint", 
    "left_ur_arm_elbow_joint", 
    "left_ur_arm_wrist_1_joint", 
    "left_ur_arm_wrist_2_joint", 
    "left_ur_arm_wrist_3_joint"
]

HUSKY_DUAL_ARM_JOINT_NAMES_RIGHT = [
    "right_ur_arm_shoulder_pan_joint", 
    "right_ur_arm_shoulder_lift_joint", 
    "right_ur_arm_elbow_joint", 
    "right_ur_arm_wrist_1_joint", 
    "right_ur_arm_wrist_2_joint", 
    "right_ur_arm_wrist_3_joint"
]

import math
intermediate_robot_cell_state = robot_cell_state.copy()  # type: RobotCellState

trajectory_path = os.path.join(path, file_name)
trajectory = json_load(trajectory_path)

step = math.floor(t*(len(trajectory.points)-1))

trajectory.points[step].joint_names = HUSKY_DUAL_ARM_JOINT_NAMES_LEFT + HUSKY_DUAL_ARM_JOINT_NAMES_RIGHT
print("Step: {} - joint_values = {}".format(step, trajectory.points[step].joint_values))
intermediate_robot_cell_state.robot_configuration.merge(trajectory.points[step])
# planner.set_robot_cell_state(intermediate_robot_cell_state)
# ---------- end python_3_script_51 ----------
python_3_script_52 = Python3Script(planner=python_3_script_27.planner, groups=merge_19, robot_cell_state=stream_filter_6, path=panel_37, file_name=panel_38)  # -> out; inputs groups: list; disabled
# ---------- python_3_script_52: Python ----------
import math
import os
from compas.data import json_load
from compas.geometry import Frame, Transformation
from compas.geometry import angle_vectors
from compas_fab.robots import TargetMode

# Joint names for dual arm Husky robot
HUSKY_DUAL_ARM_JOINT_NAMES_LEFT = [
    "left_ur_arm_shoulder_pan_joint", 
    "left_ur_arm_shoulder_lift_joint", 
    "left_ur_arm_elbow_joint", 
    "left_ur_arm_wrist_1_joint", 
    "left_ur_arm_wrist_2_joint", 
    "left_ur_arm_wrist_3_joint"
]

HUSKY_DUAL_ARM_JOINT_NAMES_RIGHT = [
    "right_ur_arm_shoulder_pan_joint", 
    "right_ur_arm_shoulder_lift_joint", 
    "right_ur_arm_elbow_joint", 
    "right_ur_arm_wrist_1_joint", 
    "right_ur_arm_wrist_2_joint", 
    "right_ur_arm_wrist_3_joint"
]

def load_and_validate_trajectory(trajectory_path, planner, robot_cell_state, groups, tolerance=0.001):
    """
    Load a trajectory and validate that all points maintain consistent tool0-to-tool0 transformation.
    
    Args:
        trajectory_path (str): Path to the trajectory JSON file
        planner: Robot planner instance with forward kinematics capabilities
        groups: List containing [left_arm_group, right_arm_group]
        tolerance (float): Tolerance for position and orientation errors
    
    Returns:
        dict: Validation results
    """
    
    # Step 1: Load trajectory from given path
    print(f"Loading trajectory from: {trajectory_path}")
    trajectory = json_load(trajectory_path)
    print(f"Loaded trajectory with {len(trajectory.points)} points")
    
    # # Step 2: Set joint names if not provided (check at trajectory point level)
    # if not hasattr(trajectory.points[0], 'joint_names') or not trajectory.points[0].joint_names:
    #     # Set joint names for all trajectory points
    #     for point in trajectory.points:
    #         point.joint_names = HUSKY_DUAL_ARM_JOINT_NAMES_LEFT + HUSKY_DUAL_ARM_JOINT_NAMES_RIGHT
    #     print("Set joint names using predefined constants for all trajectory points")
    # else:
    #     print(f"Using existing joint names: {trajectory.points[0].joint_names}")
    
    # Get robot cell and joint names for each arm
    robot_cell = planner.client.robot_cell
    left_arm_group = groups[0]
    right_arm_group = groups[1]
    
    left_joint_names = robot_cell.get_configurable_joint_names(left_arm_group)
    right_joint_names = robot_cell.get_configurable_joint_names(right_arm_group)

    # INSERT_YOUR_CODE
    # Check that left_joint_names and right_joint_names match the expected HUSKY joint name lists
    if left_joint_names != HUSKY_DUAL_ARM_JOINT_NAMES_LEFT:
        raise ValueError(f"left_joint_names do not match HUSKY_DUAL_ARM_JOINT_NAMES_LEFT.\n"
                         f"left_joint_names: {left_joint_names}\n"
                         f"Expected: {HUSKY_DUAL_ARM_JOINT_NAMES_LEFT}")
    if right_joint_names != HUSKY_DUAL_ARM_JOINT_NAMES_RIGHT:
        raise ValueError(f"right_joint_names do not match HUSKY_DUAL_ARM_JOINT_NAMES_RIGHT.\n"
                         f"right_joint_names: {right_joint_names}\n"
                         f"Expected: {HUSKY_DUAL_ARM_JOINT_NAMES_RIGHT}")
    
    # Step 3: Compute expected transformation from first trajectory point
    print("\nComputing expected tool0-to-tool0 transformation from first trajectory point...")
    
    # Get first trajectory point
    first_point = trajectory.points[0]
    # Give first_point joint_names if it doesn't have
    if not hasattr(first_point, 'joint_names') or not first_point.joint_names:
        first_point.joint_names = HUSKY_DUAL_ARM_JOINT_NAMES_LEFT + HUSKY_DUAL_ARM_JOINT_NAMES_RIGHT
    
    # Extract joint values for each arm from the first point
    left_joint_values = [first_point[joint_name] for joint_name in left_joint_names]
    right_joint_values = [first_point[joint_name] for joint_name in right_joint_names]
    
    # Create temporary robot cell state for forward kinematics
    temp_state = robot_cell_state.copy()
    
    # Set joint values for each arm
    for j, joint_name in enumerate(left_joint_names):
        temp_state.robot_configuration[joint_name] = left_joint_values[j]
    for j, joint_name in enumerate(right_joint_names):
        temp_state.robot_configuration[joint_name] = right_joint_values[j]
    
    # Set robot state and get forward kinematics for first point
    planner.set_robot_cell_state(temp_state)
    
    # Get forward kinematics for both arms' tool0 frames from first point
    left_tool0_frame = planner.forward_kinematics(temp_state, TargetMode.ROBOT, group=left_arm_group)
    right_tool0_frame = planner.forward_kinematics(temp_state, TargetMode.ROBOT, group=right_arm_group)
    
    # Calculate expected transformation between arms (left_tool0_from_right_tool0)
    world_from_left_tool0 = Transformation.from_frame(left_tool0_frame)
    world_from_right_tool0 = Transformation.from_frame(right_tool0_frame)
    expected_left_tool0_from_right_tool0 = world_from_left_tool0.inverse() * world_from_right_tool0
    
    print(f"Expected left_tool0_from_right_tool0 transformation computed from first point")
    
    # Step 4: Check all trajectory points maintain the same transformation
    print("\n" + "="*60)
    print("TRAJECTORY VALIDATION - TOOL0 TO TOOL0 TRANSFORMATION CONSISTENCY")
    print("="*60)
    
    verification_results = {
        "success": True,
        "max_position_error": 0.0,
        "max_orientation_error": 0.0,
        "failed_points": [],
        "details": [],
        "expected_transformation": expected_left_tool0_from_right_tool0
    }
    
    print("Verifying tool0-to-tool0 transformation consistency across all trajectory points...")
    
    for i, point in enumerate(trajectory.points):
        if not hasattr(point, 'joint_names') or not point.joint_names:
            point.joint_names = HUSKY_DUAL_ARM_JOINT_NAMES_LEFT + HUSKY_DUAL_ARM_JOINT_NAMES_RIGHT

        # Extract joint values for each arm from the current trajectory point
        left_joint_values = [point[joint_name] for joint_name in left_joint_names]
        right_joint_values = [point[joint_name] for joint_name in right_joint_names]
        
        # Create temporary robot cell state for forward kinematics
        temp_state = robot_cell_state.copy()
        
        # Set joint values for each arm
        for j, joint_name in enumerate(left_joint_names):
            temp_state.robot_configuration[joint_name] = left_joint_values[j]
        for j, joint_name in enumerate(right_joint_names):
            temp_state.robot_configuration[joint_name] = right_joint_values[j]
        
        # Set robot state and get forward kinematics
        planner.set_robot_cell_state(temp_state)
        
        # Get forward kinematics for both arms' tool0 frames
        left_tool0_frame = planner.forward_kinematics(temp_state, TargetMode.ROBOT, group=left_arm_group)
        right_tool0_frame = planner.forward_kinematics(temp_state, TargetMode.ROBOT, group=right_arm_group)
        
        # Calculate actual transformation between arms
        world_from_left_tool0 = Transformation.from_frame(left_tool0_frame)
        world_from_right_tool0 = Transformation.from_frame(right_tool0_frame)
        actual_left_tool0_from_right_tool0 = world_from_left_tool0.inverse() * world_from_right_tool0
        
        # Compare with expected transformation
        position_error = (actual_left_tool0_from_right_tool0.translation_vector - 
                         expected_left_tool0_from_right_tool0.translation_vector).length
        
        # Calculate orientation error by comparing axis vectors
        # Convert transformations to frames to get axis vectors directly
        actual_frame = Frame.from_transformation(actual_left_tool0_from_right_tool0)
        expected_frame = Frame.from_transformation(expected_left_tool0_from_right_tool0)
        
        # Get axis vectors directly from frames
        actual_x_axis = actual_frame.xaxis
        actual_y_axis = actual_frame.yaxis
        actual_z_axis = actual_frame.zaxis
        
        expected_x_axis = expected_frame.xaxis
        expected_y_axis = expected_frame.yaxis
        expected_z_axis = expected_frame.zaxis
        
        # Calculate angles between corresponding axis vectors
        x_axis_error = angle_vectors(actual_x_axis, expected_x_axis)
        y_axis_error = angle_vectors(actual_y_axis, expected_y_axis)
        z_axis_error = angle_vectors(actual_z_axis, expected_z_axis)
        
        # Use the maximum axis error as the overall orientation error
        orientation_error = max(x_axis_error, y_axis_error, z_axis_error)
        
        # Update max errors
        verification_results["max_position_error"] = max(verification_results["max_position_error"], position_error)
        verification_results["max_orientation_error"] = max(verification_results["max_orientation_error"], orientation_error)
        
        # Check if this point fails verification
        if position_error > tolerance or orientation_error > tolerance:
            print(f'Point #{i}: position error {position_error:.6f} m, orientation error {orientation_error:.6f} rad')
            verification_results["success"] = False
            verification_results["failed_points"].append(i)
            verification_results["details"].append({
                "point": i,
                "position_error": position_error,
                "orientation_error": orientation_error,
                "left_tool0_frame": left_tool0_frame,
                "right_tool0_frame": right_tool0_frame
            })
    
    # Print verification results
    print("\n" + "="*60)
    if verification_results["success"]:
        print("✓ Trajectory validation PASSED")
        print(f"  All {len(trajectory.points)} points maintain consistent tool0-to-tool0 transformation")
        print(f"  Max position error: {verification_results['max_position_error']:.6f} m")
        print(f"  Max orientation error: {verification_results['max_orientation_error']:.6f} rad")
    else:
        print("✗ Trajectory validation FAILED")
        print(f"  Failed points: {len(verification_results['failed_points'])}/{len(trajectory.points)}")
        print(f"  Max position error: {verification_results['max_position_error']:.6f} m")
        print(f"  Max orientation error: {verification_results['max_orientation_error']:.6f} rad")
        print(f"  Failed at points: {verification_results['failed_points']}")
    print("="*60)
    
    return verification_results

import os
trajectory_path = os.path.join(path, file_name)
result = load_and_validate_trajectory(trajectory_path, planner, robot_cell_state, groups, tolerance=0.001)
# ---------- end python_3_script_52 ----------
panel_39 = Panel(python_3_script_52)

# ----
plane_27 = Plane([python_3_script_49.left_tool0_frame, python_3_script_49.right_tool0_frame])
orient_21 = Orient(Geometry=block_instance_5, Source=PlaneXY(0, 0, 0), Target=plane_27)  # -> Geometry, Transform
custom_preview = CustomPreview(
    Geometry=orient_21.Geometry,
    Material={diffuse=RGB(221, 160, 221), emission=RGB(66, 48, 66), shine=0.5, specular=RGB(255, 255, 255), transparency=0})
deconstruct_plane_8 = DeconstructPlane(Plane=plane_19)  # -> Origin, XAxis, YAxis, ZAxis
list_item_20 = ListItem(List=plane_27, Index=0, Wrap=True)  # -> Item, Item1
deconstruct_plane_9 = DeconstructPlane(Plane=plane_27)  # -> Origin, XAxis, YAxis, ZAxis
point_22 = Point(deconstruct_plane_8.Origin)
python_3_script_53 = Python3Script(planeA=list_item_20.Item, planeB=list_item_20.Item1)  # -> out, a; same code as python_3_script_47
distance_3 = Distance(PointA=point_22, PointB=deconstruct_plane_9.Origin)
list_item_21 = ListItem(List=deconstruct_plane_8.ZAxis, Index=0, Wrap=True)  # -> Item, Item1
panel_40 = Panel(python_3_script_53.out)
angle_4 = Angle(VectorA=list_item_21.Item, VectorB=list_item_21.Item1)  # -> Angle, Reflex
panel_41 = Panel(distance_3)
degrees_4 = Degrees(Radians=angle_4.Angle)
panel_42 = Panel(degrees_4)

# ==== cluster Cluster
curve = ClusterInput()
end_points = EndPoints(Curve=curve)  # -> Start, End
vector_2pt = Vector2Pt(PointA=end_points.Start, PointB=end_points.End, Unitize=False)  # -> Vector, Length
vector = ClusterOutput(vector_2pt.Vector)

# ==== cluster Cluster_2
curve = ClusterInput()
curve_2 = ClusterInput()
curve_3 = Curve(curve)
curve_4 = Curve(curve_2)
curve_curve = CurveCurve(CurveA=curve_3, CurveB=curve_4)  # -> Points, ParamsA, ParamsB
construct_plane = ConstructPlane(Origin=curve_curve.Points, XAxis=curve_3, YAxis=curve_4)
plane = ClusterOutput(construct_plane)

# ==== cluster Cluster_3
curve = ClusterInput()
curve_2 = ClusterInput()
curve_3 = Curve(curve)
curve_4 = Curve(curve_2)
curve_middle = CurveMiddle(Curve=curve_4)
cross_product = CrossProduct(VectorA=curve_4, VectorB=curve_3, Unitize=False)  # -> Vector, Length
construct_plane = ConstructPlane(Origin=curve_middle, XAxis=cross_product.Vector, YAxis=curve_4)
plane = ClusterOutput(construct_plane)
